# Grasshopper definition 200119_Robo+tool.gh (Grasshopper 1.0.7)
# plug-ins: MeshEdit Components, Human, KUKA|prc - parametric robot control, Kangaroo2 Components

number_slider = Slider(1000, range=0..1000)

height_of_wooden_bar_from_sides = Slider(0.04, range=0..1)
additional_bar_length = Slider(0.69, range=0.1..2)
half_width_of_wooden_bar = Slider(0.11, range=0..1)
radius = Slider(0.6, range=0.6..2)

multiplication = Multiplication(A=number_slider, B=Slider(0.1866, range=0..0.6))
number_slider_2 = Slider(1000, range=0..1000)  # disabled
number_slider_3 = Slider(3, range=0..10)  # disabled
boundary = BoundarySurfaces()
multiplication_2 = Multiplication(A=number_slider, B=Slider(0.038, range=0..0.3))
H = Slider(0.076, range=0..1.1)  # disabled
Y = Slider(0.11, range=0.1..1.1)  # disabled
X = Slider(0.23, range=0.1..1.1)  # disabled

no_of_segments_octagon = Slider(4, range=4..12)
number_slider_4 = Slider(1.2, range=1.2..2)

multiplication_3 = Multiplication(A=number_slider_2, B=Y)  # disabled
multiplication_4 = Multiplication(A=number_slider_2, B=X)  # disabled
series = Series(Start=0, Step=multiplication_3, Count=number_slider_3)  # disabled
multiplication_5 = Multiplication(A=number_slider_2, B=H)  # disabled
series_2 = Series(Start=0, Step=multiplication_4, Count=number_slider_3)  # disabled
Y_2 = UnitY(Factor=expr("-x", series))  # disabled
kr6_16_arc = KR616ArcRobot(infiniterot=False)  # disabled
Y_3 = UnitY(Factor=expr("0.6*x", series_2))  # disabled
number_slider_5 = Slider(2, range=0..3)  # disabled
number_slider_6 = Slider(0, range=0..3)  # disabled
number_slider_7 = Slider(1, range=0..3)  # disabled
Z = UnitZ(Factor=multiplication_5)  # disabled
toggle = BooleanToggle(False)  # disabled
number_slider_8 = Slider(0.6, range=0..1)  # disabled
toggle_2 = BooleanToggle(True)  # disabled
number_slider_9 = Slider(90, range=0..360)  # disabled
multiplication_6 = Multiplication(A=number_slider, B=Slider(0.0324, range=0.01..0.5))
number_slider_10 = Slider(3, range=0..10)  # disabled
digital_out = DigitalOutputKUKAPrc(DigitalOutputNumber=toggle, OutputState=False, ContinuousMovement=False, ToolState=-1)  # disabled
digital_out_2 = DigitalOutputKUKAPrc(DigitalOutputNumber=toggle_2, OutputState=False, ContinuousMovement=False, ToolState=-1)  # disabled
multiplication_7 = Multiplication(A=number_slider_2, B=number_slider_8)  # disabled
wait = WaitKUKAPrc(KUKAPrcWait=1)  # disabled
multiplication_8 = Multiplication(A=number_slider, B=Slider(0.0154, range=0.001..0.15))
Z_2 = UnitZ(Factor=multiplication_7)  # disabled
dup = DuplicateData(Data=wait, Number=number_slider_10, Order=True)  # disabled
dup_2 = DuplicateData(Data=digital_out, Number=number_slider_10, Order=True)  # disabled
dup_3 = DuplicateData(Data=digital_out_2, Number=number_slider_10, Order=True)  # disabled
multiplication_9 = Multiplication(A=number_slider, B=Slider(1.2, range=0.1..3))
multiplication_10 = Multiplication(A=number_slider, B=Slider(0.55, range=0.1..0.7))
kr90_kr270_r2500 = QuantecKR90KR270R2500Robot(infiniterot=False)  # disabled
kr90_kr270_r3100 = QuantecKR90KR270R3100Robot(infiniterot=False)  # disabled
kr120_r3900k = QuantecKR120R3900KRobot(infiniterot=False)  # disabled
kr6_10_r1100_2 = AgilusKR610R11002Robot(infiniterot=False)  # disabled
knob = ControlKnob(Decimals=2, Limit=True, Maximum=1, Minimum=0, Range=1, Value=0.47)  # disabled
item = TreeItem(Index=0, Wrap=True)  # disabled
panel = Panel("{")  # disabled
panel_2 = Panel("}")  # disabled
shatter = Shatter()  # disabled
explode = Explode(Recursive=True)  # -> Segments, Vertices; disabled

number_slider_11 = Slider(0.0009, range=0..0.001)
timer = Timer(TimerInterval=20, Target=number_slider_11)  # disabled
rec = DataRecorder(number_slider_11, DataLimit=-10, RecordData=True)
ma = MassAddition(Input=rec)  # -> Result, PartialResults
larger = LargerThan(FirstNumber=ma.Result, SecondNumber="1")  # -> LargerThan, OrEqualTo
p_n_c = PickNChoose(Pattern=larger.LargerThan, Stream0=ma.Result)

Z_3 = UnitZ(Factor=multiplication_2)
pt = ConstructPoint(XCoordinate=0, YCoordinate=0, ZCoordinate=Z_3)
xy = XYPlane(Origin=pt)
cir = Circle(Plane=xy, Radius=multiplication)
boundary_2 = BoundarySurfaces(Edges=cir)
extr = Extrude(Base=boundary_2, Direction=Z_3)
debrep = DeconstructBrep(Brep=extr)  # -> Faces, Edges, Vertices
list = ItemSelector(debrep.Faces, {"Trimmed Surface", "Untrimmed Surface", "Trimmed Surface"}, selected="Trimmed Surface")
md_slider = MDSlider(SliderMode=0, slider_value=Point(0.5, 0.5, 0.5), x_domain=Domain(0, 1), y_domain=Domain(0, 1), z_domain=Domain(0, 1))
evalsrf = EvaluateSurface(Surface=reparameterize(list), Point=md_slider)  # -> Point, Normal, UDirection, VDirection, Frame
multiplication_11 = Multiplication(A=multiplication, B=Slider(0.655, range=0.1..1.1))
circle = CircleCNR(Center=evalsrf.Point, Normal=evalsrf.Normal, Radius=multiplication_11)
eval = EvaluateCurve(Curve=circle, Parameter=Slider(0.773, range=0.7..0.8))  # -> Point, Tangent, Angle
mirror = Mirror(Geometry=eval.Point, Plane=PlaneYZ(0, 0, 0))  # -> Geometry, Transform
pdecon = Deconstruct(Point=mirror.Geometry)  # -> XComponent, YComponent, ZComponent
pt_2 = ConstructPoint(XCoordinate=pdecon.XComponent, YCoordinate=0, ZCoordinate=pdecon.ZComponent)
rec_3pt = Rectangle3Pt(PointA=pt_2, PointB=mirror.Geometry, PointC=eval.Point)  # -> Rectangle, Length
arrpolar = PolarArray(Geometry=rec_3pt.Rectangle, Plane=PlaneXY(0, 0, 0), Count="4", Angle=6.283185307)  # -> Geometry, Transform
item_2 = ListItem(List=arrpolar.Geometry, Index=0, Wrap=True)  # -> Item, Item1, Item2, Item3
filter = StreamFilter(Gate=Slider(0, range=0..1), Stream0=[item_2.Item, item_2.Item2], Stream1=[item_2.Item1, item_2.Item3])
filter_2 = StreamFilter(Gate=Slider(1, range=0..1), Stream0=[item_2.Item, item_2.Item2], Stream1=[item_2.Item1, item_2.Item3])
polygon = Polygon(Plane=evalsrf.Frame, Radius=multiplication_6, Segments="4", FilletRadius=multiplication_8)  # -> Polygon, Length
scale_nu = ScaleNU(Geometry=filter_2, Plane=PlaneXY(0, 0, 0), ScaleX=1, ScaleY=Slider(0.92, range=0..1), ScaleZ=1)  # -> Geometry, Transform
runion = RegionUnion(Curves=[filter, scale_nu.Geometry])
boundary_3 = BoundarySurfaces(Edges=polygon.Polygon)  # -> flatten(Surfaces)
boundary_4 = BoundarySurfaces(Edges=runion)  # -> flatten(Surfaces)
runion_2 = RegionUnion(Curves=[boundary_4, boundary_3])
extr_2 = Extrude(Base=runion_2, Direction=Z_3)  # -> simplify(Extrusion)
pt_3 = ConstructPoint(XCoordinate=0, YCoordinate=0, ZCoordinate=multiplication_9)
move = Move(Geometry=runion_2, Motion=Z_3)  # -> Geometry, Transform
extr_3 = ExtrudePoint(Base=move.Geometry, Point=pt_3)
Z_4 = UnitZ(Factor=multiplication_10)
data = Data(extr_2)
md_slider_2 = MDSlider(
    SliderMode=0,
    slider_value=Point(0.8040618896, 0.5029668808, 0.5),
    x_domain=Domain(0, 1),
    y_domain=Domain(0, 1),
    z_domain=Domain(0, 1))
yz = YZPlane(Origin=Point(0, 0, 0))
xz = XZPlane(Origin=Point(0, 0, 0))
move_2 = Move(Motion=Vector(0, 0, 10))  # -> Geometry, Transform
md_slider_3 = MDSlider(SliderMode=0, slider_value=Point(0.5, 0.5, 0.5), x_domain=Domain(0, 1), y_domain=Domain(0, 1), z_domain=Domain(0, 1))

multiplication_12 = Multiplication(A=number_slider, B=Slider(0.136, range=0..1))
arrpolar_2 = PolarArray(Geometry=rec_3pt.Rectangle, Plane=PlaneXY(0, 0, 0), Count="4", Angle=6.283185307)  # -> Geometry, Transform
extr_4 = ExtrudePoint(Base=move.Geometry, Point=pt_3)
multiplication_13 = Multiplication(A=number_slider, B=Slider(0.191, range=0..0.5))
multiplication_14 = Multiplication(A=number_slider, B=Slider(0.07, range=0..0.5))
multiplication_15 = Multiplication(A=number_slider, B=Slider(0.401, range=0..1))
multiplication_16 = Multiplication(A=number_slider, B=Slider(0.011, range=0..0.3))
multiplication_17 = Multiplication(A=number_slider, B=Slider(0.019, range=0..0.1))
multiplication_18 = Multiplication(A=number_slider, B=Slider(0.07, range=0..0.1))
multiplication_19 = Multiplication(A=number_slider, B=Slider(0.014, range=0..0.1))

neg = Negative(Value=multiplication_12)
dom = ConstructDomain(DomainStart=multiplication_12, DomainEnd=neg)
dom_2 = ConstructDomain(DomainStart=multiplication_12, DomainEnd=neg)
rectangle = Rectangle(Plane=PlaneXY(0, 0, 0), XSize=dom, YSize=dom_2, Radius=0)  # -> Rectangle, Length
neg_2 = Negative(Value=multiplication_14)
neg_3 = Negative(Value=multiplication_13)
dom_3 = ConstructDomain(DomainStart=multiplication_13, DomainEnd=neg_3)
dom_4 = ConstructDomain(DomainStart=multiplication_14, DomainEnd=neg_2)
Z_5 = UnitZ(Factor=multiplication_16)
Z_6 = UnitZ(Factor=multiplication_17)
Z_7 = UnitZ(Factor=multiplication_19)

boundary_5 = BoundarySurfaces(Edges=rectangle.Rectangle)
extr_5 = Extrude(Base=boundary_5, Direction=Z_3)

# ---- group: Place Location
number_slider_12 = Slider(0.68, range=0..2.5)  # disabled
number_slider_13 = Slider(0.14, range=0..2)  # disabled
number_slider_14 = Slider(-0.08, range=-1..1)  # disabled

# ----
subtraction = Subtraction(A=number_slider_12, B=H)  # disabled
multiplication_20 = Multiplication(A=number_slider_2, B=subtraction)  # disabled
rec_2 = Rectangle({Plane=PlaneXY(411.5297668, 22.60512148, 0), Size=Domain2(u=-445.5319408..445.5319408, v=-724.6603856..724.6603856)})  # disabled
boxrec = BoxRectangle(Rectangle=rec_2, Height=multiplication_20)  # disabled

multiplication_21 = Multiplication(A=number_slider_2, B=number_slider_13)  # disabled
multiplication_22 = Multiplication(A=number_slider_2, B=number_slider_12)  # disabled
multiplication_23 = Multiplication(A=number_slider_2, B=number_slider_14)  # disabled

# ---- group: Place Location (continued)
pt_4 = ConstructPoint(XCoordinate=multiplication_21, YCoordinate=multiplication_23, ZCoordinate=multiplication_22)  # disabled

# ----
move_3 = Move(Geometry=pt_4, Motion=Y_3)  # -> Geometry, Transform; disabled
item_3 = ListItem(List=move_3.Geometry, Index=number_slider_5, Wrap=True)  # disabled
item_4 = ListItem(List=move_3.Geometry, Index=number_slider_6, Wrap=True)  # disabled
item_5 = ListItem(List=move_3.Geometry, Index=number_slider_7, Wrap=True)  # disabled
move_4 = Move(Geometry=item_5, Motion=Z)  # -> Geometry, Transform; disabled
xy_2 = XYPlane(Origin=[item_4, item_3, move_4.Geometry])  # disabled
prot = RotatePlane(Plane=xy_2, Angle=degrees(number_slider_9))  # disabled
move_5 = Move(Geometry=prot, Motion=Z_2)  # -> Geometry, Transform; disabled

# ---- group: Place Location
number_slider_15 = Slider(0.85, range=0..1)  # disabled
number_slider_16 = Slider(-1, range=-1..1)  # disabled
number_slider_17 = Slider(0, range=0..100)  # disabled

# ----
multiplication_24 = Multiplication(A=number_slider_2, B=number_slider_16)  # disabled
multiplication_25 = Multiplication(A=number_slider_2, B=number_slider_15)  # disabled

# ---- group: Place Location (continued)
pt_5 = ConstructPoint(XCoordinate=multiplication_25, YCoordinate=multiplication_24, ZCoordinate=number_slider_17)  # disabled

# ----
rectangle_2 = Rectangle(Plane=pt_5, XSize=multiplication_4, YSize=multiplication_3, Radius=0)  # -> Rectangle, Length; disabled
boxrec_2 = BoxRectangle(Rectangle=rectangle_2.Rectangle, Height=multiplication_5)  # disabled
move_6 = Move(Geometry=boxrec_2, Motion=Y_2)  # -> Geometry, Transform; disabled
debrep_2 = DeconstructBrep(Brep=move_6.Geometry)  # -> Faces, Edges, Vertices; disabled
item_6 = ListItem(List=debrep_2.Faces, Index=0, Wrap=True)  # -> Item1, Item, Item1_2, Item2, Item3, Item4; disabled
area = Area(Geometry=item_6.Item1)  # -> Area, flatten(Centroid); disabled
data_2 = Data(item_6.Item4)  # disabled

# ---- group: Pick-up
xy_3 = XYPlane(Origin=area.Centroid)  # disabled

# ----
orient = Orient(Geometry=move_6.Geometry, Source=xy_3, Target=prot)  # -> Geometry, Transform; disabled
move_7 = Move(Geometry=xy_3, Motion=Z_2)  # -> Geometry, Transform; disabled

ptp_move = PTPMovementKUKAPrc(TargetAsPlane=move_5.Geometry, extaxenabled=False, interpolation="C_PTP")  # disabled
lin_move = LINearMovementKUKAPrc(TargetAsPlane=prot, extaxenabled=False, interpolation="C_DIS")  # disabled
ptp_move_2 = PTPMovementKUKAPrc(TargetAsPlane=move_7.Geometry, extaxenabled=False, interpolation="C_PTP")  # disabled
lin_move_2 = LINearMovementKUKAPrc(TargetAsPlane=xy_3, extaxenabled=False, interpolation="C_DIS")  # disabled

cmd_weave = CommandWeaverKUKAPrc(
    Command1=ptp_move_2,
    Command2=lin_move_2,
    Command3=dup_3,
    Command4=dup,
    Command5=ptp_move_2,
    Command6=ptp_move,
    Command7=lin_move,
    Command8=dup_2,
    Command9=dup,
    Command10=ptp_move,
    enabletree=False)  # disabled
kuka_prc = KUKAPrcCORE(
    SimulationSlider=knob,
    KUKAPrcCommands=cmd_weave,
    Robot=kr120_r3900k,
    PRC_BaseExpose=False,
    PRC_SaveNameExpose=False,
    PRCsettings="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")  # -> RobotGeometry, AnalysisOutput; disabled

height_of_wooden_bar_from_sides_2 = Slider(0.04, range=0..1)
size_of_screws = Slider(0.005, range=0..0.03)
additional_bar_length_2 = Slider(1.13, range=0.1..2)
half_width_of_wooden_bar_2 = Slider(0.27, range=0..1)
height_of_ring = Slider(0.017, range=0..0.5)
size_of_screws_2 = Slider(0.005, range=0..0.03)
eval_2 = Evaluate(F="x*1000", x=size_of_screws)
half_width_of_ring = Slider(0.02, range=0.01..0.1)
eval_3 = Evaluate(F="x*1000", x=radius)
number_slider_18 = Slider(45, range=0..100)
eval_4 = Evaluate(F="x*1000", x=size_of_screws_2)

# ----
# Inner base
polygon_2 = Polygon(Plane=PlaneXY(0, 0, 0), Radius=eval_3, Segments=no_of_segments_octagon, FilletRadius=0)  # -> Polygon, Length
cir_2 = Circle(Plane=PlaneXY(0, 0, 0), Radius=eval_3)
explode_2 = Explode(Curve=polygon_2.Polygon, Recursive=True)  # -> Segments, Vertices
item_7 = ListItem(List=explode_2.Segments, Index=0, Wrap=True)

vertices = Data(explode_2.Vertices)
duppt = RemoveDuplicatePts(Points=vertices, Tolerance=0.01)

# ----
# Depth adopted
base_circle = Data(cir_2)
eval_5 = Evaluate(F="x*1000", x=half_width_of_ring)
neg_4 = Negative(Value=eval_5)
offset = OffsetCurve(Curve=base_circle, Distance=eval_5, Plane=PlaneXY(0, 0, 0), Corners=1)
offset_2 = OffsetCurve(Curve=base_circle, Distance=neg_4, Plane=PlaneXY(0, 0, 0), Corners=1)
loft = Loft(
    Curves=[offset, offset_2],
    Options={Adjust=False, Closed=False, LoftEnds=0, LoftSimp=0, LoftType=0, Rebuild=10, Refit=0.01})

md_slider_4 = MDSlider(SliderMode=0, slider_value=Point(0.5, 0.5, 0.5), x_domain=Domain(0, 1), y_domain=Domain(0, 1), z_domain=Domain(0, 1))
evalsrf_2 = EvaluateSurface(Surface=loft, Point=md_slider_4)  # -> Point, Normal, UDirection, VDirection, Frame
eval_6 = Evaluate(F="x*1000", x=height_of_ring)
amp = Amplitude(Vector=evalsrf_2.Normal, Amplitude=eval_6)
extr_6 = Extrude(Base=loft, Direction=amp)

extr_7 = Extrude(Base=boundary_5, Direction=Z_3)

factor_for_equal_sides = Slider(1.84776, range=1.1..2)
area_2 = Area(Geometry=polygon_2.Polygon)  # -> Area, Centroid

eval_7 = Evaluate(F="x*2", x=no_of_segments_octagon)
multiplication_26 = Multiplication(A=eval_3, B=factor_for_equal_sides)
eval_8 = Evaluate(F="x*2", x=eval_3)

# ----
# Hole placement of outer
polygon_3 = Polygon(Plane=PlaneXY(0, 0, 0), Radius=multiplication_26, Segments=eval_7, FilletRadius=0)  # -> Polygon, Length
cir_3 = Circle(Plane=PlaneXY(0, 0, 0), Radius=multiplication_26)
explode_3 = Explode(Curve=polygon_3.Polygon, Recursive=True)  # -> Segments, Vertices
item_8 = ListItem(List=explode_3.Segments, Index=0, Wrap=True)

# ----
# Center of moving Circle
polygon_4 = Polygon(Plane=PlaneXY(0, 0, 0), Radius=eval_8, Segments=eval_7, FilletRadius=0)  # -> Polygon, Length
cir_4 = Circle(Plane=PlaneXY(0, 0, 0), Radius=eval_8)
explode_4 = Explode(Curve=polygon_4.Polygon, Recursive=True)  # -> Segments, Vertices
area_3 = Area(Geometry=polygon_4.Polygon)  # -> Area, Centroid

area_4 = Area(Geometry=polygon_3.Polygon)  # -> Area, Centroid

number_slider_19 = Slider(22.5, range=0..100)
rotate = Rotate(Geometry=explode_3.Vertices, Angle=degrees(number_slider_19), Plane=area_4.Centroid)  # -> Geometry, Transform
rotate_2 = Rotate(Geometry=explode_3.Segments, Angle=degrees(number_slider_19), Plane=area_4.Centroid)  # -> Geometry, Transform

rotate_3 = Rotate(Geometry=explode_4.Segments, Angle=degrees(number_slider_19), Plane=area_3.Centroid)  # -> Geometry, Transform
rotate_4 = Rotate(Geometry=explode_4.Vertices, Angle=degrees(number_slider_19), Plane=area_3.Centroid)  # -> Geometry, Transform

# ----
# The Octagon Wings (unmodified)
eval_9 = Evaluate(F="x*1000", x=half_width_of_wooden_bar)
neg_5 = Negative(Value=eval_9)
eval_10 = Evaluate(F="x*1000", x=additional_bar_length)
offset_3 = OffsetCurve(Curve=rotate_3.Geometry, Distance=neg_5, Plane=PlaneXY(0, 0, 0), Corners=1)
offset_4 = OffsetCurve(Curve=rotate_3.Geometry, Distance=eval_9, Plane=PlaneXY(0, 0, 0), Corners=1)
number_slider_20 = Slider(0.094, range=0..1)
md_slider_5 = MDSlider(SliderMode=0, slider_value=Point(0.5, 0.5, 0.5), x_domain=Domain(0, 1), y_domain=Domain(0, 1), z_domain=Domain(0, 1))
eval_11 = Evaluate(F="x*1000", x=Slider(0.023, range=0..1))
ext = ExtendCurve(Curve=offset_4, Type=0, Start=eval_11, End=eval_10)
ext_2 = ExtendCurve(Curve=offset_3, Type=0, Start=eval_11, End=eval_10)
loft_2 = Loft(Curves=[ext, ext_2], Options={Adjust=False, Closed=False, LoftEnds=0, LoftSimp=0, LoftType=0, Rebuild=10, Refit=0.01})  # -> flatten(Loft)
evalsrf_3 = EvaluateSurface(Surface=reparameterize(loft_2), Point=md_slider_5)  # -> Point, flatten(Normal), UDirection, VDirection, Frame
eval_12 = Evaluate(F="x*1000", x=height_of_wooden_bar_from_sides)
amp_2 = Amplitude(Vector=evalsrf_3.Normal, Amplitude=eval_12)
neg_6 = Negative(Value=amp_2)
multiplication_27 = Multiplication(A=amp_2, B=Slider(2, range=0..10))
extr_8 = Extrude(Base=loft_2, Direction=amp_2)  # -> flatten(Extrusion)
move_8 = Move(Geometry=extr_8, Motion=multiplication_27)  # -> simplify(flatten(Geometry)), Transform

rotate_5 = Rotate(Geometry=explode_2.Segments, Angle=degrees(number_slider_18), Plane=area_2.Centroid)  # -> Geometry, Transform
rotate_6 = Rotate(Geometry=explode_2.Vertices, Angle=degrees(number_slider_18), Plane=area_2.Centroid)  # -> Geometry, Transform

duppt_2 = RemoveDuplicatePts(Points=explode_4.Vertices, Tolerance=0.01)
duppt_3 = RemoveDuplicatePts(Points=rotate_6.Geometry, Tolerance=0.01)
duppt_4 = RemoveDuplicatePts(Points=rotate_4.Geometry, Tolerance=0.01)
duppt_5 = RemoveDuplicatePts(Points=rotate.Geometry, Tolerance=0.01)

weave = Weave(Pattern=[0, 1], Stream0=graft(duppt), Stream1=graft(duppt_3), NullGaps=False)  # -> flatten(Weave)
subtraction_2 = Subtraction(A=eval_5, B=eval_4)

item_9 = ListItem(List=flatten(neg_6), Index=0, Wrap=True)
expression = Expression(x=item_9, Expression="x * 2")

# ----
# Screw combining them together
panel_3 = Panel("""0
1""")
dispatch = Dispatch(List=flatten(extr_8), DispatchPattern=panel_3)  # -> ListA, ListB
item_10 = ListItem(List=flatten(neg_6), Index=0, Wrap=True)
level_2_bars = Data(graft(dispatch.ListB))
center_pts_up = Data(duppt_5)
subtraction_3 = Subtraction(A=eval_5, B=eval_2)
panel_4 = Panel(subtraction_3)
circle_2 = CircleCNR(Center=center_pts_up, Normal=item_9, Radius=subtraction_3)
move_9 = Move(Geometry=simplify(center_pts_up), Motion=simplify(flatten(amp_2)))  # -> Geometry, Transform
boundary_6 = BoundarySurfaces(Edges=circle_2)
level_1_bars = Data(dispatch.ListA)
extr_9 = Extrude(Base=boundary_6, Direction=flatten(amp_2))
center_pts_down = Data(move_9.Geometry)
move_10 = Move(Geometry=level_2_bars, Motion=item_10)  # -> Geometry, Transform
trim = TrimSolid(Shape=graft(level_1_bars), Cutters=flatten(extr_9))
partition = PartitionList(List=extr_9, Size="2")  # -> simplify(Chunks)
merge = Merge(Data1=simplify(move_10.Geometry), Data2=partition)
sunion = SolidUnion(Breps=merge)

midpt = CurveMiddle(Curve=offset_3)
total_inner_vertces = Data(weave)
outer_vertices = Data(flatten(midpt))
shift = ShiftList(List=total_inner_vertces, Shift=1, Wrap=True)
list_2 = ItemSelector(
    outer_vertices,
    {"{706.156033, 706.156033, 0}", "{0, 998.655439, 0}", "{-706.156033, 706.156033, 0}", "{-998.655439, 0, 0}", "{-706.156033, -706.156033, 0}", "{0, -998.655439, 0}", "{706.156033, -706.156033, 0}", "{998.655439, 0, 0}"}, selected="{706.156033, 706.156033, 0}")
ln = Line(StartPoint=outer_vertices, EndPoint=shift)
list_3 = ItemSelector(
    total_inner_vertces,
    {"{600, 0, 0}", "{424.264069, 424.264069, 0}", "{0, 600, 0}", "{-424.264069, 424.264069, 0}", "{-600, 0, 0}", "{-424.264069, -424.264069, 0}", "{0, -600, 0}", "{424.264069, -424.264069, 0}"}, selected="{600, 0, 0}")
panel_5 = Panel("""0
1""")
pipe = Pipe(Curve=ln, Radius=subtraction_2, Caps=0)  # -> flatten(Pipe)
expression_2 = Expression(x=item_9, Expression="3*x / 2")
dispatch_2 = Dispatch(List=pipe, DispatchPattern=panel_5)  # -> ListA, ListB
expression_3 = Expression(x=item_9, Expression="x / 2")
move_11 = Move(Geometry=dispatch_2.ListA, Motion=expression_3)  # -> simplify(graft(Geometry)), Transform
move_12 = Move(Geometry=dispatch_2.ListB, Motion=expression_2)  # -> simplify(graft(Geometry)), Transform

upper_level = Data(flatten(sunion))
lower_level = Data(flatten(trim))
move_13 = Move(Geometry=upper_level, Motion=item_9)  # -> Geometry, Transform
move_14 = Move(Geometry=lower_level, Motion=item_9)  # -> Geometry, Transform

data_3 = Data(move_11.Geometry)
data_4 = Data(move_12.Geometry)

item_11 = ListItem(List=move_14.Geometry, Index=0, Wrap=True)
debrep_3 = DeconstructBrep(Brep=item_11)  # -> Faces, Edges, Vertices
item_12 = ListItem(List=debrep_3.Vertices, Index=0, Wrap=True)  # -> Item, Item1, Item2, Item3
vec2pt = Vector2Pt(PointA=item_12.Item, PointB=item_12.Item3, Unitize=invert(False))  # -> Vector, Length
vec2pt_2 = Vector2Pt(PointA=item_12.Item1, PointB=item_12.Item, Unitize=invert(False))  # -> Vector, Length
amp_3 = Amplitude(Vector=vec2pt_2.Vector, Amplitude=Slider(299, range=0..10000))
amp_4 = Amplitude(Vector=vec2pt.Vector, Amplitude=Slider(581, range=-3500..3000))
move_15 = Move(Geometry=item_11, Motion=amp_3)  # -> Geometry, Transform
move_16 = Move(Geometry=move_15.Geometry, Motion=amp_4)  # -> Geometry, Transform

bbox = BoundingBox(Content=move_14.Geometry, Plane=PlaneXY(0, 0, 0), UnionBox=False)  # -> Box, Box_2
bbox_2 = BoundingBox(Content=move_13.Geometry, Plane=PlaneXY(0, 0, 0))  # -> Box, Box_2
area_5 = Area(Geometry=bbox_2.Box)  # -> Area, Centroid
area_6 = Area(Geometry=bbox.Box)  # -> Area, Centroid
area_7 = Area(Geometry=move_16.Geometry)  # -> Area, Centroid
ln_2 = Line(StartPoint=area_6.Centroid, EndPoint=area_7.Centroid)
ln_3 = Line(StartPoint=area_5.Centroid, EndPoint=area_7.Centroid)
len = Length(Curve=ln_3)
len_2 = Length(Curve=ln_2)
sort = SortList(Keys=len_2, ValuesA=move_14.Geometry)  # -> reverse(Keys), reverse(ValuesA)
sort_2 = SortList(Keys=len, ValuesA=move_13.Geometry)  # -> reverse(Keys), reverse(ValuesA)
merge_2 = Merge(Data1=sort.ValuesA, Data2=sort_2.ValuesA)
debrep_4 = DeconstructBrep(Brep=sort.ValuesA)  # -> Faces, Edges, Vertices
debrep_5 = DeconstructBrep(Brep=sort_2.ValuesA)  # -> Faces, Edges, Vertices
item_13 = ListItem(List=debrep_4.Faces, Index=0, Wrap=True)  # -> flatten(Item)
item_14 = ListItem(List=debrep_5.Faces, Index="4", Wrap=True)  # -> flatten(Item)
area_8 = MeshArea(Mesh=item_13)  # -> Area, Centroid
area_9 = MeshArea(Mesh=item_14)  # -> Area, Centroid
merge_3 = Merge(Data1=area_8.Centroid, Data2=area_9.Centroid)
xy_4 = XYPlane(Origin=merge_3)

series_3 = Series(Start=0, Step=item_9, Count="8")
Z_8 = UnitZ(Factor=series_3)
move_17 = Move(Geometry=move_16.Geometry, Motion=Z_8)  # -> reverse(Geometry), Transform
debrep_6 = DeconstructBrep(Brep=move_17.Geometry)  # -> Faces, Edges, Vertices
item_15 = ListItem(List=debrep_6.Faces, Index=0, Wrap=True)  # -> flatten(Item)
area_10 = MeshArea(Mesh=item_15)  # -> Area, Centroid

# ---- group: Pick-up
xy_5 = XYPlane(Origin=area_10.Centroid)

# ----
xy_6 = XYPlane(Origin=Point(0, 0, 0))
pt_6 = ConstructPoint(XCoordinate=0, YCoordinate=0, ZCoordinate=0)
pl = PlaneNormal(Origin=xy_6, ZAxis=Vector(0, 0, 1))

multiplication_28 = Multiplication(A=number_slider, B="0.5")

circle_3 = CircleCNR(Center=pt_6, Normal=pl, Radius=multiplication_28)
boundary_7 = BoundarySurfaces(Edges=circle_3)

extr_10 = Extrude(Base=boundary_7, Direction=Z_4)
bbx = BrepBrep(BrepA=extr_10, BrepB=extr_3)  # -> Curves, Points
sint = SolidIntersection(BrepsA=extr_3, BrepsB=extr_10)
area_11 = Area(Geometry=bbx.Curves)  # -> Area, Centroid
data_5 = Data(sint)
xy_7 = XYPlane(Origin=area_11.Centroid)
rectangle_3 = Rectangle(Plane=xy_7, XSize=dom_3, YSize=dom_4, Radius=multiplication_15)  # -> Rectangle, Length
boundary_8 = BoundarySurfaces(Edges=rectangle_3.Rectangle)
move_18 = Move(Geometry=boundary_8, Motion=Z_5)  # -> Geometry, Transform
extr_11 = Extrude(Base=boundary_8, Direction=Z_5)
evalsrf_4 = EvaluateSurface(Surface=reparameterize(move_18.Geometry), Point=md_slider_2)  # -> Point, Normal, UDirection, VDirection, Frame
sunion_2 = SolidUnion(Breps=[data, data_5])  # -> flatten(Result)
data_6 = Data(evalsrf_4.Point)
circle_4 = CircleCNR(Center=data_6, Normal=Vector(0, 0, 1), Radius=multiplication_18)
boundary_9 = BoundarySurfaces(Edges=circle_4)
move_19 = Move(Geometry=boundary_9, Motion=Z_6)  # -> Geometry, Transform
area_12 = Area(Geometry=move_19.Geometry)  # -> Area, Centroid
scale = Scale(Geometry=move_19.Geometry, Center=area_12.Centroid, Factor=Slider(0.9, range=0..0.9))  # -> Geometry, Transform
scale_2 = Scale(Geometry=move_19.Geometry, Center=area_12.Centroid, Factor=Slider(1.202, range=1..1.4))  # -> Geometry, Transform
sdiff = SolidDifference(BrepsA=scale.Geometry, BrepsB=scale_2.Geometry)
extr_12 = Extrude(Base=sdiff, Direction=Z_7)
extr_13 = Extrude(Base=boundary_9, Direction=Z_6)
mirror_2 = Mirror(Geometry=[extr_12, extr_13], Plane=yz)  # -> Geometry, Transform
merge_4 = Merge(Data1=extr_13, Data2=extr_12, Data3=mirror_2.Geometry, Data4=extr_11, Data5=sunion_2, Data6=extr, Data7=extr_7)  # -> flatten(Result)
sunion_3 = SolidUnion(Breps=merge_4)

mirror_3 = Mirror(Geometry=[extr_12, extr_13], Plane=yz)  # -> Geometry, Transform
scale_3 = Scale(Geometry=sunion_3, Center=Point(0, 0, 0), Factor=Slider(0.601, range=0..1))  # -> Geometry, Transform
mesh = MeshBrep(
    Brep=scale_3.Geometry,
    Settings={GridMaxCount=0, GridMinCount=16, JaggedSeams=False, MaxEdgeLength=0, MinEdgeLength=0.0001, MinTolerance=0, Refine=True, RefineAngle=0, RelativeTolerance=0.65, SimplePlanes=True, Tolerance=0})
mesh_2 = Mesh(mesh)  # disabled
custom_tool = CustomToolKUKAPrc(
    CustomToolGeometry=mesh_2,
    toolid=8,
    toolvala=0,
    toolvalb=-90,
    toolvalc=0,
    toolvalx=0,
    toolvaly=0,
    toolvalz=153.252,
    valuesset=True)  # disabled
kuka_prc_2 = KUKAPrcCORE(
    SimulationSlider=knob,
    KUKAPrcCommands=cmd_weave,
    Tool=custom_tool,
    Robot=kr90_kr270_r2500,
    PRC_BaseExpose=False,
    PRC_SaveNameExpose=False,
    PRCsettings="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")  # -> RobotGeometry, AnalysisOutput; disabled
bang = ExplodeTree(Data=kuka_prc_2.RobotGeometry)  # -> Branch0, Branch1, Branch2; disabled
list_4 = ItemSelector(
    bang.Branch1,
    {"230,230,230", "51,51,51", "230,230,230", "51,51,51", "255,127,0", "51,51,51", "255,127,0", "255,127,0", "255,127,0", "51,51,51", "51,51,51", "255,127,0", "DarkGray"}, selected="51,51,51")  # disabled
num2pt = NumbersToPoints(Numbers=list_4, Mask=4)  # disabled
concat = Concatenate(FragmentA=panel, FragmentB=list_4, FragmentC=panel_2)  # disabled
panel_6 = Panel(kuka_prc_2.RobotGeometry)  # disabled
list_5 = ItemSelector(
    bang.Branch2,
    {"Polyline Curve", "Polyline Curve", "Line-like Curve", "Line-like Curve", "Line-like Curve"}, selected="Polyline Curve")  # disabled
data_7 = Data(bang.Branch1)  # disabled
pt_7 = Point(concat)  # disabled
explode_5 = Explode(Curve=list_5, Recursive=False)  # -> Segments, Vertices; disabled

Z_9 = UnitZ(Factor=Slider(455, range=100..1000))
Z_10 = UnitZ(Factor=Slider(391, range=100..1000))
move_20 = Move(Geometry=xy_4, Motion=Z_10)  # -> Geometry, Transform
move_21 = Move(Geometry=xy_5, Motion=Z_9)  # -> Geometry, Transform
ptp_move_3 = PTPMovementKUKAPrc(TargetAsPlane=move_20.Geometry, extaxenabled=False, interpolation="C_PTP")
ptp_move_4 = PTPMovementKUKAPrc(TargetAsPlane=move_21.Geometry, extaxenabled=False, interpolation="C_PTP")
lin_move_3 = LINearMovementKUKAPrc(TargetAsPlane=xy_4, extaxenabled=False, interpolation="C_DIS")
lin_move_4 = LINearMovementKUKAPrc(TargetAsPlane=xy_5, extaxenabled=False, interpolation="C_DIS")
cmd_weave_2 = CommandWeaverKUKAPrc(
    Command1=ptp_move_4,
    Command2=lin_move_4,
    Command3=ptp_move_4,
    Command4=ptp_move_3,
    Command5=lin_move_3,
    Command6=ptp_move_3,
    enabletree=False)
knob_2 = ControlKnob(Decimals=2, Limit=True, Maximum=1, Minimum=0, Range=1, Value=0)
mesh_3 = Mesh(mesh)
kr120_r3900k_2 = QuantecKR120R3900KRobot(infiniterot=False)
custom_tool_2 = CustomToolKUKAPrc(
    CustomToolGeometry=mesh_3,
    toolid=8,
    toolvala=0,
    toolvalb=-90,
    toolvalc=0,
    toolvalx=0,
    toolvaly=0,
    toolvalz=356.994,
    valuesset=True)
kr120_r1800 = QuantecKR120R1800NanoRobot(infiniterot=False)
kr90_kr270_r2500_2 = QuantecKR90KR270R2500Robot(infiniterot=False)
kuka_prc_3 = KUKAPrcCORE(
    SimulationSlider=knob_2,
    KUKAPrcCommands=cmd_weave_2,
    Tool=custom_tool_2,
    Robot=kr90_kr270_r2500_2,
    SaveToggle=True,
    Filename="kukaprc_project",
    PRC_BaseExpose=False,
    PRC_SaveNameExpose=True,
    PRCsettings="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")  # -> RobotGeometry, AnalysisOutput

data_8 = Data(scale_3.Geometry)

bbox_3 = BoundingBox(Content=data_8, Plane=PlaneXY(0, 0, 0))  # -> Box, Box_2
debrep_7 = DeconstructBrep(Brep=bbox_3.Box)  # -> Faces, Edges, Vertices
item_16 = ListItem(List=debrep_7.Faces, Index=Slider(5, range=0..20), Wrap=True)
evalsrf_5 = EvaluateSurface(Surface=item_16, Point=md_slider_3)  # -> Point, Normal, UDirection, VDirection, Frame
debox = DeconstructBox(Box=bbox_3.Box)  # -> Plane, X, Y, Z
dedomain = DeconstructDomain(Domain=debox.Z)  # -> Start, End

pt_8 = ConstructPoint(XCoordinate=0, YCoordinate=0, ZCoordinate=dedomain.End)
add_this_number_to_kuka_for_the_tool = Panel(dedomain.End)
