# Grasshopper definition 200119_hoberman_effect_kangaroo_only1unit.gh (Grasshopper 1.0.7)
# plug-ins: Human, Kangaroo2 Components

height_of_wooden_bar_from_sides = Slider(0.04, range=0..1)
# Determined By design (human scale)
shortside_bar_length = Slider(0.023, range=0..1)
additional_bar_length = Slider(0.69, range=0.1..2)
half_width_of_wooden_bar = Slider(0.11, range=0..1)

number_slider = Slider(0.6, range=0.6..2)
# Determined By design (chinese culture)
no_of_segments_octagon = Slider(4, range=4..12)

factor_for_equal_sides = Slider(1.84776, range=1.1..2)

# ----
# Determined by Galapagos
factor_for_equal_sides_2 = Slider(1.84776, range=1.1..2)

cluster = Cluster_2(
    R_2=number_slider,
    R=number_slider,
    S=no_of_segments_octagon,
    x=no_of_segments_octagon,
    x_2=number_slider,
    A=number_slider,
    B=factor_for_equal_sides_2,
    h3=height_of_wooden_bar_from_sides,
    A_2=height_of_wooden_bar_from_sides,
    l0=shortside_bar_length,
    D=half_width_of_wooden_bar,
    l1=additional_bar_length,
    x_3=half_width_of_wooden_bar,
    l0_2=shortside_bar_length,
    l1_2=additional_bar_length)  # -> B_3, b_base_points_lower_2, b_base_points_upper_2, b_points_lower_2, b_points_upper_2, A_4, a_base_points_upper_2, a_base_points_lower_2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
cluster_2 = Cluster_3(
    data_7=number_slider,
    data_3=half_width_of_wooden_bar,
    data_2=additional_bar_length,
    data=height_of_wooden_bar_from_sides,
    data_9=shortside_bar_length)  # -> i, G, G_2, R_2, R

list = ItemSelector(
    cluster.b_points_upper_2,
    {"{0.424264, 0.424264, 1.177}", "{-0.424264, 0.424264, 1.177}", "{-0.424264, -0.424264, 1.177}", "{0.424264, -0.424264, 1.177}"}, selected="{-0.424264, -0.424264, 1.177}")
list_2 = ItemSelector(
    cluster.b_points_lower_2,
    {"{0.424264, 0.424264, 1.16}", "{-0.424264, 0.424264, 1.16}", "{-0.424264, -0.424264, 1.16}", "{0.424264, -0.424264, 1.16}"}, selected="{-0.424264, -0.424264, 1.16}")
list_3 = ItemSelector(
    cluster.a_points_lower_2,
    {"{0.6, 0, -1.017}", "{0, 0.6, -1.017}", "{-0.6, 0, -1.017}", "{0, -0.6, -1.017}"}, selected="{-0.6, 0, -1.017}")
list_4 = ItemSelector(cluster.a_points_upper_2, {"{0.6, 0, -1}", "{0, 0.6, -1}", "{-0.6, 0, -1}", "{0, -0.6, -1}"}, selected="{-0.6, 0, -1}")
list_5 = ItemSelector(
    cluster.b_base_points_upper_2,
    {"{0.424264, 0.424264, 0.177}", "{-0.424264, 0.424264, 0.177}", "{-0.424264, -0.424264, 0.177}", "{0.424264, -0.424264, 0.177}"}, selected="{-0.424264, -0.424264, 0.177}")
list_6 = ItemSelector(
    cluster.b_base_points_lower_2,
    {"{0.424264, 0.424264, 0.16}", "{-0.424264, 0.424264, 0.16}", "{-0.424264, -0.424264, 0.16}", "{0.424264, -0.424264, 0.16}"}, selected="{-0.424264, -0.424264, 0.16}")
list_7 = ItemSelector(
    cluster.a_base_points_lower_2,
    {"{0.6, 0, -0.017}", "{0, 0.6, -0.017}", "{-0.6, 0, -0.017}", "{0, -0.6, -0.017}"}, selected="{-0.6, 0, -0.017}")
list_8 = ItemSelector(cluster.a_base_points_upper_2, {"{0.6, 0, 0}", "{0, 0.6, 0}", "{-0.6, 0, 0}", "{0, -0.6, 0}"}, selected="{-0.6, 0, 0}")
list_9 = ItemSelector(
    cluster.common_pts_up_3,
    {"{1.024265, 0.424264, -0.92}", "{0.424264, 1.024265, -0.92}", "{-0.424264, 1.024265, -0.92}", "{-1.024265, 0.424264, -0.92}", "{-1.024265, -0.424264, -0.92}", "{-0.424264, -1.024265, -0.92}", "{0.424264, -1.024265, -0.92}", "{1.024265, -0.424264, -0.92}"}, selected="{-1.024265, -0.424264, -0.92}")
list_10 = ItemSelector(
    cluster.common_pts_down_4,
    {"{1.024265, 0.424264, 1.04}", "{0.424264, 1.024265, 1.04}", "{-0.424264, 1.024265, 1.04}", "{-1.024265, 0.424264, 1.04}", "{-1.024265, -0.424264, 1.04}", "{-0.424264, -1.024265, 1.04}", "{0.424264, -1.024265, 1.04}", "{1.024265, -0.424264, 1.04}"}, selected="{-1.024265, -0.424264, 1.04}")
list_11 = ItemSelector(
    cluster.common_pts_up_4,
    {"{1.024265, 0.424264, 1.08}", "{0.424264, 1.024265, 1.08}", "{-0.424264, 1.024265, 1.08}", "{-1.024265, 0.424264, 1.08}", "{-1.024265, -0.424264, 1.08}", "{-0.424264, -1.024265, 1.08}", "{0.424264, -1.024265, 1.08}", "{1.024265, -0.424264, 1.08}"}, selected="{-1.024265, -0.424264, 1.08}")
list_12 = ItemSelector(
    cluster.common_pts_down_3,
    {"{1.024265, 0.424264, -0.96}", "{0.424264, 1.024265, -0.96}", "{-0.424264, 1.024265, -0.96}", "{-1.024265, 0.424264, -0.96}", "{-1.024265, -0.424264, -0.96}", "{-0.424264, -1.024265, -0.96}", "{0.424264, -1.024265, -0.96}", "{1.024265, -0.424264, -0.96}"}, selected="{-1.024265, -0.424264, -0.96}")

list_13 = ItemSelector(
    cluster.b_points_upper_2,
    {"{0.424264, 0.424264, 1.177}", "{-0.424264, 0.424264, 1.177}", "{-0.424264, -0.424264, 1.177}", "{0.424264, -0.424264, 1.177}"}, selected="{-0.424264, 0.424264, 1.177}")
list_14 = ItemSelector(
    cluster.b_points_lower_2,
    {"{0.424264, 0.424264, 1.16}", "{-0.424264, 0.424264, 1.16}", "{-0.424264, -0.424264, 1.16}", "{0.424264, -0.424264, 1.16}"}, selected="{-0.424264, 0.424264, 1.16}")
list_15 = ItemSelector(
    cluster.a_points_lower_2,
    {"{0.6, 0, -1.017}", "{0, 0.6, -1.017}", "{-0.6, 0, -1.017}", "{0, -0.6, -1.017}"}, selected="{0, 0.6, -1.017}")
list_16 = ItemSelector(cluster.a_points_upper_2, {"{0.6, 0, -1}", "{0, 0.6, -1}", "{-0.6, 0, -1}", "{0, -0.6, -1}"}, selected="{0, 0.6, -1}")
list_17 = ItemSelector(
    cluster.b_base_points_upper_2,
    {"{0.424264, 0.424264, 0.177}", "{-0.424264, 0.424264, 0.177}", "{-0.424264, -0.424264, 0.177}", "{0.424264, -0.424264, 0.177}"}, selected="{-0.424264, 0.424264, 0.177}")
list_18 = ItemSelector(
    cluster.b_base_points_lower_2,
    {"{0.424264, 0.424264, 0.16}", "{-0.424264, 0.424264, 0.16}", "{-0.424264, -0.424264, 0.16}", "{0.424264, -0.424264, 0.16}"}, selected="{-0.424264, 0.424264, 0.16}")
list_19 = ItemSelector(
    cluster.a_base_points_lower_2,
    {"{0.6, 0, -0.017}", "{0, 0.6, -0.017}", "{-0.6, 0, -0.017}", "{0, -0.6, -0.017}"}, selected="{0, 0.6, -0.017}")
list_20 = ItemSelector(cluster.a_base_points_upper_2, {"{0.6, 0, 0}", "{0, 0.6, 0}", "{-0.6, 0, 0}", "{0, -0.6, 0}"}, selected="{0, 0.6, 0}")
list_21 = ItemSelector(
    cluster.common_pts_up_3,
    {"{1.024265, 0.424264, -0.92}", "{0.424264, 1.024265, -0.92}", "{-0.424264, 1.024265, -0.92}", "{-1.024265, 0.424264, -0.92}", "{-1.024265, -0.424264, -0.92}", "{-0.424264, -1.024265, -0.92}", "{0.424264, -1.024265, -0.92}", "{1.024265, -0.424264, -0.92}"}, selected="{-0.424264, 1.024265, -0.92}")
list_22 = ItemSelector(
    cluster.common_pts_down_4,
    {"{1.024265, 0.424264, 1.04}", "{0.424264, 1.024265, 1.04}", "{-0.424264, 1.024265, 1.04}", "{-1.024265, 0.424264, 1.04}", "{-1.024265, -0.424264, 1.04}", "{-0.424264, -1.024265, 1.04}", "{0.424264, -1.024265, 1.04}", "{1.024265, -0.424264, 1.04}"}, selected="{-0.424264, 1.024265, 1.04}")
list_23 = ItemSelector(
    cluster.common_pts_up_4,
    {"{1.024265, 0.424264, 1.08}", "{0.424264, 1.024265, 1.08}", "{-0.424264, 1.024265, 1.08}", "{-1.024265, 0.424264, 1.08}", "{-1.024265, -0.424264, 1.08}", "{-0.424264, -1.024265, 1.08}", "{0.424264, -1.024265, 1.08}", "{1.024265, -0.424264, 1.08}"}, selected="{-0.424264, 1.024265, 1.08}")
list_24 = ItemSelector(
    cluster.common_pts_down_3,
    {"{1.024265, 0.424264, -0.96}", "{0.424264, 1.024265, -0.96}", "{-0.424264, 1.024265, -0.96}", "{-1.024265, 0.424264, -0.96}", "{-1.024265, -0.424264, -0.96}", "{-0.424264, -1.024265, -0.96}", "{0.424264, -1.024265, -0.96}", "{1.024265, -0.424264, -0.96}"}, selected="{-0.424264, 1.024265, -0.96}")

list_25 = ItemSelector(
    cluster.b_points_upper_2,
    {"{0.424264, 0.424264, 1.177}", "{-0.424264, 0.424264, 1.177}", "{-0.424264, -0.424264, 1.177}", "{0.424264, -0.424264, 1.177}"}, selected="{0.424264, -0.424264, 1.177}")
list_26 = ItemSelector(
    cluster.b_points_lower_2,
    {"{0.424264, 0.424264, 1.16}", "{-0.424264, 0.424264, 1.16}", "{-0.424264, -0.424264, 1.16}", "{0.424264, -0.424264, 1.16}"}, selected="{0.424264, -0.424264, 1.16}")
list_27 = ItemSelector(
    cluster.a_points_lower_2,
    {"{0.6, 0, -1.017}", "{0, 0.6, -1.017}", "{-0.6, 0, -1.017}", "{0, -0.6, -1.017}"}, selected="{0, -0.6, -1.017}")
list_28 = ItemSelector(cluster.a_points_upper_2, {"{0.6, 0, -1}", "{0, 0.6, -1}", "{-0.6, 0, -1}", "{0, -0.6, -1}"}, selected="{0, -0.6, -1}")
list_29 = ItemSelector(
    cluster.b_base_points_upper_2,
    {"{0.424264, 0.424264, 0.177}", "{-0.424264, 0.424264, 0.177}", "{-0.424264, -0.424264, 0.177}", "{0.424264, -0.424264, 0.177}"}, selected="{0.424264, -0.424264, 0.177}")
list_30 = ItemSelector(
    cluster.b_base_points_lower_2,
    {"{0.424264, 0.424264, 0.16}", "{-0.424264, 0.424264, 0.16}", "{-0.424264, -0.424264, 0.16}", "{0.424264, -0.424264, 0.16}"}, selected="{0.424264, -0.424264, 0.16}")
list_31 = ItemSelector(
    cluster.a_base_points_lower_2,
    {"{0.6, 0, -0.017}", "{0, 0.6, -0.017}", "{-0.6, 0, -0.017}", "{0, -0.6, -0.017}"}, selected="{0, -0.6, -0.017}")
list_32 = ItemSelector(cluster.a_base_points_upper_2, {"{0.6, 0, 0}", "{0, 0.6, 0}", "{-0.6, 0, 0}", "{0, -0.6, 0}"}, selected="{0, -0.6, 0}")
list_33 = ItemSelector(
    cluster.common_pts_up_3,
    {"{1.024265, 0.424264, -0.92}", "{0.424264, 1.024265, -0.92}", "{-0.424264, 1.024265, -0.92}", "{-1.024265, 0.424264, -0.92}", "{-1.024265, -0.424264, -0.92}", "{-0.424264, -1.024265, -0.92}", "{0.424264, -1.024265, -0.92}", "{1.024265, -0.424264, -0.92}"}, selected="{0.424264, -1.024265, -0.92}")
list_34 = ItemSelector(
    cluster.common_pts_down_4,
    {"{1.024265, 0.424264, 1.04}", "{0.424264, 1.024265, 1.04}", "{-0.424264, 1.024265, 1.04}", "{-1.024265, 0.424264, 1.04}", "{-1.024265, -0.424264, 1.04}", "{-0.424264, -1.024265, 1.04}", "{0.424264, -1.024265, 1.04}", "{1.024265, -0.424264, 1.04}"}, selected="{0.424264, -1.024265, 1.04}")
list_35 = ItemSelector(
    cluster.common_pts_up_4,
    {"{1.024265, 0.424264, 1.08}", "{0.424264, 1.024265, 1.08}", "{-0.424264, 1.024265, 1.08}", "{-1.024265, 0.424264, 1.08}", "{-1.024265, -0.424264, 1.08}", "{-0.424264, -1.024265, 1.08}", "{0.424264, -1.024265, 1.08}", "{1.024265, -0.424264, 1.08}"}, selected="{0.424264, -1.024265, 1.08}")
list_36 = ItemSelector(
    cluster.common_pts_down_3,
    {"{1.024265, 0.424264, -0.96}", "{0.424264, 1.024265, -0.96}", "{-0.424264, 1.024265, -0.96}", "{-1.024265, 0.424264, -0.96}", "{-1.024265, -0.424264, -0.96}", "{-0.424264, -1.024265, -0.96}", "{0.424264, -1.024265, -0.96}", "{1.024265, -0.424264, -0.96}"}, selected="{0.424264, -1.024265, -0.96}")

list_37 = ItemSelector(
    cluster.b_points_upper_2,
    {"{0.424264, 0.424264, 1.177}", "{-0.424264, 0.424264, 1.177}", "{-0.424264, -0.424264, 1.177}", "{0.424264, -0.424264, 1.177}"}, selected="{0.424264, 0.424264, 1.177}")
list_38 = ItemSelector(
    cluster.b_points_lower_2,
    {"{0.424264, 0.424264, 1.16}", "{-0.424264, 0.424264, 1.16}", "{-0.424264, -0.424264, 1.16}", "{0.424264, -0.424264, 1.16}"}, selected="{0.424264, 0.424264, 1.16}")
list_39 = ItemSelector(
    cluster.a_points_lower_2,
    {"{0.6, 0, -1.017}", "{0, 0.6, -1.017}", "{-0.6, 0, -1.017}", "{0, -0.6, -1.017}"}, selected="{0.6, 0, -1.017}")
list_40 = ItemSelector(
    cluster.b_base_points_lower_2,
    {"{0.424264, 0.424264, 0.16}", "{-0.424264, 0.424264, 0.16}", "{-0.424264, -0.424264, 0.16}", "{0.424264, -0.424264, 0.16}"}, selected="{0.424264, 0.424264, 0.16}")
list_41 = ItemSelector(
    cluster.b_base_points_upper_2,
    {"{0.424264, 0.424264, 0.177}", "{-0.424264, 0.424264, 0.177}", "{-0.424264, -0.424264, 0.177}", "{0.424264, -0.424264, 0.177}"}, selected="{0.424264, 0.424264, 0.177}")
list_42 = ItemSelector(
    cluster.a_base_points_lower_2,
    {"{0.6, 0, -0.017}", "{0, 0.6, -0.017}", "{-0.6, 0, -0.017}", "{0, -0.6, -0.017}"}, selected="{0.6, 0, -0.017}")
list_43 = ItemSelector(cluster.a_base_points_upper_2, {"{0.6, 0, 0}", "{0, 0.6, 0}", "{-0.6, 0, 0}", "{0, -0.6, 0}"}, selected="{0.6, 0, 0}")
list_44 = ItemSelector(
    cluster.common_pts_up_3,
    {"{1.024265, 0.424264, -0.92}", "{0.424264, 1.024265, -0.92}", "{-0.424264, 1.024265, -0.92}", "{-1.024265, 0.424264, -0.92}", "{-1.024265, -0.424264, -0.92}", "{-0.424264, -1.024265, -0.92}", "{0.424264, -1.024265, -0.92}", "{1.024265, -0.424264, -0.92}"}, selected="{1.024265, 0.424264, -0.92}")
list_45 = ItemSelector(
    cluster.common_pts_down_4,
    {"{1.024265, 0.424264, 1.04}", "{0.424264, 1.024265, 1.04}", "{-0.424264, 1.024265, 1.04}", "{-1.024265, 0.424264, 1.04}", "{-1.024265, -0.424264, 1.04}", "{-0.424264, -1.024265, 1.04}", "{0.424264, -1.024265, 1.04}", "{1.024265, -0.424264, 1.04}"}, selected="{1.024265, 0.424264, 1.04}")
list_46 = ItemSelector(
    cluster.common_pts_down_3,
    {"{1.024265, 0.424264, -0.96}", "{0.424264, 1.024265, -0.96}", "{-0.424264, 1.024265, -0.96}", "{-1.024265, 0.424264, -0.96}", "{-1.024265, -0.424264, -0.96}", "{-0.424264, -1.024265, -0.96}", "{0.424264, -1.024265, -0.96}", "{1.024265, -0.424264, -0.96}"}, selected="{1.024265, 0.424264, -0.96}")
list_47 = ItemSelector(
    cluster.common_pts_up_4,
    {"{1.024265, 0.424264, 1.08}", "{0.424264, 1.024265, 1.08}", "{-0.424264, 1.024265, 1.08}", "{-1.024265, 0.424264, 1.08}", "{-1.024265, -0.424264, 1.08}", "{-0.424264, -1.024265, 1.08}", "{0.424264, -1.024265, 1.08}", "{1.024265, -0.424264, 1.08}"}, selected="{1.024265, 0.424264, 1.08}")
list_48 = ItemSelector(cluster.a_points_upper_2, {"{0.6, 0, -1}", "{0, 0.6, -1}", "{-0.6, 0, -1}", "{0, -0.6, -1}"}, selected="{0.6, 0, -1}")

data = Data(cluster._3_2)
data_2 = Data(cluster._3)

upper_level = Data(flatten(cluster_2.R_2))
lower_level = Data(flatten(cluster_2.R))
move = Move(Geometry=upper_level, Motion=cluster_2.i)  # -> Geometry, Transform
move_2 = Move(Geometry=lower_level, Motion=cluster_2.i)  # -> Geometry, Transform

list_49 = ItemSelector(
    cluster.common_pts_up_3,
    {"{1.024265, 0.424264, -0.92}", "{0.424264, 1.024265, -0.92}", "{-0.424264, 1.024265, -0.92}", "{-1.024265, 0.424264, -0.92}", "{-1.024265, -0.424264, -0.92}", "{-0.424264, -1.024265, -0.92}", "{0.424264, -1.024265, -0.92}", "{1.024265, -0.424264, -0.92}"}, selected="{0.424264, 1.024265, -0.92}")
list_50 = ItemSelector(
    cluster.common_pts_up_3,
    {"{1.024265, 0.424264, -0.92}", "{0.424264, 1.024265, -0.92}", "{-0.424264, 1.024265, -0.92}", "{-1.024265, 0.424264, -0.92}", "{-1.024265, -0.424264, -0.92}", "{-0.424264, -1.024265, -0.92}", "{0.424264, -1.024265, -0.92}", "{1.024265, -0.424264, -0.92}"}, selected="{-1.024265, 0.424264, -0.92}")
list_51 = ItemSelector(
    cluster.common_pts_up_3,
    {"{1.024265, 0.424264, -0.92}", "{0.424264, 1.024265, -0.92}", "{-0.424264, 1.024265, -0.92}", "{-1.024265, 0.424264, -0.92}", "{-1.024265, -0.424264, -0.92}", "{-0.424264, -1.024265, -0.92}", "{0.424264, -1.024265, -0.92}", "{1.024265, -0.424264, -0.92}"}, selected="{-0.424264, -1.024265, -0.92}")
list_52 = ItemSelector(
    cluster.common_pts_up_3,
    {"{1.024265, 0.424264, -0.92}", "{0.424264, 1.024265, -0.92}", "{-0.424264, 1.024265, -0.92}", "{-1.024265, 0.424264, -0.92}", "{-1.024265, -0.424264, -0.92}", "{-0.424264, -1.024265, -0.92}", "{0.424264, -1.024265, -0.92}", "{1.024265, -0.424264, -0.92}"}, selected="{1.024265, -0.424264, -0.92}")
list_53 = ItemSelector(
    cluster.common_pts_up_4,
    {"{1.024265, 0.424264, 1.08}", "{0.424264, 1.024265, 1.08}", "{-0.424264, 1.024265, 1.08}", "{-1.024265, 0.424264, 1.08}", "{-1.024265, -0.424264, 1.08}", "{-0.424264, -1.024265, 1.08}", "{0.424264, -1.024265, 1.08}", "{1.024265, -0.424264, 1.08}"}, selected="{0.424264, 1.024265, 1.08}")
list_54 = ItemSelector(
    cluster.common_pts_down_3,
    {"{1.024265, 0.424264, -0.96}", "{0.424264, 1.024265, -0.96}", "{-0.424264, 1.024265, -0.96}", "{-1.024265, 0.424264, -0.96}", "{-1.024265, -0.424264, -0.96}", "{-0.424264, -1.024265, -0.96}", "{0.424264, -1.024265, -0.96}", "{1.024265, -0.424264, -0.96}"}, selected="{0.424264, 1.024265, -0.96}")
list_55 = ItemSelector(
    cluster.common_pts_up_4,
    {"{1.024265, 0.424264, 1.08}", "{0.424264, 1.024265, 1.08}", "{-0.424264, 1.024265, 1.08}", "{-1.024265, 0.424264, 1.08}", "{-1.024265, -0.424264, 1.08}", "{-0.424264, -1.024265, 1.08}", "{0.424264, -1.024265, 1.08}", "{1.024265, -0.424264, 1.08}"}, selected="{-1.024265, 0.424264, 1.08}")
list_56 = ItemSelector(
    cluster.common_pts_up_4,
    {"{1.024265, 0.424264, 1.08}", "{0.424264, 1.024265, 1.08}", "{-0.424264, 1.024265, 1.08}", "{-1.024265, 0.424264, 1.08}", "{-1.024265, -0.424264, 1.08}", "{-0.424264, -1.024265, 1.08}", "{0.424264, -1.024265, 1.08}", "{1.024265, -0.424264, 1.08}"}, selected="{-0.424264, -1.024265, 1.08}")
list_57 = ItemSelector(
    cluster.common_pts_down_3,
    {"{1.024265, 0.424264, -0.96}", "{0.424264, 1.024265, -0.96}", "{-0.424264, 1.024265, -0.96}", "{-1.024265, 0.424264, -0.96}", "{-1.024265, -0.424264, -0.96}", "{-0.424264, -1.024265, -0.96}", "{0.424264, -1.024265, -0.96}", "{1.024265, -0.424264, -0.96}"}, selected="{-1.024265, 0.424264, -0.96}")
list_58 = ItemSelector(
    cluster.common_pts_down_3,
    {"{1.024265, 0.424264, -0.96}", "{0.424264, 1.024265, -0.96}", "{-0.424264, 1.024265, -0.96}", "{-1.024265, 0.424264, -0.96}", "{-1.024265, -0.424264, -0.96}", "{-0.424264, -1.024265, -0.96}", "{0.424264, -1.024265, -0.96}", "{1.024265, -0.424264, -0.96}"}, selected="{-0.424264, -1.024265, -0.96}")
list_59 = ItemSelector(
    cluster.common_pts_down_4,
    {"{1.024265, 0.424264, 1.04}", "{0.424264, 1.024265, 1.04}", "{-0.424264, 1.024265, 1.04}", "{-1.024265, 0.424264, 1.04}", "{-1.024265, -0.424264, 1.04}", "{-0.424264, -1.024265, 1.04}", "{0.424264, -1.024265, 1.04}", "{1.024265, -0.424264, 1.04}"}, selected="{0.424264, 1.024265, 1.04}")
list_60 = ItemSelector(
    cluster.common_pts_up_4,
    {"{1.024265, 0.424264, 1.08}", "{0.424264, 1.024265, 1.08}", "{-0.424264, 1.024265, 1.08}", "{-1.024265, 0.424264, 1.08}", "{-1.024265, -0.424264, 1.08}", "{-0.424264, -1.024265, 1.08}", "{0.424264, -1.024265, 1.08}", "{1.024265, -0.424264, 1.08}"}, selected="{1.024265, -0.424264, 1.08}")
number_slider_2 = Slider(10000, range=0..10000)
list_61 = ItemSelector(
    cluster.common_pts_down_3,
    {"{1.024265, 0.424264, -0.96}", "{0.424264, 1.024265, -0.96}", "{-0.424264, 1.024265, -0.96}", "{-1.024265, 0.424264, -0.96}", "{-1.024265, -0.424264, -0.96}", "{-0.424264, -1.024265, -0.96}", "{0.424264, -1.024265, -0.96}", "{1.024265, -0.424264, -0.96}"}, selected="{1.024265, -0.424264, -0.96}")
list_62 = ItemSelector(
    cluster.common_pts_down_4,
    {"{1.024265, 0.424264, 1.04}", "{0.424264, 1.024265, 1.04}", "{-0.424264, 1.024265, 1.04}", "{-1.024265, 0.424264, 1.04}", "{-1.024265, -0.424264, 1.04}", "{-0.424264, -1.024265, 1.04}", "{0.424264, -1.024265, 1.04}", "{1.024265, -0.424264, 1.04}"}, selected="{-1.024265, 0.424264, 1.04}")
list_63 = ItemSelector(
    cluster.common_pts_down_4,
    {"{1.024265, 0.424264, 1.04}", "{0.424264, 1.024265, 1.04}", "{-0.424264, 1.024265, 1.04}", "{-1.024265, 0.424264, 1.04}", "{-1.024265, -0.424264, 1.04}", "{-0.424264, -1.024265, 1.04}", "{0.424264, -1.024265, 1.04}", "{1.024265, -0.424264, 1.04}"}, selected="{-0.424264, -1.024265, 1.04}")
list_64 = ItemSelector(
    cluster.common_pts_down_4,
    {"{1.024265, 0.424264, 1.04}", "{0.424264, 1.024265, 1.04}", "{-0.424264, 1.024265, 1.04}", "{-1.024265, 0.424264, 1.04}", "{-1.024265, -0.424264, 1.04}", "{-0.424264, -1.024265, 1.04}", "{0.424264, -1.024265, 1.04}", "{1.024265, -0.424264, 1.04}"}, selected="{1.024265, -0.424264, 1.04}")

data_3 = Data(cluster_2.G)
data_4 = Data(cluster_2.G_2)

list_65 = ItemSelector(
    cluster.common_pts_up_3,
    {"{1.024265, 0.424264, -0.92}", "{0.424264, 1.024265, -0.92}", "{-0.424264, 1.024265, -0.92}", "{-1.024265, 0.424264, -0.92}", "{-1.024265, -0.424264, -0.92}", "{-0.424264, -1.024265, -0.92}", "{0.424264, -1.024265, -0.92}", "{1.024265, -0.424264, -0.92}"}, selected="{-1.024265, 0.424264, -0.92}")
list_66 = ItemSelector(
    cluster.common_pts_down_3,
    {"{1.024265, 0.424264, -0.96}", "{0.424264, 1.024265, -0.96}", "{-0.424264, 1.024265, -0.96}", "{-1.024265, 0.424264, -0.96}", "{-1.024265, -0.424264, -0.96}", "{-0.424264, -1.024265, -0.96}", "{0.424264, -1.024265, -0.96}", "{1.024265, -0.424264, -0.96}"}, selected="{-1.024265, 0.424264, -0.96}")
list_67 = ItemSelector(
    cluster.common_pts_up_3,
    {"{1.024265, 0.424264, -0.92}", "{0.424264, 1.024265, -0.92}", "{-0.424264, 1.024265, -0.92}", "{-1.024265, 0.424264, -0.92}", "{-1.024265, -0.424264, -0.92}", "{-0.424264, -1.024265, -0.92}", "{0.424264, -1.024265, -0.92}", "{1.024265, -0.424264, -0.92}"}, selected="{-1.024265, -0.424264, -0.92}")
list_68 = ItemSelector(
    cluster.common_pts_down_3,
    {"{1.024265, 0.424264, -0.96}", "{0.424264, 1.024265, -0.96}", "{-0.424264, 1.024265, -0.96}", "{-1.024265, 0.424264, -0.96}", "{-1.024265, -0.424264, -0.96}", "{-0.424264, -1.024265, -0.96}", "{0.424264, -1.024265, -0.96}", "{1.024265, -0.424264, -0.96}"}, selected="{-1.024265, -0.424264, -0.96}")
list_69 = ItemSelector(
    cluster.b_points_lower_2,
    {"{0.424264, 0.424264, 1.16}", "{-0.424264, 0.424264, 1.16}", "{-0.424264, -0.424264, 1.16}", "{0.424264, -0.424264, 1.16}"}, selected="{-0.424264, -0.424264, 1.16}")
list_70 = ItemSelector(
    cluster.common_pts_up_3,
    {"{1.024265, 0.424264, -0.92}", "{0.424264, 1.024265, -0.92}", "{-0.424264, 1.024265, -0.92}", "{-1.024265, 0.424264, -0.92}", "{-1.024265, -0.424264, -0.92}", "{-0.424264, -1.024265, -0.92}", "{0.424264, -1.024265, -0.92}", "{1.024265, -0.424264, -0.92}"}, selected="{1.024265, -0.424264, -0.92}")
list_71 = ItemSelector(
    cluster.common_pts_down_3,
    {"{1.024265, 0.424264, -0.96}", "{0.424264, 1.024265, -0.96}", "{-0.424264, 1.024265, -0.96}", "{-1.024265, 0.424264, -0.96}", "{-1.024265, -0.424264, -0.96}", "{-0.424264, -1.024265, -0.96}", "{0.424264, -1.024265, -0.96}", "{1.024265, -0.424264, -0.96}"}, selected="{1.024265, -0.424264, -0.96}")
list_72 = ItemSelector(
    cluster.common_pts_up_3,
    {"{1.024265, 0.424264, -0.92}", "{0.424264, 1.024265, -0.92}", "{-0.424264, 1.024265, -0.92}", "{-1.024265, 0.424264, -0.92}", "{-1.024265, -0.424264, -0.92}", "{-0.424264, -1.024265, -0.92}", "{0.424264, -1.024265, -0.92}", "{1.024265, -0.424264, -0.92}"}, selected="{1.024265, 0.424264, -0.92}")
list_73 = ItemSelector(
    cluster.b_points_upper_2,
    {"{0.424264, 0.424264, 1.177}", "{-0.424264, 0.424264, 1.177}", "{-0.424264, -0.424264, 1.177}", "{0.424264, -0.424264, 1.177}"}, selected="{-0.424264, -0.424264, 1.177}")
list_74 = ItemSelector(
    cluster.common_pts_up_3,
    {"{1.024265, 0.424264, -0.92}", "{0.424264, 1.024265, -0.92}", "{-0.424264, 1.024265, -0.92}", "{-1.024265, 0.424264, -0.92}", "{-1.024265, -0.424264, -0.92}", "{-0.424264, -1.024265, -0.92}", "{0.424264, -1.024265, -0.92}", "{1.024265, -0.424264, -0.92}"}, selected="{-0.424264, -1.024265, -0.92}")
list_75 = ItemSelector(
    cluster.common_pts_down_3,
    {"{1.024265, 0.424264, -0.96}", "{0.424264, 1.024265, -0.96}", "{-0.424264, 1.024265, -0.96}", "{-1.024265, 0.424264, -0.96}", "{-1.024265, -0.424264, -0.96}", "{-0.424264, -1.024265, -0.96}", "{0.424264, -1.024265, -0.96}", "{1.024265, -0.424264, -0.96}"}, selected="{-0.424264, -1.024265, -0.96}")
list_76 = ItemSelector(
    cluster.common_pts_down_3,
    {"{1.024265, 0.424264, -0.96}", "{0.424264, 1.024265, -0.96}", "{-0.424264, 1.024265, -0.96}", "{-1.024265, 0.424264, -0.96}", "{-1.024265, -0.424264, -0.96}", "{-0.424264, -1.024265, -0.96}", "{0.424264, -1.024265, -0.96}", "{1.024265, -0.424264, -0.96}"}, selected="{1.024265, 0.424264, -0.96}")
list_77 = ItemSelector(
    cluster.common_pts_up_3,
    {"{1.024265, 0.424264, -0.92}", "{0.424264, 1.024265, -0.92}", "{-0.424264, 1.024265, -0.92}", "{-1.024265, 0.424264, -0.92}", "{-1.024265, -0.424264, -0.92}", "{-0.424264, -1.024265, -0.92}", "{0.424264, -1.024265, -0.92}", "{1.024265, -0.424264, -0.92}"}, selected="{0.424264, 1.024265, -0.92}")
list_78 = ItemSelector(
    cluster.common_pts_down_3,
    {"{1.024265, 0.424264, -0.96}", "{0.424264, 1.024265, -0.96}", "{-0.424264, 1.024265, -0.96}", "{-1.024265, 0.424264, -0.96}", "{-1.024265, -0.424264, -0.96}", "{-0.424264, -1.024265, -0.96}", "{0.424264, -1.024265, -0.96}", "{1.024265, -0.424264, -0.96}"}, selected="{0.424264, 1.024265, -0.96}")
list_79 = ItemSelector(
    cluster.common_pts_up_3,
    {"{1.024265, 0.424264, -0.92}", "{0.424264, 1.024265, -0.92}", "{-0.424264, 1.024265, -0.92}", "{-1.024265, 0.424264, -0.92}", "{-1.024265, -0.424264, -0.92}", "{-0.424264, -1.024265, -0.92}", "{0.424264, -1.024265, -0.92}", "{1.024265, -0.424264, -0.92}"}, selected="{0.424264, -1.024265, -0.92}")
list_80 = ItemSelector(
    cluster.common_pts_down_4,
    {"{1.024265, 0.424264, 1.04}", "{0.424264, 1.024265, 1.04}", "{-0.424264, 1.024265, 1.04}", "{-1.024265, 0.424264, 1.04}", "{-1.024265, -0.424264, 1.04}", "{-0.424264, -1.024265, 1.04}", "{0.424264, -1.024265, 1.04}", "{1.024265, -0.424264, 1.04}"}, selected="{-1.024265, -0.424264, 1.04}")
list_81 = ItemSelector(
    cluster.common_pts_up_3,
    {"{1.024265, 0.424264, -0.92}", "{0.424264, 1.024265, -0.92}", "{-0.424264, 1.024265, -0.92}", "{-1.024265, 0.424264, -0.92}", "{-1.024265, -0.424264, -0.92}", "{-0.424264, -1.024265, -0.92}", "{0.424264, -1.024265, -0.92}", "{1.024265, -0.424264, -0.92}"}, selected="{-0.424264, 1.024265, -0.92}")
list_82 = ItemSelector(
    cluster.common_pts_up_4,
    {"{1.024265, 0.424264, 1.08}", "{0.424264, 1.024265, 1.08}", "{-0.424264, 1.024265, 1.08}", "{-1.024265, 0.424264, 1.08}", "{-1.024265, -0.424264, 1.08}", "{-0.424264, -1.024265, 1.08}", "{0.424264, -1.024265, 1.08}", "{1.024265, -0.424264, 1.08}"}, selected="{-1.024265, -0.424264, 1.08}")
list_83 = ItemSelector(
    cluster.b_points_lower_2,
    {"{0.424264, 0.424264, 1.16}", "{-0.424264, 0.424264, 1.16}", "{-0.424264, -0.424264, 1.16}", "{0.424264, -0.424264, 1.16}"}, selected="{0.424264, 0.424264, 1.16}")
list_84 = ItemSelector(
    cluster.common_pts_down_3,
    {"{1.024265, 0.424264, -0.96}", "{0.424264, 1.024265, -0.96}", "{-0.424264, 1.024265, -0.96}", "{-1.024265, 0.424264, -0.96}", "{-1.024265, -0.424264, -0.96}", "{-0.424264, -1.024265, -0.96}", "{0.424264, -1.024265, -0.96}", "{1.024265, -0.424264, -0.96}"}, selected="{0.424264, -1.024265, -0.96}")
list_85 = ItemSelector(
    cluster.b_points_lower_2,
    {"{0.424264, 0.424264, 1.16}", "{-0.424264, 0.424264, 1.16}", "{-0.424264, -0.424264, 1.16}", "{0.424264, -0.424264, 1.16}"}, selected="{0.424264, -0.424264, 1.16}")
list_86 = ItemSelector(
    cluster.common_pts_down_3,
    {"{1.024265, 0.424264, -0.96}", "{0.424264, 1.024265, -0.96}", "{-0.424264, 1.024265, -0.96}", "{-1.024265, 0.424264, -0.96}", "{-1.024265, -0.424264, -0.96}", "{-0.424264, -1.024265, -0.96}", "{0.424264, -1.024265, -0.96}", "{1.024265, -0.424264, -0.96}"}, selected="{-0.424264, 1.024265, -0.96}")
list_87 = ItemSelector(
    cluster.b_points_lower_2,
    {"{0.424264, 0.424264, 1.16}", "{-0.424264, 0.424264, 1.16}", "{-0.424264, -0.424264, 1.16}", "{0.424264, -0.424264, 1.16}"}, selected="{-0.424264, 0.424264, 1.16}")
list_88 = ItemSelector(
    cluster.b_points_upper_2,
    {"{0.424264, 0.424264, 1.177}", "{-0.424264, 0.424264, 1.177}", "{-0.424264, -0.424264, 1.177}", "{0.424264, -0.424264, 1.177}"}, selected="{0.424264, 0.424264, 1.177}")
list_89 = ItemSelector(
    cluster.common_pts_up_4,
    {"{1.024265, 0.424264, 1.08}", "{0.424264, 1.024265, 1.08}", "{-0.424264, 1.024265, 1.08}", "{-1.024265, 0.424264, 1.08}", "{-1.024265, -0.424264, 1.08}", "{-0.424264, -1.024265, 1.08}", "{0.424264, -1.024265, 1.08}", "{1.024265, -0.424264, 1.08}"}, selected="{0.424264, 1.024265, 1.08}")
list_90 = ItemSelector(
    cluster.common_pts_up_4,
    {"{1.024265, 0.424264, 1.08}", "{0.424264, 1.024265, 1.08}", "{-0.424264, 1.024265, 1.08}", "{-1.024265, 0.424264, 1.08}", "{-1.024265, -0.424264, 1.08}", "{-0.424264, -1.024265, 1.08}", "{0.424264, -1.024265, 1.08}", "{1.024265, -0.424264, 1.08}"}, selected="{-0.424264, -1.024265, 1.08}")
list_91 = ItemSelector(
    cluster.b_points_upper_2,
    {"{0.424264, 0.424264, 1.177}", "{-0.424264, 0.424264, 1.177}", "{-0.424264, -0.424264, 1.177}", "{0.424264, -0.424264, 1.177}"}, selected="{0.424264, -0.424264, 1.177}")
list_92 = ItemSelector(
    cluster.b_points_upper_2,
    {"{0.424264, 0.424264, 1.177}", "{-0.424264, 0.424264, 1.177}", "{-0.424264, -0.424264, 1.177}", "{0.424264, -0.424264, 1.177}"}, selected="{-0.424264, 0.424264, 1.177}")
list_93 = ItemSelector(
    cluster.common_pts_down_4,
    {"{1.024265, 0.424264, 1.04}", "{0.424264, 1.024265, 1.04}", "{-0.424264, 1.024265, 1.04}", "{-1.024265, 0.424264, 1.04}", "{-1.024265, -0.424264, 1.04}", "{-0.424264, -1.024265, 1.04}", "{0.424264, -1.024265, 1.04}", "{1.024265, -0.424264, 1.04}"}, selected="{-0.424264, -1.024265, 1.04}")
list_94 = ItemSelector(
    cluster.common_pts_down_4,
    {"{1.024265, 0.424264, 1.04}", "{0.424264, 1.024265, 1.04}", "{-0.424264, 1.024265, 1.04}", "{-1.024265, 0.424264, 1.04}", "{-1.024265, -0.424264, 1.04}", "{-0.424264, -1.024265, 1.04}", "{0.424264, -1.024265, 1.04}", "{1.024265, -0.424264, 1.04}"}, selected="{1.024265, 0.424264, 1.04}")
list_95 = ItemSelector(
    cluster.common_pts_up_4,
    {"{1.024265, 0.424264, 1.08}", "{0.424264, 1.024265, 1.08}", "{-0.424264, 1.024265, 1.08}", "{-1.024265, 0.424264, 1.08}", "{-1.024265, -0.424264, 1.08}", "{-0.424264, -1.024265, 1.08}", "{0.424264, -1.024265, 1.08}", "{1.024265, -0.424264, 1.08}"}, selected="{1.024265, 0.424264, 1.08}")
list_96 = ItemSelector(
    cluster.common_pts_down_4,
    {"{1.024265, 0.424264, 1.04}", "{0.424264, 1.024265, 1.04}", "{-0.424264, 1.024265, 1.04}", "{-1.024265, 0.424264, 1.04}", "{-1.024265, -0.424264, 1.04}", "{-0.424264, -1.024265, 1.04}", "{0.424264, -1.024265, 1.04}", "{1.024265, -0.424264, 1.04}"}, selected="{0.424264, -1.024265, 1.04}")
list_97 = ItemSelector(
    cluster.common_pts_up_4,
    {"{1.024265, 0.424264, 1.08}", "{0.424264, 1.024265, 1.08}", "{-0.424264, 1.024265, 1.08}", "{-1.024265, 0.424264, 1.08}", "{-1.024265, -0.424264, 1.08}", "{-0.424264, -1.024265, 1.08}", "{0.424264, -1.024265, 1.08}", "{1.024265, -0.424264, 1.08}"}, selected="{0.424264, -1.024265, 1.08}")
list_98 = ItemSelector(
    cluster.common_pts_down_4,
    {"{1.024265, 0.424264, 1.04}", "{0.424264, 1.024265, 1.04}", "{-0.424264, 1.024265, 1.04}", "{-1.024265, 0.424264, 1.04}", "{-1.024265, -0.424264, 1.04}", "{-0.424264, -1.024265, 1.04}", "{0.424264, -1.024265, 1.04}", "{1.024265, -0.424264, 1.04}"}, selected="{-0.424264, 1.024265, 1.04}")
list_99 = ItemSelector(
    cluster.common_pts_up_4,
    {"{1.024265, 0.424264, 1.08}", "{0.424264, 1.024265, 1.08}", "{-0.424264, 1.024265, 1.08}", "{-1.024265, 0.424264, 1.08}", "{-1.024265, -0.424264, 1.08}", "{-0.424264, -1.024265, 1.08}", "{0.424264, -1.024265, 1.08}", "{1.024265, -0.424264, 1.08}"}, selected="{-0.424264, 1.024265, 1.08}")
list_100 = ItemSelector(
    cluster.common_pts_up_4,
    {"{1.024265, 0.424264, 1.08}", "{0.424264, 1.024265, 1.08}", "{-0.424264, 1.024265, 1.08}", "{-1.024265, 0.424264, 1.08}", "{-1.024265, -0.424264, 1.08}", "{-0.424264, -1.024265, 1.08}", "{0.424264, -1.024265, 1.08}", "{1.024265, -0.424264, 1.08}"}, selected="{1.024265, -0.424264, 1.08}")
list_101 = ItemSelector(
    cluster.common_pts_down_4,
    {"{1.024265, 0.424264, 1.04}", "{0.424264, 1.024265, 1.04}", "{-0.424264, 1.024265, 1.04}", "{-1.024265, 0.424264, 1.04}", "{-1.024265, -0.424264, 1.04}", "{-0.424264, -1.024265, 1.04}", "{0.424264, -1.024265, 1.04}", "{1.024265, -0.424264, 1.04}"}, selected="{0.424264, 1.024265, 1.04}")
list_102 = ItemSelector(
    cluster.common_pts_up_4,
    {"{1.024265, 0.424264, 1.08}", "{0.424264, 1.024265, 1.08}", "{-0.424264, 1.024265, 1.08}", "{-1.024265, 0.424264, 1.08}", "{-1.024265, -0.424264, 1.08}", "{-0.424264, -1.024265, 1.08}", "{0.424264, -1.024265, 1.08}", "{1.024265, -0.424264, 1.08}"}, selected="{-1.024265, 0.424264, 1.08}")
list_103 = ItemSelector(
    cluster.common_pts_down_4,
    {"{1.024265, 0.424264, 1.04}", "{0.424264, 1.024265, 1.04}", "{-0.424264, 1.024265, 1.04}", "{-1.024265, 0.424264, 1.04}", "{-1.024265, -0.424264, 1.04}", "{-0.424264, -1.024265, 1.04}", "{0.424264, -1.024265, 1.04}", "{1.024265, -0.424264, 1.04}"}, selected="{1.024265, -0.424264, 1.04}")
list_104 = ItemSelector(
    cluster.common_pts_down_4,
    {"{1.024265, 0.424264, 1.04}", "{0.424264, 1.024265, 1.04}", "{-0.424264, 1.024265, 1.04}", "{-1.024265, 0.424264, 1.04}", "{-1.024265, -0.424264, 1.04}", "{-0.424264, -1.024265, 1.04}", "{0.424264, -1.024265, 1.04}", "{1.024265, -0.424264, 1.04}"}, selected="{-1.024265, 0.424264, 1.04}")
list_105 = ItemSelector(
    cluster.a_points_lower_2,
    {"{0.6, 0, -1.017}", "{0, 0.6, -1.017}", "{-0.6, 0, -1.017}", "{0, -0.6, -1.017}"}, selected="{0, 0.6, -1.017}")
list_106 = ItemSelector(
    cluster.a_points_lower_2,
    {"{0.6, 0, -1.017}", "{0, 0.6, -1.017}", "{-0.6, 0, -1.017}", "{0, -0.6, -1.017}"}, selected="{-0.6, 0, -1.017}")
list_107 = ItemSelector(cluster.a_points_upper_2, {"{0.6, 0, -1}", "{0, 0.6, -1}", "{-0.6, 0, -1}", "{0, -0.6, -1}"}, selected="{-0.6, 0, -1}")
list_108 = ItemSelector(
    cluster.a_points_lower_2,
    {"{0.6, 0, -1.017}", "{0, 0.6, -1.017}", "{-0.6, 0, -1.017}", "{0, -0.6, -1.017}"}, selected="{0.6, 0, -1.017}")
list_109 = ItemSelector(cluster.a_points_upper_2, {"{0.6, 0, -1}", "{0, 0.6, -1}", "{-0.6, 0, -1}", "{0, -0.6, -1}"}, selected="{0.6, 0, -1}")
list_110 = ItemSelector(
    cluster.a_points_lower_2,
    {"{0.6, 0, -1.017}", "{0, 0.6, -1.017}", "{-0.6, 0, -1.017}", "{0, -0.6, -1.017}"}, selected="{0, -0.6, -1.017}")
list_111 = ItemSelector(cluster.a_points_upper_2, {"{0.6, 0, -1}", "{0, 0.6, -1}", "{-0.6, 0, -1}", "{0, -0.6, -1}"}, selected="{0, -0.6, -1}")
list_112 = ItemSelector(cluster.a_points_upper_2, {"{0.6, 0, -1}", "{0, 0.6, -1}", "{-0.6, 0, -1}", "{0, -0.6, -1}"}, selected="{0, 0.6, -1}")

point = Point(list_59)
point_2 = Point(list_54)
point_3 = Point(list_53)
point_4 = Point(list_49)
C = Coincident(Point0=point_4, Point1=point_3, Strength=100)
C_2 = Coincident(Point0=point_2, Point1=point, Strength=100)

point_5 = Point(list_62)
point_6 = Point(list_57)
point_7 = Point(list_55)
point_8 = Point(list_50)
C_3 = Coincident(Point0=point_8, Point1=point_7, Strength=100)
C_4 = Coincident(Point0=point_6, Point1=point_5, Strength=100)

point_9 = Point(list_63)
point_10 = Point(list_58)
point_11 = Point(list_56)
point_12 = Point(list_51)
C_5 = Coincident(Point0=point_12, Point1=point_11, Strength=100)
C_6 = Coincident(Point0=point_10, Point1=point_9, Strength=100)

point_13 = Point(list_64)
point_14 = Point(list_61)
point_15 = Point(list_60)
point_16 = Point(list_52)
C_7 = Coincident(Point0=point_16, Point1=point_15, Strength=100)
C_8 = Coincident(Point0=point_14, Point1=point_13, Strength=100)

merge = Merge(Data1=cluster.b_base_points_lower_2, Data2=cluster.b_base_points_upper_2)
merge_2 = Merge(Data1=cluster.a_base_points_upper_2, Data2=cluster.a_base_points_lower_2)

# ----
# A3 B3
a3 = Brep(cluster._2)
pt = Point([list_107, list_106, list_65, list_66, list_67, list_68])
b3 = Brep(cluster._2_2)
pt_2 = Point([list_69, list_73, list_82, list_80, list_90, list_93])
debrep = DeconstructBrep(Brep=b3)  # -> Faces, Edges, Vertices
debrep_2 = DeconstructBrep(Brep=a3)  # -> Faces, Edges, Vertices
rigidbody = RigidBody(Part=a3, Points=flatten([debrep_2.Vertices, pt]), Strength=10)  # -> RigidBody, Planes
rigidbody_2 = RigidBody(Part=b3, Points=flatten([debrep.Vertices, pt_2]), Strength=10)  # -> RigidBody, Planes

# ----
# A1 B1
A = Brep(cluster._0)
B = Brep(cluster._0_2)
pt_3 = Point([list_109, list_108, list_72, list_76, list_70, list_71])
pt_4 = Point([list_83, list_88, list_95, list_94, list_89, list_101])
debrep_3 = DeconstructBrep(Brep=A)  # -> Faces, Edges, Vertices
debrep_4 = DeconstructBrep(Brep=B)  # -> Faces, Edges, Vertices
rigidbody_3 = RigidBody(Part=A, Points=flatten([debrep_3.Vertices, pt_3]), Strength=10)  # -> RigidBody, Planes
rigidbody_4 = RigidBody(Part=B, Points=flatten([debrep_4.Vertices, pt_4]), Strength=10)  # -> RigidBody, Planes

# ----
# A2 B2
a2 = Brep(cluster._1)
pt_5 = Point([list_112, list_105, list_77, list_78, list_81, list_86])
b2 = Brep(cluster._1_2)
pt_6 = Point([list_87, list_92, list_99, list_98, list_102, list_104])
debrep_5 = DeconstructBrep(Brep=b2)  # -> Faces, Edges, Vertices
debrep_6 = DeconstructBrep(Brep=a2)  # -> Faces, Edges, Vertices
rigidbody_5 = RigidBody(Part=a2, Points=flatten([debrep_6.Vertices, pt_5]), Strength=10)  # -> RigidBody, Planes
rigidbody_6 = RigidBody(Part=b2, Points=flatten([debrep_5.Vertices, pt_6]), Strength=10)  # -> RigidBody, Planes

# ----
# A4 B4
a4 = Brep(cluster._3)
b4 = Brep(cluster._3_2)
pt_7 = Point([list_111, list_110, list_74, list_75, list_79, list_84])
pt_8 = Point([list_85, list_91, list_97, list_96, list_100, list_103])
debrep_7 = DeconstructBrep(Brep=a4)  # -> Faces, Edges, Vertices
debrep_8 = DeconstructBrep(Brep=b4)  # -> Faces, Edges, Vertices
rigidbody_7 = RigidBody(Part=a4, Points=flatten([debrep_7.Vertices, pt_7]), Strength=10)  # -> RigidBody, Planes
rigidbody_8 = RigidBody(Part=b4, Points=flatten([debrep_8.Vertices, pt_8]), Strength=10)  # -> RigidBody, Planes

# ----
# A
pt_9 = Point(merge_2)
A_2 = Brep(cluster.A_4)
debrep_9 = DeconstructBrep(Brep=A_2)  # -> Faces, Edges, Vertices
list_113 = ItemSelector(
    debrep_9.Faces,
    {"Untrimmed Surface", "Untrimmed Surface", "Trimmed Surface", "Trimmed Surface"}, selected="Trimmed Surface")
area = Area(Geometry=list_113)  # -> Area, Centroid
xy = XYPlane(Origin=area.Centroid)
rigidbody_9 = RigidBody(Part=A_2, Plane=xy, Points=flatten([debrep_9.Vertices, pt_9]), Strength=10)  # -> RigidBody, Planes
support = Support(Frame=rigidbody_9.Planes, X=True, Y=True, Z=True, XX=True, YY=True, ZZ=True, Strength=100)

au = Point(list_21)
bu = Point(list_23)
_1_a_d = Point(list_15)
a_1_d = Point(list_19)
C_9 = Coincident(Point0=_1_a_d, Point1=a_1_d, Strength=100)
C_10 = Coincident(Point0=au, Point1=bu, Strength=100)
ad = Point(list_24)
bd = Point(list_22)
b_1_u = Point(list_17)
_1_b_u = Point(list_13)
C_11 = Coincident(Point0=ad, Point1=bd, Strength=100)
C_12 = Coincident(Point0=_1_b_u, Point1=b_1_u, Strength=100)
_1_a_u = Point(list_16)
a_1_u = Point(list_20)
b_1_d = Point(list_18)
_1_b_d = Point(list_14)
C_13 = Coincident(Point0=_1_a_u, Point1=a_1_u, Strength=100)
C_14 = Coincident(Point0=_1_b_d, Point1=b_1_d, Strength=100)

au_2 = Point(list_9)
bu_2 = Point(list_11)
_1_a_d_2 = Point(list_3)
a_1_d_2 = Point(list_7)
C_15 = Coincident(Point0=_1_a_d_2, Point1=a_1_d_2, Strength=100)
C_16 = Coincident(Point0=au_2, Point1=bu_2, Strength=100)
ad_2 = Point(list_12)
bd_2 = Point(list_10)
b_1_u_2 = Point(list_5)
_1_b_u_2 = Point(list)
C_17 = Coincident(Point0=ad_2, Point1=bd_2, Strength=100)
C_18 = Coincident(Point0=_1_b_u_2, Point1=b_1_u_2, Strength=100)
_1_a_u_2 = Point(list_4)
a_1_u_2 = Point(list_8)
b_1_d_2 = Point(list_6)
_1_b_d_2 = Point(list_2)
C_19 = Coincident(Point0=_1_a_u_2, Point1=a_1_u_2, Strength=100)
C_20 = Coincident(Point0=_1_b_d_2, Point1=b_1_d_2, Strength=100)

# ----
# B
B_2 = Brep(cluster.B_3)
pt_10 = Point(merge)
debrep_10 = DeconstructBrep(Brep=B_2)  # -> Faces, Edges, Vertices
list_114 = ItemSelector(
    debrep_10.Faces,
    {"Untrimmed Surface", "Untrimmed Surface", "Trimmed Surface", "Trimmed Surface"}, selected="Trimmed Surface")
area_2 = Area(Geometry=list_114)  # -> Area, Centroid
xy_2 = XYPlane(Origin=area_2.Centroid)
rigidbody_10 = RigidBody(Part=B_2, Plane=xy_2, Points=flatten([debrep_10.Vertices, pt_10]), Strength=10)  # -> RigidBody, Planes
support_2 = Support(Frame=rigidbody_10.Planes, X=True, Y=True, Z=True, XX=True, YY=True, ZZ=False, Strength=100)

au_3 = Point(list_33)
bu_3 = Point(list_35)
_1_a_d_3 = Point(list_27)
a_1_d_3 = Point(list_31)
C_21 = Coincident(Point0=_1_a_d_3, Point1=a_1_d_3, Strength=100)
C_22 = Coincident(Point0=au_3, Point1=bu_3, Strength=100)
ad_3 = Point(list_36)
bd_3 = Point(list_34)
b_1_u_3 = Point(list_29)
_1_b_u_3 = Point(list_25)
C_23 = Coincident(Point0=ad_3, Point1=bd_3, Strength=100)
C_24 = Coincident(Point0=_1_b_u_3, Point1=b_1_u_3, Strength=100)
_1_a_u_3 = Point(list_28)
a_1_u_3 = Point(list_32)
b_1_d_3 = Point(list_30)
_1_b_d_3 = Point(list_26)
C_25 = Coincident(Point0=_1_a_u_3, Point1=a_1_u_3, Strength=100)
C_26 = Coincident(Point0=_1_b_d_3, Point1=b_1_d_3, Strength=100)

a1 = Point(list_44)
b1 = Point(list_47)
_1_a_d_4 = Point(list_39)
a_1_d_4 = Point(list_42)
C_27 = Coincident(Point0=_1_a_d_4, Point1=a_1_d_4, Strength=100)
C_28 = Coincident(Point0=a1, Point1=b1, Strength=100)
a2_2 = Point(list_46)
b2_2 = Point(list_45)
b_1_u_4 = Point(list_41)
_1_b_u_4 = Point(list_37)
C_29 = Coincident(Point0=a2_2, Point1=b2_2, Strength=100)
C_30 = Coincident(Point0=_1_b_u_4, Point1=b_1_u_4, Strength=100)
_1_a_u_4 = Point(list_48)
a_1_u_4 = Point(list_43)
b_1_d_4 = Point(list_40)
_1_b_d_4 = Point(list_38)
C_31 = Coincident(Point0=_1_a_u_4, Point1=a_1_u_4, Strength=100)
C_32 = Coincident(Point0=_1_b_d_4, Point1=b_1_d_4, Strength=100)

list_115 = ItemSelector(
    debrep.Faces,
    {"Untrimmed Surface", "Trimmed Surface", "Untrimmed Surface", "Trimmed Surface", "Trimmed Surface", "Untrimmed Surface", "Untrimmed Surface", "Untrimmed Surface", "Untrimmed Surface", "Trimmed Surface", "Trimmed Surface", "Trimmed Surface", "Trimmed Surface", "Untrimmed Surface", "Trimmed Surface"}, selected="Trimmed Surface")
list_116 = ItemSelector(
    debrep_5.Faces,
    {"Untrimmed Surface", "Trimmed Surface", "Untrimmed Surface", "Trimmed Surface", "Trimmed Surface", "Untrimmed Surface", "Untrimmed Surface", "Untrimmed Surface", "Untrimmed Surface", "Trimmed Surface", "Trimmed Surface", "Trimmed Surface", "Trimmed Surface", "Untrimmed Surface", "Trimmed Surface"}, selected="Trimmed Surface")
list_117 = ItemSelector(
    debrep_8.Faces,
    {"Untrimmed Surface", "Trimmed Surface", "Untrimmed Surface", "Trimmed Surface", "Trimmed Surface", "Untrimmed Surface", "Untrimmed Surface", "Untrimmed Surface", "Untrimmed Surface", "Trimmed Surface", "Trimmed Surface", "Trimmed Surface", "Trimmed Surface", "Untrimmed Surface", "Trimmed Surface"}, selected="Trimmed Surface")
item = ListItem(List=debrep_6.Faces, Index=Slider(0, range=0..10), Wrap=True)
list_118 = ItemSelector(
    debrep_3.Faces,
    {"Trimmed Surface", "Untrimmed Surface", "Untrimmed Surface", "Untrimmed Surface", "Untrimmed Surface", "Trimmed Surface", "Trimmed Surface", "Trimmed Surface", "Trimmed Surface", "Untrimmed Surface", "Trimmed Surface"}, selected="Trimmed Surface")
list_119 = ItemSelector(
    debrep_4.Faces,
    {"Untrimmed Surface", "Trimmed Surface", "Untrimmed Surface", "Trimmed Surface", "Trimmed Surface", "Untrimmed Surface", "Untrimmed Surface", "Untrimmed Surface", "Untrimmed Surface", "Trimmed Surface", "Trimmed Surface", "Trimmed Surface", "Trimmed Surface", "Untrimmed Surface", "Trimmed Surface"}, selected="Trimmed Surface")
data_5 = Data(item)
list_120 = ItemSelector(
    debrep_3.Faces,
    {"Trimmed Surface", "Untrimmed Surface", "Untrimmed Surface", "Untrimmed Surface", "Untrimmed Surface", "Trimmed Surface", "Trimmed Surface", "Trimmed Surface", "Trimmed Surface", "Untrimmed Surface", "Trimmed Surface"}, selected="Trimmed Surface")
list_121 = ItemSelector(
    debrep_6.Faces,
    {"Trimmed Surface", "Untrimmed Surface", "Untrimmed Surface", "Untrimmed Surface", "Untrimmed Surface", "Trimmed Surface", "Trimmed Surface", "Trimmed Surface", "Trimmed Surface", "Untrimmed Surface", "Trimmed Surface"}, selected="Trimmed Surface")
list_122 = ItemSelector(
    debrep_6.Faces,
    {"Trimmed Surface", "Untrimmed Surface", "Untrimmed Surface", "Untrimmed Surface", "Untrimmed Surface", "Trimmed Surface", "Trimmed Surface", "Trimmed Surface", "Trimmed Surface", "Untrimmed Surface", "Trimmed Surface"}, selected="Trimmed Surface")
list_123 = ItemSelector(
    debrep_2.Faces,
    {"Trimmed Surface", "Untrimmed Surface", "Untrimmed Surface", "Untrimmed Surface", "Untrimmed Surface", "Trimmed Surface", "Trimmed Surface", "Trimmed Surface", "Trimmed Surface", "Untrimmed Surface", "Trimmed Surface"}, selected="Trimmed Surface")
list_124 = ItemSelector(
    debrep_2.Faces,
    {"Trimmed Surface", "Untrimmed Surface", "Untrimmed Surface", "Untrimmed Surface", "Untrimmed Surface", "Trimmed Surface", "Trimmed Surface", "Trimmed Surface", "Trimmed Surface", "Untrimmed Surface", "Trimmed Surface"}, selected="Trimmed Surface")
list_125 = ItemSelector(
    debrep_7.Faces,
    {"Trimmed Surface", "Untrimmed Surface", "Untrimmed Surface", "Untrimmed Surface", "Untrimmed Surface", "Trimmed Surface", "Trimmed Surface", "Trimmed Surface", "Trimmed Surface", "Untrimmed Surface", "Trimmed Surface"}, selected="Trimmed Surface")
alignfaces = AlignFaces(PlaneA=rigidbody_7.Planes, PlaneB=rigidbody_8.Planes, FaceA=list_125, FaceB=list_117, Flip=False, Strength=1)
number_slider_3 = Slider(10000, range=0..10000)
number_slider_4 = Slider(6158, range=0..10000)
coplanar = CoPlanar(Points=cluster.common_pts_up_3, Strength=number_slider_4)

alignfaces_2 = AlignFaces(PlaneA=rigidbody_9.Planes, PlaneB=rigidbody_3.Planes, FaceA=list_113, FaceB=list_118, Flip=False, Strength=1)
alignfaces_3 = AlignFaces(PlaneA=rigidbody_3.Planes, PlaneB=rigidbody_4.Planes, FaceA=list_120, FaceB=list_119, Flip=False, Strength=1)
alignfaces_4 = AlignFaces(PlaneA=rigidbody_3.Planes, PlaneB=rigidbody_5.Planes, FaceA=list_120, FaceB=list_121, Flip=False, Strength=1)
alignfaces_5 = AlignFaces(PlaneA=rigidbody_5.Planes, PlaneB=rigidbody_6.Planes, FaceA=list_122, FaceB=list_116, Flip=False, Strength=1)
alignfaces_6 = AlignFaces(PlaneA=rigidbody_5.Planes, PlaneB=rigidbody.Planes, FaceA=list_122, FaceB=list_123, Flip=False, Strength=1)
alignfaces_7 = AlignFaces(PlaneA=rigidbody.Planes, PlaneB=rigidbody_7.Planes, FaceA=list_124, FaceB=list_125, Flip=False, Strength=1)
alignfaces_8 = AlignFaces(PlaneA=rigidbody_3.Planes, PlaneB=rigidbody_7.Planes, FaceA=list_120, FaceB=list_125, Flip=False, Strength=1)
alignfaces_9 = AlignFaces(PlaneA=rigidbody.Planes, PlaneB=rigidbody_2.Planes, FaceA=list_124, FaceB=list_115, Flip=False, Strength=1)

merge_3 = Merge(Data1=C, Data2=C_2, Data3=C_3, Data4=C_4, Data5=C_5, Data6=C_6, Data7=C_7, Data8=C_8)
coplanar_2 = CoPlanar(Points=cluster.common_pts_down_3, Strength=number_slider_4)
merge_4 = Merge(
    Data1=C_28,
    Data2=C_29,
    Data3=C_31,
    Data4=C_27,
    Data5=C_30,
    Data6=C_32,
    Data7=C_10,
    Data8=C_11,
    Data9=C_13,
    Data10=C_9,
    Data11=C_12,
    Data12=C_14,
    Data13=C_16,
    Data14=C_17,
    Data15=C_19,
    Data16=C_15,
    Data17=C_18,
    Data18=C_20,
    Data19=C_22,
    Data20=C_23,
    Data21=C_25,
    Data22=C_21,
    Data23=C_24,
    Data24=C_26)
floor = Floor(Strength=1)
ms = MagnetSnap(Range=0.5, Strength=10)

number_slider_5 = Slider(1.432, range=0..3)
timer = Timer(TimerInterval=20, Target=number_slider_5)  # disabled
number_slider_6 = Slider(43, range=0..100)
rad = Radians(Degrees=number_slider_5)
neg = Negative(Value=number_slider_6)
rec = DataRecorder(rad, DataLimit=-10, RecordData=True)
dom = ConstructDomain(DomainStart=number_slider_6, DomainEnd=neg)
domain = Domain(Domain(-1, 1))
ma = MassAddition(Input=rec)  # -> Result, PartialResults
eval = Evaluate(F="sin(x)", x=ma.Result)
remap = RemapNumbers(Value=eval, Source=domain, Target=dom)  # -> Mapped, Clipped
panel = Panel(remap.Mapped)

data_6 = Data(remap.Mapped)
rotate = Rotate(Geometry=debrep_10.Vertices, Angle=degrees(data_6), Plane=xy_2)  # -> Geometry, Transform
anchor = Anchor(Point=debrep_10.Vertices, Target=rotate.Geometry, Strength=10000)
merge_5 = Merge(Data1=rigidbody_10.RigidBody, Data2=support_2, Data3=anchor)  # -> flatten(Result)
merge_6 = Merge(
    Data1=merge_5,
    Data2=support,
    Data3=rigidbody_9.RigidBody,
    Data4=rigidbody_3.RigidBody,
    Data5=rigidbody_4.RigidBody,
    Data6=rigidbody_5.RigidBody,
    Data7=rigidbody_6.RigidBody,
    Data8=rigidbody.RigidBody,
    Data9=rigidbody_2.RigidBody,
    Data10=rigidbody_7.RigidBody,
    Data11=rigidbody_8.RigidBody,
    Data12=anchor,
    Data13=coplanar,
    Data14=coplanar_2,
    Data16=alignfaces_7,
    Data17=alignfaces_6,
    Data18=alignfaces_4,
    Data19=alignfaces_8,
    Data20=alignfaces_3,
    Data21=alignfaces_5,
    Data22=alignfaces_9,
    Data23=alignfaces,
    Data24=alignfaces_2,
    Data25=merge_3,
    Data26=merge_4)

grab = Grab(On=True, Strength=1, Range=3)
solver = Solver(GoalObjects=flatten([merge_6, grab]), Reset=Button(), Threshold=1e-15, Tolerance=0.01, On=Toggle(False))  # -> I, V, O
data_7 = Data(solver.O)

knob = ControlKnob(Decimals=2, Limit=True, Maximum=50, Minimum=-50, Range=100, Value=-6.29)
# for inner skin
eval_2 = Evaluate(F="x-y", x=number_slider, y=cluster.half_width_of_ring_2)
inner_circle = Data(cluster.C)
# 29 mm - a
# 19.002 - b
radius = Data(eval_2)

# ==== cluster Cluster_2
x = ClusterInput()
x_2 = ClusterInput()
A = ClusterInput()
B = ClusterInput()

eval = Evaluate(F="x*2", x=x)
eval_2 = Evaluate(F="x*2", x=x_2)
multiplication = Multiplication(A=A, B=B)

R = ClusterInput()
S = ClusterInput()
R_2 = ClusterInput()
x_3 = ClusterInput()

# ----
# Inner base
polygon = Polygon(Plane=PlaneXY(0, 0, 0), Radius=R, Segments=S, FilletRadius=0)  # -> Polygon, Length
cir = Circle(Plane=PlaneXY(0, 0, 0), Radius=R_2)
explode = Explode(Curve=polygon.Polygon, Recursive=True)  # -> Segments, Vertices
item = ListItem(List=explode.Segments, Index=0, Wrap=True)

# ----
# Hole placement of outer
cir_2 = Circle(Plane=PlaneXY(0, 0, 0), Radius=multiplication)
polygon_2 = Polygon(Plane=PlaneXY(0, 0, 0), Radius=multiplication, Segments=eval, FilletRadius=0)  # -> Polygon, Length
explode_2 = Explode(Curve=polygon_2.Polygon, Recursive=True)  # -> Segments, Vertices
item_2 = ListItem(List=explode_2.Segments, Index=0, Wrap=True)

D = ClusterInput()

# ----
# Center of moving Circle
polygon_3 = Polygon(Plane=PlaneXY(0, 0, 0), Radius=eval_2, Segments=eval, FilletRadius=0)  # -> Polygon, Length
cir_3 = Circle(Plane=PlaneXY(0, 0, 0), Radius=eval_2)
explode_3 = Explode(Curve=polygon_3.Polygon, Recursive=True)  # -> Segments, Vertices
area = Area(Geometry=polygon_3.Polygon)  # -> Area, Centroid

area_2 = Area(Geometry=polygon.Polygon)  # -> Area, Centroid
area_3 = Area(Geometry=polygon_2.Polygon)  # -> Area, Centroid

# ----
# Adjust length of smaller circle (equal length)
len = Length(Curve=item_2)
len_2 = Length(Curve=item)
subtraction = Subtraction(A=len_2, B=len)
abs = Absolute(Value=subtraction)
# Depth adopted
panel = Panel(abs)
galapagos = Galapagos(fitness=abs)

# ----
# Insert Plane
number_slider = Slider(22.5, range=0..100)
rotate = Rotate(Geometry=explode_2.Vertices, Angle=degrees(number_slider), Plane=area_3.Centroid)  # -> Geometry, Transform
rotate_2 = Rotate(Geometry=explode_2.Segments, Angle=degrees(number_slider), Plane=area_3.Centroid)  # -> Geometry, Transform

l0 = ClusterInput()
l1 = ClusterInput()
l0_2 = ClusterInput()
l1_2 = ClusterInput()
duppt = RemoveDuplicatePts(Points=explode_3.Vertices, Tolerance=0.01)

# ----
# Insert Plane
rotate_3 = Rotate(Geometry=explode_3.Segments, Angle=degrees(number_slider), Plane=area.Centroid)  # -> Geometry, Transform
rotate_4 = Rotate(Geometry=explode_3.Vertices, Angle=degrees(number_slider), Plane=area.Centroid)  # -> Geometry, Transform

# ----
# Insert Plane
rotate_5 = Rotate(Geometry=explode.Vertices, Angle=degrees(number_slider), Plane=area_2.Centroid)  # -> Geometry, Transform
rotate_6 = Rotate(Geometry=explode.Segments, Angle=degrees(number_slider), Plane=area_2.Centroid)  # -> Geometry, Transform

A_2 = ClusterInput()

# ----
# The Octagon Wings (unmodified)
# Insert Plane
neg = Negative(Value=x_3)
offset = OffsetCurve(Curve=rotate_3.Geometry, Distance=D, Plane=PlaneXY(0, 0, 0), Corners=1)
offset_2 = OffsetCurve(Curve=rotate_3.Geometry, Distance=neg, Plane=PlaneXY(0, 0, 0), Corners=1)
md_slider = MDSlider(SliderMode=0, slider_value=Point(0.5, 0.5, 0.5), x_domain=Domain(0, 1), y_domain=Domain(0, 1), z_domain=Domain(0, 1))
ext = ExtendCurve(Curve=offset, Type=0, Start=l0, End=l1)
ext_2 = ExtendCurve(Curve=offset_2, Type=0, Start=l0_2, End=l1_2)
loft = Loft(Curves=[ext, ext_2], Options={Adjust=False, Closed=False, LoftEnds=0, LoftSimp=0, LoftType=0, Rebuild=10, Refit=0.01})
evalsrf = EvaluateSurface(Surface=loft, Point=md_slider)  # -> Point, Normal, UDirection, VDirection, Frame
amp = Amplitude(Vector=evalsrf.Normal, Amplitude=A_2)
neg_2 = Negative(Value=amp)
multiplication_2 = Multiplication(A=amp, B=Slider(2, range=0..10))
extr = Extrude(Base=loft, Direction=amp)
move = Move(Geometry=extr, Motion=multiplication_2)  # -> simplify(flatten(Geometry)), Transform

duppt_2 = RemoveDuplicatePts(Points=rotate_5.Geometry, Tolerance=0.01)
duppt_3 = RemoveDuplicatePts(Points=rotate_4.Geometry, Tolerance=0.01)
duppt_4 = RemoveDuplicatePts(Points=rotate.Geometry, Tolerance=0.01)

item_3 = ListItem(List=flatten(neg_2), Index=0, Wrap=True)
expression = Expression(x=item_3, Expression="x * 2")

height_of_ring = Slider(0.017, range=0..0.5)
size_of_screws = Slider(0.005, range=0..0.03)
panel_2 = Panel(item_3)
panel_3 = Panel(expression)
size_of_screws_2 = Slider(0.005, range=0..0.03)

vertices = Data(explode.Vertices)
duppt_5 = RemoveDuplicatePts(Points=vertices, Tolerance=0.01)

depth_adopted = Data(item_3)
inner_vertices = Data(duppt_5)
outer_vertices = Data(duppt)

h3 = ClusterInput()
h2 = Data(height_of_ring)
h3_2 = Data(h3)

half_width_of_ring = Slider(0.02, range=0.01..0.1)
base_circle = Data(cir)
neg_3 = Negative(Value=half_width_of_ring)
offset_3 = OffsetCurve(Curve=base_circle, Distance=neg_3, Plane=PlaneXY(0, 0, 0), Corners=1)
offset_4 = OffsetCurve(Curve=base_circle, Distance=half_width_of_ring, Plane=PlaneXY(0, 0, 0), Corners=1)
loft_2 = Loft(
    Curves=[offset_4, offset_3],
    Options={Adjust=False, Closed=False, LoftEnds=0, LoftSimp=0, LoftType=0, Rebuild=10, Refit=0.01})

md_slider_2 = MDSlider(SliderMode=0, slider_value=Point(0.5, 0.5, 0.5), x_domain=Domain(0, 1), y_domain=Domain(0, 1), z_domain=Domain(0, 1))
evalsrf_2 = EvaluateSurface(Surface=loft_2, Point=md_slider_2)  # -> Point, Normal, UDirection, VDirection, Frame
amp_2 = Amplitude(Vector=evalsrf_2.Normal, Amplitude=height_of_ring)
extr_2 = Extrude(Base=loft_2, Direction=amp_2)

cluster = Cluster(G=extr_2, A=amp_2)

# ----
# Screw combining them together
panel_4 = Panel("""0
1""")
dispatch = Dispatch(List=flatten(extr), DispatchPattern=panel_4)  # -> ListA, ListB
item_4 = ListItem(List=flatten(neg_2), Index=0, Wrap=True)
level_2_bars = Data(graft(dispatch.ListB))
center_pts_up = Data(duppt_4)
subtraction_2 = Subtraction(A=half_width_of_ring, B=size_of_screws_2)
panel_5 = Panel(subtraction_2)
circle = CircleCNR(Center=center_pts_up, Normal=item_3, Radius=subtraction_2)
move_2 = Move(Geometry=simplify(center_pts_up), Motion=simplify(flatten(amp)))  # -> Geometry, Transform
boundary = BoundarySurfaces(Edges=circle)
level_1_bars = Data(dispatch.ListA)
extr_3 = Extrude(Base=boundary, Direction=flatten(amp))
center_pts_down = Data(move_2.Geometry)
move_3 = Move(Geometry=level_2_bars, Motion=item_4)  # -> Geometry, Transform
trim = TrimSolid(Shape=graft(level_1_bars), Cutters=flatten(extr_3))
partition = PartitionList(List=extr_3, Size="2")  # -> simplify(Chunks)
merge = Merge(Data1=simplify(move_3.Geometry), Data2=partition)
sunion = SolidUnion(Breps=merge)  # -> flatten(Result)
data = Data(flatten(trim))

# ----
# Part1-Tool
subtraction_3 = Subtraction(A=half_width_of_ring, B=size_of_screws)
panel_6 = Panel(subtraction_3)
circle_2 = CircleCNR(Center=duppt_5, Normal=evalsrf_2.Normal, Radius=subtraction_3)
boundary_2 = BoundarySurfaces(Edges=circle_2)
extr_4 = Extrude(Base=boundary_2, Direction=amp_2)
move_4 = Move(Geometry=duppt_5, Motion=amp_2)  # -> Geometry, Transform

# ----
# Depth for connection
panel_7 = Panel("""0
1""")
expression_2 = Expression(x=depth_adopted, Expression="x / 2")
dispatch_2 = Dispatch(List=outer_vertices, DispatchPattern=panel_7)  # -> ListA, ListB
inner_vertices_2 = Data(simplify(graft(inner_vertices)))
move_5 = Move(Geometry=inner_vertices, Motion=expression_2)  # -> simplify(graft(Geometry)), Transform
move_6 = Move(Geometry=dispatch_2.ListB, Motion=depth_adopted)  # -> simplify(graft(Geometry)), Transform
move_7 = Move(Geometry=dispatch_2.ListB, Motion=expression_2)  # -> simplify(graft(Geometry)), Transform
merge_2 = Merge(Data1=inner_vertices_2, Data2=move_5.Geometry, Data3=move_7.Geometry, Data4=move_6.Geometry)
pline = PolyLine(Vertices=merge_2, Closed=False)
pipe = Pipe(Curve=pline, Radius=subtraction_3, Caps=0)  # -> simplify(Pipe)

bbox = BoundingBox(Content=pipe, Plane=PlaneXY(0, 0, 0))  # -> flatten(Box), Box_2
list = ItemSelector(bbox.Box, {"Box", "Box", "Box", "Box"}, selected="Box")
debox = DeconstructBox(Box=list)  # -> Plane, X, Y, Z
dedomain = DeconstructDomain(Domain=debox.Z)  # -> Start, End
h1 = Data(dedomain.End)

eval_3 = Evaluate(F="2*(x+y+z)", x=h1, y=h2, z=h3_2)

center_pts_up_2 = Data(center_pts_up)
center_pts_down_2 = Data(move_2.Geometry)
move_8 = Move(Geometry=center_pts_up_2, Motion=expression)  # -> Geometry, Transform
move_9 = Move(Geometry=center_pts_down_2, Motion=expression)  # -> Geometry, Transform

part1 = Data(extr_4)
half_width_of_ring_2 = ClusterOutput(half_width_of_ring)
C = ClusterOutput(offset_3)

moved_upper = Move(Geometry=sunion, Motion=expression)  # -> Geometry, Transform
moved_low = Move(Geometry=data, Motion=expression)  # -> Geometry, Transform

# ----
# Lower Full Bars (with connections)
trim_2 = TrimTree(Tree=part1, Depth=2)  # -> graft(Tree)
moved_low_2 = Data(moved_low.Geometry)
merge_3 = Merge(Data1=simplify(trim_2), Data2=simplify(pipe))
shift = ShiftList(List=moved_low_2, Shift=-1, Wrap=True)  # -> simplify(graft(List))
sunion_2 = SolidUnion(Breps=merge_3)
merge_4 = Merge(Data1=sunion_2, Data2=shift)
sunion_3 = SolidUnion(Breps=merge_4)

# ----
# Mirror
debrep = DeconstructBrep(Brep=moved_low.Geometry)  # -> Faces, Edges, Vertices
md_slider_3 = MDSlider(SliderMode=0, slider_value=Point(0.5, 0.5, 0.5), x_domain=Domain(0, 1), y_domain=Domain(0, 1), z_domain=Domain(0, 1))
item_5 = ListItem(List=flatten(debrep.Faces), Index=0, Wrap=True)
evalsrf_3 = EvaluateSurface(Surface=item_5, Point=md_slider_3)  # -> Point, Normal, UDirection, VDirection, Frame
data_2 = Data(item_5)
mirror = Mirror(Geometry=sunion_2, Plane=evalsrf_3.Point)  # -> Geometry, Transform

# ----
# Upper Full Bars (with connections)
movetoplane = MoveToPlane(Geometry=area_2.Centroid, Plane=evalsrf_3.Point, Above=True, Below=True)  # -> Geometry, Transform
moved_upper_2 = Data(simplify(graft(moved_upper.Geometry)))
rotate_7 = Rotate(Geometry=mirror.Geometry, Angle=degrees("45"), Plane=movetoplane.Geometry)  # -> Geometry, Transform
merge_5 = Merge(Data1=rotate_7.Geometry, Data2=moved_upper_2)
sunion_4 = SolidUnion(Breps=merge_5)

Z = UnitZ(Factor=1)
neg_4 = Negative(Value=Z)
move_b = Move(Geometry=move_8.Geometry, Motion=Z)  # -> Geometry, Transform
move_b_2 = Move(Geometry=move_9.Geometry, Motion=Z)  # -> Geometry, Transform
move_a = Move(Geometry=move_9.Geometry, Motion=neg_4)  # -> Geometry, Transform
move_a_2 = Move(Geometry=duppt_5, Motion=neg_4)  # -> Geometry, Transform
move_a_3 = Move(Geometry=move_4.Geometry, Motion=neg_4)  # -> Geometry, Transform

# ----
# Base1(ring)
trim_3 = TrimSolid(Shape=extr_2, Cutters=extr_4)
a_base_points_upper = Data(duppt_5)
a_base_points_lower = Data(move_4.Geometry)
a_points_upper = Data(move_a_2.Geometry)
a_points_lower = Data(move_a_3.Geometry)

# ----
# Upper ring and points
mir_pts_up = Mirror(Geometry=a_base_points_lower, Plane=evalsrf_3.Point)  # -> Geometry, Transform
mirror_2 = Mirror(Geometry=trim_3, Plane=evalsrf_3.Point)  # -> Geometry, Transform
mir_pts_low = Mirror(Geometry=a_base_points_upper, Plane=evalsrf_3.Point)  # -> Geometry, Transform
rotate_8 = Rotate(Geometry=mirror_2.Geometry, Angle=degrees("45"), Plane=movetoplane.Geometry)  # -> Geometry, Transform
rotate_9 = Rotate(Geometry=mir_pts_low.Geometry, Angle=degrees("45"), Plane=movetoplane.Geometry)  # -> Geometry, Transform
rotate_10 = Rotate(Geometry=mir_pts_up.Geometry, Angle=degrees("45"), Plane=movetoplane.Geometry)  # -> Geometry, Transform

move_b_3 = Move(Geometry=rotate_9.Geometry, Motion=Z)  # -> Geometry, Transform
move_b_4 = Move(Geometry=rotate_10.Geometry, Motion=Z)  # -> Geometry, Transform
move_a_4 = Move(Geometry=sunion_3, Motion=neg_4)  # -> Geometry, Transform
move_b_5 = Move(Geometry=sunion_4, Motion=Z)  # -> Geometry, Transform
move_a_5 = Move(Geometry=move_8.Geometry, Motion=neg_4)  # -> Geometry, Transform

# ----
# Base2(ring) (up)
B_2 = Data(rotate_8.Geometry)
b_base_points_lower = Data(rotate_9.Geometry)
b_base_points_upper = Data(rotate_10.Geometry)
b_points_lower = Data(move_b_3.Geometry)
b_points_upper = Data(move_b_4.Geometry)

# ----
# A common
common_pts_down = Data(move_a.Geometry)
common_pts_up = Data(move_a_5.Geometry)

# ----
# Final Output
lower_bars_a = Data(move_a_4.Geometry)
upper_bars_b = Data(move_b_5.Geometry)

# ----
# B common
common_pts_down_2 = Data(move_b_2.Geometry)
common_pts_up_2 = Data(move_b.Geometry)

B_3 = ClusterOutput(B_2)
A_3 = Data(trim_3)
a_base_points_upper_2 = ClusterOutput(a_base_points_upper)
A_4 = ClusterOutput(A_3)
a_base_points_lower_2 = ClusterOutput(a_base_points_lower)
common_pts_up_3 = ClusterOutput(common_pts_up)
common_pts_down_3 = ClusterOutput(common_pts_down)
bang = ExplodeTree(Data=lower_bars_a)  # -> Branch0, Branch1, Branch2, Branch3
common_pts_up_4 = ClusterOutput(common_pts_up_2)
bang_2 = ExplodeTree(Data=upper_bars_b)  # -> Branch0, Branch1, Branch2, Branch3
common_pts_down_4 = ClusterOutput(common_pts_down_2)
b_base_points_lower_2 = ClusterOutput(b_base_points_lower)
b_points_lower_2 = ClusterOutput(b_points_lower)
b_base_points_upper_2 = ClusterOutput(b_base_points_upper)
b_points_upper_2 = ClusterOutput(b_points_upper)
a_points_upper_2 = ClusterOutput(a_points_upper)
a_points_lower_2 = ClusterOutput(a_points_lower)
_0 = ClusterOutput(bang.Branch0)
_1 = ClusterOutput(bang.Branch1)
_2 = ClusterOutput(bang.Branch2)
_3 = ClusterOutput(bang.Branch3)
_0_2 = ClusterOutput(bang_2.Branch0)
_1_2 = ClusterOutput(bang_2.Branch1)
_2_2 = ClusterOutput(bang_2.Branch2)
_3_2 = ClusterOutput(bang_2.Branch3)

# ==== cluster Cluster_3
data = ClusterInput()
data_2 = ClusterInput()
data_3 = ClusterInput()
data_4 = Data(data)
data_5 = Data(data_2)
data_6 = Data(data_3)
data_7 = ClusterInput()
data_8 = Data(data_7)

# ----
# Determined By design (chinese culture)
# Determined By design (human scale)
no_of_segments_octagon = Slider(4, range=4..12)
number_slider = Slider(1.2, range=1.2..2)

data_9 = ClusterInput()
data_10 = Data(data_9)

# ----
# Inner base
polygon = Polygon(Plane=PlaneXY(0, 0, 0), Radius=data_8, Segments=no_of_segments_octagon, FilletRadius=0)  # -> Polygon, Length
cir = Circle(Plane=PlaneXY(0, 0, 0), Radius=data_8)
explode = Explode(Curve=polygon.Polygon, Recursive=True)  # -> Segments, Vertices
item = ListItem(List=explode.Segments, Index=0, Wrap=True)

vertices = Data(explode.Vertices)
duppt = RemoveDuplicatePts(Points=vertices, Tolerance=0.01)

height_of_wooden_bar_from_sides = Slider(0.04, range=0..1)
size_of_screws = Slider(0.005, range=0..0.03)
additional_bar_length = Slider(1.13, range=0.1..2)
half_width_of_wooden_bar = Slider(0.11, range=0..1)
height_of_ring = Slider(0.017, range=0..0.5)
size_of_screws_2 = Slider(0.005, range=0..0.03)
half_width_of_ring = Slider(0.02, range=0.01..0.1)
number_slider_2 = Slider(0.094, range=0..1)
number_slider_3 = Slider(45, range=0..100)
subtraction = Subtraction(A=half_width_of_ring, B=size_of_screws_2)

# ----
# Depth adopted
base_circle = Data(cir)
neg = Negative(Value=half_width_of_ring)
offset = OffsetCurve(Curve=base_circle, Distance=half_width_of_ring, Plane=PlaneXY(0, 0, 0), Corners=1)
offset_2 = OffsetCurve(Curve=base_circle, Distance=neg, Plane=PlaneXY(0, 0, 0), Corners=1)
loft = Loft(
    Curves=[offset, offset_2],
    Options={Adjust=False, Closed=False, LoftEnds=0, LoftSimp=0, LoftType=0, Rebuild=10, Refit=0.01})

md_slider = MDSlider(SliderMode=0, slider_value=Point(0.5, 0.5, 0.5), x_domain=Domain(0, 1), y_domain=Domain(0, 1), z_domain=Domain(0, 1))
evalsrf = EvaluateSurface(Surface=loft, Point=md_slider)  # -> Point, Normal, UDirection, VDirection, Frame
amp = Amplitude(Vector=evalsrf.Normal, Amplitude=height_of_ring)
extr = Extrude(Base=loft, Direction=amp)

factor_for_equal_sides = Slider(1.84776, range=1.1..2)
area = Area(Geometry=polygon.Polygon)  # -> Area, Centroid

eval = Evaluate(F="x*2", x=no_of_segments_octagon)
multiplication = Multiplication(A=data_8, B=factor_for_equal_sides)
eval_2 = Evaluate(F="x*2", x=data_8)

# ----
# Hole placement of outer
polygon_2 = Polygon(Plane=PlaneXY(0, 0, 0), Radius=multiplication, Segments=eval, FilletRadius=0)  # -> Polygon, Length
cir_2 = Circle(Plane=PlaneXY(0, 0, 0), Radius=multiplication)
explode_2 = Explode(Curve=polygon_2.Polygon, Recursive=True)  # -> Segments, Vertices
item_2 = ListItem(List=explode_2.Segments, Index=0, Wrap=True)

# ----
# Center of moving Circle
polygon_3 = Polygon(Plane=PlaneXY(0, 0, 0), Radius=eval_2, Segments=eval, FilletRadius=0)  # -> Polygon, Length
cir_3 = Circle(Plane=PlaneXY(0, 0, 0), Radius=eval_2)
explode_3 = Explode(Curve=polygon_3.Polygon, Recursive=True)  # -> Segments, Vertices
area_2 = Area(Geometry=polygon_3.Polygon)  # -> Area, Centroid

area_3 = Area(Geometry=polygon_2.Polygon)  # -> Area, Centroid

number_slider_4 = Slider(22.5, range=0..100)
rotate = Rotate(Geometry=explode_2.Vertices, Angle=degrees(number_slider_4), Plane=area_3.Centroid)  # -> Geometry, Transform
rotate_2 = Rotate(Geometry=explode_2.Segments, Angle=degrees(number_slider_4), Plane=area_3.Centroid)  # -> Geometry, Transform

rotate_3 = Rotate(Geometry=explode_3.Segments, Angle=degrees(number_slider_4), Plane=area_2.Centroid)  # -> Geometry, Transform
rotate_4 = Rotate(Geometry=explode_3.Vertices, Angle=degrees(number_slider_4), Plane=area_2.Centroid)  # -> Geometry, Transform

# ----
# The Octagon Wings (unmodified)
neg_2 = Negative(Value=data_6)
offset_3 = OffsetCurve(Curve=rotate_3.Geometry, Distance=neg_2, Plane=PlaneXY(0, 0, 0), Corners=1)
offset_4 = OffsetCurve(Curve=rotate_3.Geometry, Distance=data_6, Plane=PlaneXY(0, 0, 0), Corners=1)
md_slider_2 = MDSlider(SliderMode=0, slider_value=Point(0.5, 0.5, 0.5), x_domain=Domain(0, 1), y_domain=Domain(0, 1), z_domain=Domain(0, 1))
ext = ExtendCurve(Curve=offset_4, Type=0, Start=data_10, End=data_5)
ext_2 = ExtendCurve(Curve=offset_3, Type=0, Start=data_10, End=data_5)
loft_2 = Loft(Curves=[ext, ext_2], Options={Adjust=False, Closed=False, LoftEnds=0, LoftSimp=0, LoftType=0, Rebuild=10, Refit=0.01})  # -> flatten(Loft)
evalsrf_2 = EvaluateSurface(Surface=reparameterize(loft_2), Point=md_slider_2)  # -> Point, flatten(Normal), UDirection, VDirection, Frame
amp_2 = Amplitude(Vector=evalsrf_2.Normal, Amplitude=data_4)
neg_3 = Negative(Value=amp_2)
multiplication_2 = Multiplication(A=amp_2, B=Slider(2, range=0..10))
extr_2 = Extrude(Base=loft_2, Direction=amp_2)  # -> flatten(Extrusion)
move = Move(Geometry=extr_2, Motion=multiplication_2)  # -> simplify(flatten(Geometry)), Transform

rotate_5 = Rotate(Geometry=explode.Segments, Angle=degrees(number_slider_3), Plane=area.Centroid)  # -> Geometry, Transform
rotate_6 = Rotate(Geometry=explode.Vertices, Angle=degrees(number_slider_3), Plane=area.Centroid)  # -> Geometry, Transform

duppt_2 = RemoveDuplicatePts(Points=explode_3.Vertices, Tolerance=0.01)
duppt_3 = RemoveDuplicatePts(Points=rotate_6.Geometry, Tolerance=0.01)
duppt_4 = RemoveDuplicatePts(Points=rotate_4.Geometry, Tolerance=0.01)
duppt_5 = RemoveDuplicatePts(Points=rotate.Geometry, Tolerance=0.01)

weave = Weave(Pattern=[0, 1], Stream0=graft(duppt), Stream1=graft(duppt_3), NullGaps=False)  # -> flatten(Weave)

item_3 = ListItem(List=flatten(neg_3), Index=0, Wrap=True)
expression = Expression(x=item_3, Expression="x * 2")

i = ClusterOutput(item_3)

# ----
# Screw combining them together
panel = Panel("""0
1""")
dispatch = Dispatch(List=flatten(extr_2), DispatchPattern=panel)  # -> ListA, ListB
item_4 = ListItem(List=flatten(neg_3), Index=0, Wrap=True)
level_2_bars = Data(graft(dispatch.ListB))
center_pts_up = Data(duppt_5)
subtraction_2 = Subtraction(A=half_width_of_ring, B=size_of_screws)
panel_2 = Panel(subtraction_2)
circle = CircleCNR(Center=center_pts_up, Normal=item_3, Radius=subtraction_2)
move_2 = Move(Geometry=simplify(center_pts_up), Motion=simplify(flatten(amp_2)))  # -> Geometry, Transform
boundary = BoundarySurfaces(Edges=circle)
level_1_bars = Data(dispatch.ListA)
extr_3 = Extrude(Base=boundary, Direction=flatten(amp_2))
center_pts_down = Data(move_2.Geometry)
move_3 = Move(Geometry=level_2_bars, Motion=item_4)  # -> Geometry, Transform
trim = TrimSolid(Shape=graft(level_1_bars), Cutters=flatten(extr_3))
partition = PartitionList(List=extr_3, Size="2")  # -> simplify(Chunks)
merge = Merge(Data1=simplify(move_3.Geometry), Data2=partition)
sunion = SolidUnion(Breps=merge)

midpt = CurveMiddle(Curve=offset_3)
total_inner_vertces = Data(weave)
outer_vertices = Data(flatten(midpt))
shift = ShiftList(List=total_inner_vertces, Shift=1, Wrap=True)
list = ItemSelector(
    outer_vertices,
    {"{0.706156, 0.706156, 0}", "{0, 0.998655, 0}", "{-0.706156, 0.706156, 0}", "{-0.998655, 0, 0}", "{-0.706156, -0.706156, 0}", "{0, -0.998655, 0}", "{0.706156, -0.706156, 0}", "{0.998655, 0, 0}"}, selected="{0.706156, 0.706156, 0}")
ln = Line(StartPoint=outer_vertices, EndPoint=shift)
list_2 = ItemSelector(
    total_inner_vertces,
    {"{0.6, 0, 0}", "{0.424264, 0.424264, 0}", "{0, 0.6, 0}", "{-0.424264, 0.424264, 0}", "{-0.6, 0, 0}", "{-0.424264, -0.424264, 0}", "{0, -0.6, 0}", "{0.424264, -0.424264, 0}"}, selected="{0.6, 0, 0}")
panel_3 = Panel("""0
1""")
pipe = Pipe(Curve=ln, Radius=subtraction, Caps=0)  # -> flatten(Pipe)
expression_2 = Expression(x=item_3, Expression="3*x / 2")
dispatch_2 = Dispatch(List=pipe, DispatchPattern=panel_3)  # -> ListA, ListB
expression_3 = Expression(x=item_3, Expression="x / 2")
move_4 = Move(Geometry=dispatch_2.ListA, Motion=expression_3)  # -> simplify(graft(Geometry)), Transform
move_5 = Move(Geometry=dispatch_2.ListB, Motion=expression_2)  # -> simplify(graft(Geometry)), Transform

G = ClusterOutput(move_4.Geometry)
G_2 = ClusterOutput(move_5.Geometry)
R = ClusterOutput(trim)
R_2 = ClusterOutput(sunion)

# ==== cluster Cluster
number_slider = Slider(1.77, range=0..3)  # disabled
fromp = FromPolylines(Weld=-1, Min_Triangulation=True)  # disabled
from_mesh = FromMesh(Mesh=fromp, ID=0, It=1000)  # -> Mesh, VertexID, Polylines; disabled
number_slider_2 = Slider(1.9, range=1..5)  # disabled
number_slider_3 = Slider(1, range=0..1)  # disabled
top = GetPolylines()  # disabled
number_slider_4 = Slider(0.84, range=0..1)  # disabled
recipricalextend = RecipricalExtend(Mesh=fromp, Angle=number_slider_4, Scale=number_slider, NormalType=True, Height=number_slider)  # -> CM, C0, C1, P, EP; disabled
recipricalextend_2 = RecipricalExtend(Angle=0.7, Scale=1.4, NormalType=True, Height=1)  # -> CM, C0, C1, P, EP; disabled
recipricaledges = RecipricalEdges(Mesh=fromp, Angle=expr("0", 0.7), Scale=number_slider_2, NormalType=number_slider_3)  # -> Curve, ID0, ID1, Vectors; disabled
offsettrianglemesh = OffsetTriangleMesh(Dist=0.01, Chamfer=0.001)  # -> P0, P1, S, P; disabled
number_slider_5 = Slider(4.15, range=0..5)  # disabled
data = Data(<missing>)  # disabled
A = ClusterInput()
panel = Panel("2")  # disabled
multiplication = Multiplication(A=A, B=panel)  # disabled
G = ClusterInput()
move = Move(Geometry=G, Motion=multiplication)  # -> Geometry, Transform; disabled
mirror = Mirror(Plane=PlaneYZ(0, 0, 0))  # -> Geometry, Transform; disabled
