# Grasshopper definition 200204_full_Assembly_w_timer_c#.gh (Grasshopper 1.0.7)
# plug-ins: Kangaroo Components, Kangaroo2 Components

crv = Curve(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)  # disabled
crv_2 = Curve(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)  # disabled
explode = Explode(Curve=crv_2, Recursive=True)  # -> Segments, Vertices; disabled
explode_2 = Explode(Curve=crv, Recursive=True)  # -> Segments, Vertices; disabled
show = Show(G=crv)  # disabled
direction = Direction(Line=explode_2.Segments, Strength=1)  # disabled
direction_2 = Direction(Line=explode.Segments, Strength=1)  # disabled
show_2 = Show(G=crv_2)  # disabled
entwine = Entwine(Branch00=[direction_2, show_2], Branch01=[direction, show], FlattenInputs=True)  # disabled
# Custom iteration script using the solver library without the timer. Also note this creates separate solver instances for each branch of the data tree.
# 
# (You will need to update the reference assembly location to your copy of the dll)
customiteration = CSharpScript(x=entwine, Reference="F:\Program files\grasshopper\Plug-ins\Grasshopper\Components\KangarooSolver.dll")  # -> out, A, B; inputs x: list; disabled; same code as same_as_kangaroo_solver
panel = Panel(customiteration.A)  # disabled
height_of_wooden_bar_from_sides = Slider(0.04, range=0..1)
# Determined By design (human scale)
# Determined By design (chinese culture)
# Determined By design (human scale)
shortside_bar_length = Slider(0.023, range=0..1)
additional_bar_length = Slider(0.69, range=0.1..2)
half_width_of_wooden_bar = Slider(0.11, range=0..1)
factor_for_equal_sides = Slider(1.84776, range=1.1..2)

# ----
# Determined By design (chinese culture)
number_slider = Slider(0.6, range=0.6..2)
no_of_segments_octagon = Slider(4, range=4..12)

# ----
# Determined by Galapagos
factor_for_equal_sides_2 = Slider(1.84776, range=1.1..2)

cluster = Cluster_2(
    R_2=number_slider,
    R=number_slider,
    S=no_of_segments_octagon,
    x=no_of_segments_octagon,
    x_2=number_slider,
    A=number_slider,
    B=factor_for_equal_sides_2,
    h3=height_of_wooden_bar_from_sides,
    A_2=height_of_wooden_bar_from_sides,
    l0=shortside_bar_length,
    D=half_width_of_wooden_bar,
    l1=additional_bar_length,
    x_3=half_width_of_wooden_bar,
    l0_2=shortside_bar_length,
    l1_2=additional_bar_length)  # -> B_3, b_base_points_lower_2, b_base_points_upper_2, b_points_lower_2, b_points_upper_2, A_4, a_base_points_upper_2, a_base_points_lower_2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
series = Series(Start=0, Step=1, Count=10)  # -> graft(Series)
series_2 = Series(Start=0, Step=1, Count=10)  # -> graft(Series)
merge = Merge(Data1=series_2, Data2=series)
panel_2 = Panel(merge)
c_script = CSharpScript(x=merge)  # -> out, A; inputs x: tree
# ---------- c_script: C# ----------
    A = x.BranchCount;
# ---------- end c_script ----------

# ----
# for inner skin
eval = Evaluate(F="x-y", x=number_slider, y=cluster.half_width_of_ring_2)
inner_circle = Data(cluster.C)
radius = Data(eval)

number_slider_2 = Slider(3, range=0..3)
number_slider_3 = Slider(43, range=0..100)
timer = Timer(TimerInterval=20, Target=number_slider_2)  # disabled
rad = Radians(Degrees=number_slider_2)
neg = Negative(Value=number_slider_3)
rec = DataRecorder(rad, DataLimit=-10, RecordData=True)
dom = ConstructDomain(DomainStart=number_slider_3, DomainEnd=neg)
ma = MassAddition(Input=rec)  # -> Result, PartialResults
domain = Domain(Domain(-1, 1))
eval_2 = Evaluate(F="sin(x)", x=ma.Result)
remap = RemapNumbers(Value=eval_2, Source=domain, Target=dom)  # -> Mapped, Clipped
panel_3 = Panel(remap.Mapped)

timer_2 = Timer(TimerInterval=20, Target=number_slider_6)  # disabled

# ----
# Boundaries
number_slider_4 = Slider(7, range=0..100)
dom_2 = ConstructDomain(DomainStart=number_slider_4, DomainEnd=Slider(-8, range=-10..10))
dom_3 = ConstructDomain(DomainStart=Slider(6, range=0..100), DomainEnd=Slider(-6, range=-10..10))
rectangle = Rectangle(Plane=PlaneXY(0, 0, 0), XSize=dom_2, YSize=dom_3, Radius=0)  # -> Rectangle, Length

number_slider_5 = Slider(5, range=0..10)
number_slider_6 = Slider(0.01, range=0..1)
rec_2 = DataRecorder(number_slider_6, DataLimit=-10, RecordData=True)
ma_2 = MassAddition(Input=rec_2)  # -> Result, PartialResults
number_slider_7 = Slider(2.5, range=0..10)
cluster_2 = Cluster_3(E=rectangle.Rectangle)  # disabled

# ----
# Central and Side charges and their Spinning forces
number_slider_8 = Slider(1.5, range=0..10)
pt = Point(Point(0, 0, 0))
panel_4 = Panel("""{-7,-3,0}
{7,3,0}""")
pcharge = PointCharge(Point=pt, Charge=Slider(1, range=-1..2), Decay=number_slider_8, Bounds=rectangle.Rectangle)
pcharge_2 = PointCharge(Point=panel_4, Charge=Slider(-0.8, range=-2..2), Decay=Slider(0.9, range=0..10), Bounds=rectangle.Rectangle)
fspin = SpinForce(
    Plane=pt,
    Strength=Slider(2.71, range=0..15),
    Radius=number_slider_7,
    Decay=Slider(1.481, range=0..10),
    Bounds=rectangle.Rectangle)

cir = Circle(Plane=pt, Radius=number_slider_7)
eval_3 = EvaluateCurve(Curve=reparameterize(cir), Parameter=Slider(0, range=-1..1))  # -> Point, Tangent, Angle
eval_4 = EvaluateCurve(Curve=reparameterize(cir), Parameter=Slider(0.483, range=0..1))  # -> Point, Tangent, Angle
merge_2 = Merge(Data1=eval_3.Point, Data2=eval_4.Point)

number_slider_9 = Slider(5, range=0..5)
domain_2 = Domain(Domain(0, 40))
item = ListItem(Index=0, Wrap=True)  # -> Item, Item1

# ----
# Creating the Field Lines
mergef = MergeFields(Fields=[fspin, pcharge, pcharge_2])
fline = FieldLine(Field=mergef, Point=merge_2, Steps=1000, Accuracy=0.1, Method=3)
merge_3 = Merge(Data2=fline)
scale = Scale(Geometry=merge_3, Center=Point(0, 0, 0), Factor=Slider(1.4, range=1..2))  # -> Geometry, Transform

number_slider_10 = Slider(6, range=6..20)
unroller = Unroller(Unroll=1)
meshcp = MeshClosestPoint()  # -> Point, Index, Parameter
fcircle = CircleFit()  # -> Circle, Radius, Deviation
height_of_wooden_bar_from_sides_2 = Slider(0.04, range=0..1)
data = Data(height_of_wooden_bar_from_sides)
size_of_screws = Slider(0.005, range=0..0.03)
data_2 = Data(additional_bar_length)
additional_bar_length_2 = Slider(1.13, range=0.1..2)
data_3 = Data(half_width_of_wooden_bar)
half_width_of_wooden_bar_2 = Slider(0.11, range=0..1)

# ---- group: for inner circle
additional_radius = Slider(0.082, range=0..0.6)

# ----
height_of_ring = Slider(0.017, range=0..0.5)
size_of_screws_2 = Slider(0.005, range=0..0.03)
data_4 = Data(number_slider)

# ----
# Domain determines which cuve i will use to create the object along
number_slider_11 = Slider(0, range=0..100)
# anemone-dividing curve based on domain
# based on curvature (curvature >>.. number of elements <<)
number_slider_12 = Slider(4, range=0..10)
dom_4 = ConstructDomain(DomainStart=number_slider_11, DomainEnd=number_slider_12)

# ----
# Adjusting the height of the curve
number_slider_13 = Slider(20, range=20..50)
divide = DivideCurve(Curve=scale.Geometry, Count=number_slider_13, Kinks=False)  # -> Points, Tangents, Parameters
seq = Sequence(Notation="[N-1] + 1", Length=number_slider_13, Initial=0)
merge_4 = Merge(Data1=seq, Data2=seq)
partition = PartitionList(List=merge_4, Size=number_slider_13)  # -> simplify(Chunks)
graph = GraphMapper(
    partition,
    x0=0,
    x1=20,
    y0=0,
    y1=3.5,
    container_name="Sine",
    Equation_px=[0.8013471961, 0.9688360095],
    Equation_py=[0, 0.8852931261])
graph_2 = GraphMapper(partition, x0=0, x1=20, y0=0, y1=3.5, container_name="Bezier", cpx=[0, 0.2732604444, 0.7040291429, 1], cpy=[0, 1, 1, 0])
graph_3 = GraphMapper(
    partition,
    x0=0,
    x1=19,
    y0=0,
    y1=2.5,
    container_name="Sine Summation",
    Equation0_px=[0, 0.5024531484],
    Equation0_py=[0, 0.6126400232],
    Equation1_px=[1, 0.5129324198],
    Equation1_py=[0, 0.3460794687])
bnd = Bounds(Numbers=graph_3)
remap_2 = RemapNumbers(Value=graph_3, Source=bnd, Target=dom_4)  # -> Mapped, Clipped
Z = UnitZ(Factor=remap_2.Mapped)
move = Move(Geometry=divide.Points, Motion=Z)  # -> Geometry, Transform
nurbs = NurbsCurve(Vertices=move.Geometry, Degree=4, Periodic=False)  # -> Curve, Length, Domain

elevated_curves = Data(nurbs.Curve)
horzntl_curves = Data(graft(scale.Geometry))

elevated_curve = Data(elevated_curves)
end = EndPoints(Curve=elevated_curve)  # -> Start, End
bang = ExplodeTree(Data=elevated_curve)  # -> Branch0, Branch1
curvepoint = PointOnCurve(bang.Branch1, parameter=0.548)
curvepoint_2 = PointOnCurve(bang.Branch0, parameter=0.678)
eval_5 = EvaluateCurve(Curve=reparameterize(bang.Branch0), Parameter=ma_2.Result)  # -> Point, Tangent, Angle
end_2 = EndPoints(Curve=elevated_curve)  # -> Start, End
nurbs_2 = NurbsCurve(Vertices=divide.Points, Degree=3, Periodic=False)  # -> Curve, Length, Domain
cluster_3 = Cluster_6(
    A=additional_radius,
    B=data_4,
    A_4=height_of_ring,
    x_2=data_4,
    A_2=data_4,
    B_2=size_of_screws_2,
    A_3=data,
    l1=data_2,
    D=data_3,
    x=data_3,
    l1_2=data_2,
    data=shortside_bar_length,
    B_3=size_of_screws)  # -> i, G, G_2, R_2, R
panel_5 = Panel(graph_3)

upper_level = Data(flatten(cluster_3.R_2))
lower_level = Data(flatten(cluster_3.R))
move_2 = Move(Geometry=lower_level, Motion=cluster_3.i)  # -> Geometry, Transform
move_3 = Move(Geometry=upper_level, Motion=cluster_3.i)  # -> Geometry, Transform

data_5 = Data(flatten(cluster_3.G))
data_6 = Data(flatten(cluster_3.G_2))

sunion = SolidUnion(Breps=[data_6, move_3.Geometry])
sunion_2 = SolidUnion(Breps=[data_5, move_2.Geometry])
panel_6 = Panel("""0
1""")
join = BrepJoin(Breps=[sunion_2, sunion])  # -> Breps, Closed
merge_5 = Merge(Data1=graft(move_3.Geometry), Data2=graft(move_2.Geometry))
bbox = BoundingBox(Content=join.Breps, Plane=PlaneXY(0, 0, 0), UnionBox=True)  # -> Box, Box_2
mjoin = MeshJoin(Meshes=join.Breps)
object = Data(join.Breps)
boxprop = BoxProperties(Box=bbox.Box)  # -> Center, Diagonal, Area, Volume, Degeneracy

shape = Data(mjoin)
panel_7 = Panel(Z)

pdecon = Deconstruct(Point=move.Geometry)  # -> XComponent, YComponent, ZComponent; disabled
weave = Weave(Pattern=[0, 1], Stream0=nurbs_2.Curve, Stream1=nurbs.Curve, NullGaps=False)  # disabled
loft = Loft(Curves=weave, Options={Adjust=False, Closed=False, LoftEnds=0, LoftSimp=0, LoftType=0, Rebuild=10, Refit=0.01})  # disabled

radius_2 = Data()

# ----
# Interference Check
number_slider_14 = Slider(68, range=10..200)

eval_6 = Evaluate(F="(z/2)-(y/2)", z=number_slider_14, y=number_slider_10)
int = Integer(eval_6)

eval_7 = Evaluate(F="z-(x+y)", x=Slider(34, range=0..100), y=Slider(40, range=0..100), z=number_slider_14)

series_3 = Series(Start=expr("x+1", int), Step=1, Count=number_slider_10)
panel_8 = Panel(series_3)

divide_2 = DivideCurve(Curve=reparameterize(elevated_curves), Count=number_slider_14, Kinks=False)  # -> Points, unitize(Tangents), Parameters
Z_2 = UnitZ(Factor=expr("-1", 1))
xy = XYPlane(Origin=Point(0, 0, 0))
project = ProjectPoint(Point=divide_2.Points, Direction=Z_2, Geometry=xy)  # -> Point, Index
crv_cp = CurveClosestPoint(Point=project.Point, Curve=reparameterize(horzntl_curves))  # -> Point, Parameter, Distance

item_2 = ListItem(List=series_3, Index=0, Wrap=True)
centre_point = Data(divide_2.Points)

pframe = PerpFrame(Curve=reparameterize(horzntl_curves), Parameter=crv_cp.Parameter)
pl_origin = PlaneOrigin(Base=pframe, Origin=divide_2.Points)

cull_i = CullIndex(List=pl_origin, Indices=series_3, Wrap=True)
item_3 = ListItem(List=pl_origin, Index=series_3, Wrap=True)
digestion_pts = Point(item_3)
bang_2 = ExplodeTree(Data=digestion_pts)  # -> Branch0, Branch1
dist = Distance(PointA=curvepoint_2, PointB=bang_2.Branch0)
dist_2 = Distance(PointA=curvepoint, PointB=bang_2.Branch1)
item_4 = ListItem(List=dist_2, Index=number_slider_9, Wrap=True)
dist_3 = Distance(PointA=digestion_pts, PointB=end_2.Start)
dist_4 = Distance(PointA=digestion_pts, PointB=end_2.End)
item_5 = ListItem(List=dist, Index=number_slider_9, Wrap=True)
panel_9 = Panel(item_5)
merge_6 = Merge(Data1=dist_3, Data2=dist_4)  # -> flatten(Result)
sort = SortList(Keys=merge_6)  # -> Keys, ValuesA
item_6 = ListItem(List=sort.Keys, Index=0, Wrap=True)  # -> flatten(Item)
dom_5 = ConstructDomain(DomainStart=item_6, DomainEnd=0)
remap_3 = RemapNumbers(Value=dist, Source=dom_5, Target=domain_2)  # -> Mapped, Clipped
panel_10 = Panel(remap_3.Mapped)
# why we separated the two ovements of kangaroo?
# coz a man moving in one tube is indeoendent of the other tube
item_7 = ListItem(List=panel_10, Index=0, Wrap=True)
angle1 = Data(item_7)
cluster_4 = Cluster_5(
    B_2=cluster.B_3,
    d1=cluster.b_base_points_lower_2,
    d2=cluster.b_base_points_upper_2,
    A_5=angle1,
    A_2=cluster.A_4,
    d1_2=cluster.a_base_points_upper_2,
    d2_2=cluster.a_base_points_lower_2,
    points=cluster.common_pts_up_3,
    list_157=cluster.a_points_upper_2,
    list_143=cluster.a_points_lower_2,
    data=cluster._3,
    list_69=cluster.common_pts_up_3,
    data_2=cluster._3_2,
    A=cluster._0,
    list_70=cluster.common_pts_down_3,
    list_71=cluster.common_pts_up_3,
    list_75=cluster.common_pts_down_3,
    list_82=cluster.b_points_lower_2,
    list_87=cluster.b_points_upper_2,
    B=cluster._0_2,
    list_94=cluster.common_pts_up_4,
    list_93=cluster.common_pts_down_4,
    list_88=cluster.common_pts_up_4,
    list_100=cluster.common_pts_down_4,
    points_2=cluster.common_pts_down_3,
    list_162=cluster.a_points_upper_2,
    list_104=cluster.a_points_lower_2,
    a2=cluster._1,
    list_76=cluster.common_pts_up_3,
    list_77=cluster.common_pts_down_3,
    list_80=cluster.common_pts_up_3,
    list_85=cluster.common_pts_down_3,
    list_86=cluster.b_points_lower_2,
    list_91=cluster.b_points_upper_2,
    b2=cluster._1_2,
    list_98=cluster.common_pts_up_4,
    list_97=cluster.common_pts_down_4,
    list_101=cluster.common_pts_up_4,
    list_103=cluster.common_pts_down_4,
    list_113=cluster.a_points_upper_2,
    list_108=cluster.a_points_lower_2,
    list_64=cluster.common_pts_up_3,
    list_65=cluster.common_pts_down_3,
    a3=cluster._2,
    list_66=cluster.common_pts_up_3,
    list_67=cluster.common_pts_down_3,
    list_68=cluster.b_points_lower_2,
    list_72=cluster.b_points_upper_2,
    list_81=cluster.common_pts_up_4,
    list_79=cluster.common_pts_down_4,
    b3=cluster._2_2,
    list_89=cluster.common_pts_up_4,
    list_92=cluster.common_pts_down_4,
    list_160=cluster.a_points_upper_2,
    list_159=cluster.a_points_lower_2,
    list_73=cluster.common_pts_up_3,
    list_74=cluster.common_pts_down_3,
    a4=cluster._3,
    list_78=cluster.common_pts_up_3,
    list_83=cluster.common_pts_down_3,
    list_84=cluster.b_points_lower_2,
    list_90=cluster.b_points_upper_2,
    list_96=cluster.common_pts_up_4,
    list_95=cluster.common_pts_down_4,
    b4=cluster._3_2,
    list_99=cluster.common_pts_up_4,
    list_102=cluster.common_pts_down_4,
    list_216=cluster.a_points_upper_2,
    list_48=cluster.a_base_points_upper_2,
    list_140=cluster.common_pts_up_3,
    list_15=cluster.a_points_lower_2,
    list_45=cluster.a_base_points_lower_2,
    list_163=cluster.common_pts_up_4,
    list_7=cluster.b_points_upper_2,
    list_36=cluster.b_base_points_upper_2,
    list_158=cluster.common_pts_down_4,
    list_8=cluster.b_points_lower_2,
    list_27=cluster.b_base_points_lower_2,
    list_161=cluster.common_pts_down_3,
    list_12=cluster.a_points_upper_2,
    list_44=cluster.a_base_points_upper_2,
    list_106=cluster.common_pts_up_3,
    list_10=cluster.a_points_lower_2,
    list_41=cluster.a_base_points_lower_2,
    list_112=cluster.common_pts_up_4,
    list_2=cluster.b_points_upper_2,
    list_17=cluster.b_base_points_upper_2,
    list_109=cluster.common_pts_down_4,
    list_4=cluster.b_points_lower_2,
    list_21=cluster.b_base_points_lower_2,
    list_127=cluster.common_pts_down_3,
    list_11=cluster.a_points_upper_2,
    list_43=cluster.a_base_points_upper_2,
    list_105=cluster.common_pts_up_3,
    list_9=cluster.a_points_lower_2,
    list_40=cluster.a_base_points_lower_2,
    list_110=cluster.common_pts_up_4,
    list=cluster.b_points_upper_2,
    list_16=cluster.b_base_points_upper_2,
    list_107=cluster.common_pts_down_4,
    list_3=cluster.b_points_lower_2,
    list_19=cluster.b_base_points_lower_2,
    list_114=cluster.common_pts_down_3,
    list_14=cluster.a_points_upper_2,
    list_46=cluster.a_base_points_upper_2,
    list_111=cluster.common_pts_up_3,
    list_13=cluster.a_points_lower_2,
    list_42=cluster.a_base_points_lower_2,
    list_142=cluster.common_pts_up_4,
    list_5=cluster.b_points_upper_2,
    list_18=cluster.b_base_points_upper_2,
    list_141=cluster.common_pts_down_4,
    list_6=cluster.b_points_lower_2,
    list_24=cluster.b_base_points_lower_2,
    list_144=cluster.common_pts_down_3,
    list_26=cluster.common_pts_up_4,
    list_20=cluster.common_pts_up_3,
    list_33=cluster.common_pts_down_4,
    list_28=cluster.common_pts_down_3,
    list_29=cluster.common_pts_up_4,
    list_22=cluster.common_pts_up_3,
    list_37=cluster.common_pts_down_4,
    list_31=cluster.common_pts_down_3,
    list_30=cluster.common_pts_up_4,
    list_23=cluster.common_pts_up_3,
    list_38=cluster.common_pts_down_4,
    list_32=cluster.common_pts_down_3,
    list_34=cluster.common_pts_up_4,
    list_25=cluster.common_pts_up_3,
    list_39=cluster.common_pts_down_4,
    list_35=cluster.common_pts_down_3)  # -> list_229, P, V, list_215, R, R_2

# ---- group: one piece kangaroo
same_as_kangaroo_solver = CSharpScript(x=cluster_4.R, Reference="F:\Program files\grasshopper\Plug-ins\Grasshopper\Components\KangarooSolver.dll")  # -> out, A, B; inputs x: list; same code as same_as_kangaroo_solver
data_7 = Data(same_as_kangaroo_solver.A)
panel_11 = Panel(same_as_kangaroo_solver.B)

# ----
data_8 = Data(cluster_4.V)

solver = Solver(GoalObjects=flatten(cluster_4.R), Reset=Button(), Threshold=1e-15, Tolerance=0.01, On=Toggle(True))  # -> I, V, O
data_9 = Data(solver.O)
clean = CleanTree(RemoveNulls=True, RemoveInvalid=True, RemoveEmpty=False, Tree=solver.O)
vertices = Data(solver.V)
sort_2 = SortList(Keys=vertices)  # -> Keys, ValuesA
data_10 = Data(clean)
debrep = DeconstructBrep(Brep=data_10)  # -> Faces, Edges, flatten(Vertices)
kangaroo_units = Data(solver.O)

area = Area(Geometry=cluster_4.list_215)  # -> Area, Centroid
area_2 = Area(Geometry=cluster_4.list_229)  # -> Area, Centroid
ln = Line(StartPoint=area_2.Centroid, EndPoint=area.Centroid)
midpt = CurveMiddle(Curve=ln)

dup = DuplicateData(Data=cluster_4.R_2, Number=6, Order=True)
lng = ListLength(List=cluster_4.R_2)
partition_2 = PartitionList(List=dup, Size=lng)  # -> simplify(Chunks)
rotate = Rotate(Geometry=cluster_4.V, Angle=graft(degrees(remap_3.Mapped)), Plane=cluster_4.P)  # -> Geometry, Transform
anchor = Anchor(Point=cluster_4.V, Target=rotate.Geometry, Strength=10000)  # -> simplify(A)
panel_12 = Panel(cluster_4.R_2)
merge_7 = Merge(Data1=anchor, Data2=partition_2)

# ---- group: obs-indivual c# modules
cluster_5 = Cluster_4(Panel=merge_7, D=merge_7)

# ----
xy_2 = XYPlane(Origin=midpt)

customiteration_2 = CSharpScript(
    x=simplify(merge_7),
    timer=Slider(0.392, range=0.001..0.5),
    Reference="F:\Program files\grasshopper\Plug-ins\Grasshopper\Components\KangarooSolver.dll")  # -> out, A; inputs x: tree, timer: Double
# ---------- customiteration_2: C# ----------
    List<KangarooSolver.PhysicalSystem> PS = new List<KangarooSolver.PhysicalSystem>();
    for(int d = 0; d < x.BranchCount; d++)
    {

      var PSx = new KangarooSolver.PhysicalSystem();
      PS.Add(PSx);

    }
    DataTree<object> outputTree = new DataTree<object>();
    for(int i = 0; i < x.BranchCount; i++)
    {
      double tol = 0.00001; // points closer than this will get combined into a single particle
      var GoalList = new List<IGoal>();


      List<IGoal> Gs = new List<IGoal>();
      for(int j = 0; j < x.Branch(i).Count; j++)
        Gs.Add((IGoal) x.Branch(i)[j]);


      foreach(IGoal G in Gs)
      {
        //IGoal G = x.Branch(i)[j];
        //define var to absorb the iterated lists of results
        PS[i].AssignPIndex(G, tol);
        GoalList.Add(G);

      }
      #region oldIgoal
      //Assign indexes to the particles in each Goal:
      /*

      foreach(IGoal G in x)
      {
      PS.AssignPIndex(G, tol);
      GoalList.Add(G);
      }
      */
      #endregion
      int counter = 0;
      double threshold = 1e-15;
      do
      {
        PS[i].Step(GoalList, true, timer); // The step will iterate until either reaching 0.1s or the energy threshold
        counter++;
      }while(PS[i].GetvSum() > threshold && counter < 100); //GetvSum returns the current kinetic energy
      // always include a counter to prevent it getting stuck forever in case it cannot reach the given threshold
      //var A = PS.GetOutput(GoalList);
      foreach(object geo in PS[i].GetOutput(GoalList))
        outputTree.Add(geo, x.Paths[i]);

      //ATot.Add(A);
      //ATot = PS.GetOutput(GoalList);
      //B = counter;

    }
    A = outputTree;
# ---------- end customiteration_2 ----------
customiteration_3 = CSharpScript(x=simplify(merge_7), Reference="F:\Program files\grasshopper\Plug-ins\Grasshopper\Components\KangarooSolver.dll")  # -> out, A; inputs x: tree; disabled
# ---------- customiteration_3: C# ----------
    DataTree<object> outputTree = new DataTree<object>();
    for(int i = 0; i < x.BranchCount; i++)
    {
      var PS = new KangarooSolver.PhysicalSystem();
      double tol = 0.0001; // points closer than this will get combined into a single particle
      var GoalList = new List<IGoal>();


      List<IGoal> Gs = new List<IGoal>();
      for(int j = 0; j < x.Branch(i).Count; j++)
        Gs.Add((IGoal) x.Branch(i)[j]);


      foreach(IGoal G in Gs)
      {
        //IGoal G = x.Branch(i)[j];
        //define var to absorb the iterated lists of results
        PS.AssignPIndex(G, tol);
        GoalList.Add(G);

      }
      #region oldIgoal
      //Assign indexes to the particles in each Goal:
      /*

      foreach(IGoal G in x)
      {
      PS.AssignPIndex(G, tol);
      GoalList.Add(G);
      }
      */
      #endregion
      int counter = 0;
      double threshold = 1e-15;
      do
      {
        PS.Step(GoalList, true, 0.1); // The step will iterate until either reaching 0.1s or the energy threshold
        counter++;
      }while(PS.GetvSum() > threshold && counter < 100); //GetvSum returns the current kinetic energy
      // always include a counter to prevent it getting stuck forever in case it cannot reach the given threshold
      //var A = PS.GetOutput(GoalList);
      foreach(object geo in PS.GetOutput(GoalList))
        outputTree.Add(geo, x.Paths[i]);

      //ATot.Add(A);
      //ATot = PS.GetOutput(GoalList);
      //B = counter;

    }
    A = outputTree;
# ---------- end customiteration_3 ----------

centroid = Data(xy_2)
clean_2 = CleanTree(RemoveNulls=True, RemoveInvalid=True, RemoveEmpty=False, Tree=customiteration_2.A)
replacement_units = Data(clean_2)
mjoin_2 = MeshJoin(Meshes=replacement_units)  # -> flatten(Mesh)
join_2 = BrepJoin(Breps=replacement_units)  # -> Breps, Closed
lng_2 = ListLength(List=mjoin_2)
remap_4 = RemapNumbers(Value=dist_2, Source=dom_5, Target=domain_2)  # -> Mapped, Clipped
rotate_2 = Rotate(Geometry=cluster_4.V, Angle=graft(degrees(remap_4.Mapped)), Plane=cluster_4.P)  # -> Geometry, Transform
anchor_2 = Anchor(Point=cluster_4.V, Target=rotate_2.Geometry, Strength=10000)  # -> simplify(A)
merge_8 = Merge(Data1=anchor_2, Data2=partition_2)
customiteration_4 = CSharpScript(
    x=simplify(merge_8),
    timer=Slider(0.392, range=0.001..0.5),
    Reference="F:\Program files\grasshopper\Plug-ins\Grasshopper\Components\KangarooSolver.dll")  # -> out, A; inputs x: tree, timer: Double; same code as customiteration_2
customiteration_5 = CSharpScript(x=simplify(merge_8), Reference="F:\Program files\grasshopper\Plug-ins\Grasshopper\Components\KangarooSolver.dll")  # -> out, A; inputs x: tree; disabled; same code as customiteration_3
clean_3 = CleanTree(RemoveNulls=True, RemoveInvalid=True, RemoveEmpty=False, Tree=customiteration_4.A)
replacement_units_2 = Data(clean_3)
mjoin_3 = MeshJoin(Meshes=replacement_units_2)  # -> flatten(Mesh)
merge_9 = Merge(Data1=mjoin_2, Data2=mjoin_3)
combine = CombineData(Input0=mjoin_2, Input1=mjoin_3)  # -> Result, Index
partition_3 = PartitionList(List=merge_9, Size=lng_2)
split = SplitList(List=merge_9, Index=lng_2)  # -> ListA, ListB
# Adjust the first point to indicate
# the entrance to the pavilion from both sides
panel_13 = Panel(split.ListA)
# TRY TO ADJUST A PATTERN IN WHICH U CAN SEE AM OBVIOUS DIFFERENCE BETWEEN THE DIFFERENT KANGAROO PARTS
smaller = SmallerThan(FirstNumber=item_5, SecondNumber=item_6)  # -> SmallerThan, OrEqualTo
smaller_2 = SmallerThan(FirstNumber=item_4, SecondNumber=item_6)  # -> SmallerThan, OrEqualTo
kangaroo_plane_centroid = Data(centroid)
kangaroo_units_2 = Data(merge_9)

orient = Orient(Geometry=shape, Source=boxprop.Center, Target=cull_i)  # -> Geometry, Transform
python = GhPythonScript(uVal=divide_2.Parameters, geometry=orient.Geometry)  # -> out, a, simplify(b); inputs uVal: list, geometry: list; disabled
# ---------- python: Python ----------
__author__ = "NS"
__version__ = "2020.01.07"

import rhinoscriptsyntax as rs
import Rhino.Geometry as rg

def recFun(geometry,i,j, uVal):
        print ("recursive number", j)
#        if uVal[i] > uVal[len(uVal)-1]:
#            return j
        if uVal[j] >= uVal[len(uVal)-1]:
            return j


#        if i >= (len(uVal)-1):
#            return i
#        if j >= (len(uVal)-1):
#            return j
#        print(rg.Intersect.Intersection.BrepBrep(rs.coercebrep((geometry[i]),False),rs.coercebrep((geometry[j]),False),0.00001))
        if (rg.Intersect.Intersection.MeshMeshAccurate(rs.coercemesh((geometry[i]),False),rs.coercemesh((geometry[j]),False),0.00001)) is None:
#        if (rg.Intersect.Intersection.BrepBrep(rs.coercebrep(geometry[i]),rs.coercebrep(geometry[j]),0.001)) == None:
  #      if(rg.Intersect.Intersection.MeshMeshAccurate(rs.coercemesh((geometry[i]),False),rs.coercemesh((geometry[j]),False),0.00001)) is None:
#        if (rg.Intersect.Intersection.MeshMeshAccurate(rs.coercemesh((geometry[i]),False),rs.coercemesh((geometry[j]),False),0)) is None :
  #          print(rg.Intersect.Intersection.BrepBrep(rs.coercebrep(geometry[i]),rs.coercebrep(geometry[j]),0.001))
      #      print(rg.Intersect.Intersection.MeshMeshAccurate(rs.coercemesh((geometry[i]),False),rs.coercemesh((geometry[j]),False),0.00001))
            print ("finished in i = ", i, "j = ", j)
            return j
        else:
            j = j+1
            print("new recursive in i = ", i, "j = ", j)
            recFun(geometry,i,j, uVal)
        return j

i = 0
newList = []
newList2 = []
newList.append(uVal[0])
newList2.append(0)
j = i + 1

while uVal[i] < uVal[len(uVal)-1]:
#for x in range(len(uVal)):
#    print ("x =", x)
    if i > (len(uVal)):
        break
       
    
#    if i is None:
#        continue
#    if i == len(uVal)
    else:
#        print("i2",i)
        inew = recFun(geometry,i,j,uVal)
        newList.append(uVal[inew])
        newList2.append(inew)
        print("newlist length = ",len(newList))
        i = inew
        j = i+1
#        print("j = ",j)
        print("i new =",i)
    
    
        
#newList.append(uVal[len(uVal)])
a = newList
b = newList2
# ---------- end python ----------

orient_2 = Orient(Geometry=partition_3, Source=kangaroo_plane_centroid, Target=item_3)  # -> Geometry, Transform
python_2 = GhPythonScript(uVal=divide_2.Parameters, geometry=orient.Geometry)  # -> out, simplify(a), simplify(b); inputs uVal: list, geometry: list; disabled; same code as python

item_8 = ListItem(List=orient.Geometry, Index=python.b, Wrap=True)  # disabled

# ---- group: Scaling
# Manual Insertion !!
ins = InsertItems(List=simplify(orient.Geometry), Item=simplify(orient_2.Geometry), Indices=item_2, Wrap=True)
lng_3 = ListLength(List=ins)
eval_8 = Evaluate(F="(360/(x-1))*y", x=lng_3, y=Slider(2, range=1..6))
series_4 = Series(Start=0, Step=eval_8, Count=lng_3)
rad_2 = Radians(Degrees=series_4)
rad_3 = Radians(Degrees=Slider(90, range=0..360))
dom_6 = ConstructDomain(DomainStart=Slider(0.8, range=0..5), DomainEnd=Slider(1.1, range=0..10))
expression = Expression(x=rad_2, t=rad_3, Expression="sin(x + t)")
bnd_2 = Bounds(Numbers=expression)
remap_5 = RemapNumbers(Value=expression, Source=bnd_2, Target=dom_6)  # -> Mapped, Clipped
scale_2 = Scale(Geometry=ins, Center=divide_2.Points, Factor=remap_5.Mapped)  # -> Geometry, Transform

# ----
eval_9 = EvaluateCurve(Curve=reparameterize(elevated_curves), Parameter=python_2.a)  # -> Point, Tangent, Angle; disabled

# ----
# Scaling
units_count = Data(number_slider_14)  # disabled
final_units = Data(item_8)  # disabled
center_points = Data(eval_9.Point)  # disabled
series_5 = Series(Start=0, Step=1, Count=units_count)  # disabled
graph_4 = GraphMapper(
    series_5,
    x0=0,
    x1=80,
    y0=1,
    y1=2,
    container_name="Sine Summation",
    Equation0_px=[0, 0.4729287028],
    Equation0_py=[0.005372285843, 0],
    Equation1_px=[0.2388579845, 0.4986519217],
    Equation1_py=[0, 0.7630844116])  # disabled

item_9 = ListItem(List=ins, Index=Slider(33, range=0..86), Wrap=True)
panel_14 = Panel(eval_8)
index = ItemIndex(List=series_4, Item=series_4)
panel_15 = Panel(index)
graph_5 = GraphMapper(
    series_5,
    x0=0,
    x1=160,
    y0=1,
    y1=2,
    container_name="Sine Summation",
    Equation0_px=[0, 0.3461497724],
    Equation0_py=[0, 0],
    Equation1_px=[0.4384406507, 1],
    Equation1_py=[0, 0.4699049592])  # disabled
graph_6 = GraphMapper(index, x0=0, x1=80, y0=0, y1=90, container_name="Gaussian", factor=0.2202499509, mean=0.5063971877, sdev=0.1119650006)
graph_7 = GraphMapper(index, x0=0, x1=80, y0=0, y1=90, container_name="Gaussian", factor=0.3649243712, mean=0.5954784155, sdev=0.2644962668)
panel_17 = Panel(remap_5.Mapped)

# ----
# Rotation
brep = Brep(scale_2.Geometry)  # disabled
number_slider_15 = Slider(10, range=0..100)  # disabled
debrep_2 = DeconstructBrep(Brep=brep)  # -> Faces, Edges, Vertices; disabled
md_slider = MDSlider(SliderMode=0, slider_value=Point(0.5, 0.5, 0.5), x_domain=Domain(0, 1), y_domain=Domain(0, 1), z_domain=Domain(0, 1))  # disabled
item_10 = ListItem(List=debrep_2.Faces, Index=number_slider_15, Wrap=True)  # disabled
area_3 = Area(Geometry=final_units, UseTasks=False)  # -> Area, Centroid; disabled
evalsrf = EvaluateSurface(Surface=item_10, Point=md_slider)  # -> Point, flatten(Normal), UDirection, VDirection, Frame; disabled
lng_4 = ListLength(List=evalsrf.Normal)  # disabled
eval_10 = Evaluate(F="x / 2", x=lng_4)  # disabled
graph_8 = GraphMapper(series_5, x0=0, x1=80, y0=0, y1=90, container_name="Gaussian", factor=0.3649243712, mean=0.5954784155, sdev=0.2644962668)  # disabled
partition_4 = PartitionList(List=evalsrf.Normal, Size=eval_10)  # disabled
rad_4 = Radians(Degrees=graph_8)  # disabled
pl = PlaneNormal(Origin=area_3.Centroid, ZAxis=partition_4)  # disabled
rotate_3 = Rotate(Geometry=scale_2.Geometry, Angle=rad_4, Plane=pl)  # -> Geometry, Transform; disabled

panel_18 = Panel(graph_6)
rad_5 = Radians(Degrees=graph_6)

# ---- group: Scaling
# Manual Insertion !!
ins_2 = InsertItems(List=simplify(orient.Geometry), Item=simplify(orient_2.Geometry), Indices=item_2, Wrap=True)
number_slider_16 = Slider(2, range=1..6)
lng_5 = ListLength(List=ins_2)
eval_11 = Evaluate(F="(360*amplifier/(num_units-1))", num_units=lng_5, amplifier=Slider(1, range=1..6))
series_6 = Series(Start=0, Step=eval_11, Count=lng_5)
rad_6 = Radians(Degrees=series_6)
rotate_4 = Rotate(Geometry=scale_2.Geometry, Angle=rad_5, Plane=pl_origin)  # -> Geometry, Transform

# ----
panel_19 = Panel(eval_11)
panel_20 = Panel(rad_6)
rotate_5 = Rotate(Geometry=scale_2.Geometry, Angle=rad_4, Plane=pl)  # -> Geometry, Transform; disabled
meshcp_2 = MeshClosestPoint(Point=divide_2.Points, Mesh=rotate_4.Geometry)  # -> Point, Index, Parameter
dist_5 = Distance(PointA=centre_point, PointB=meshcp_2.Point)
cir_2 = Circle(Plane=pl_origin, Radius=dist_5)
fitloft = FitLoft(Curves=cir_2, CountU=15, DegreeU=5, DegreeV=5)

# ----
# Height Adjustment
number_slider_17 = Slider(0.713, range=0..2)  # disabled
Z_3 = UnitZ(Factor=number_slider_17)  # disabled
move_4 = Move(Geometry=rotate_3.Geometry, Motion=Z_3)  # -> Geometry, Transform; disabled

# ==== cluster Cluster_2
x = ClusterInput()
x_2 = ClusterInput()
A = ClusterInput()
B = ClusterInput()

eval = Evaluate(F="x*2", x=x)
eval_2 = Evaluate(F="x*2", x=x_2)
multiplication = Multiplication(A=A, B=B)

R = ClusterInput()
S = ClusterInput()
R_2 = ClusterInput()
x_3 = ClusterInput()

# ----
# Inner base
polygon = Polygon(Plane=PlaneXY(0, 0, 0), Radius=R, Segments=S, FilletRadius=0)  # -> Polygon, Length
cir = Circle(Plane=PlaneXY(0, 0, 0), Radius=R_2)
explode = Explode(Curve=polygon.Polygon, Recursive=True)  # -> Segments, Vertices
item = ListItem(List=explode.Segments, Index=0, Wrap=True)

# ----
# Hole placement of outer
cir_2 = Circle(Plane=PlaneXY(0, 0, 0), Radius=multiplication)
polygon_2 = Polygon(Plane=PlaneXY(0, 0, 0), Radius=multiplication, Segments=eval, FilletRadius=0)  # -> Polygon, Length
explode_2 = Explode(Curve=polygon_2.Polygon, Recursive=True)  # -> Segments, Vertices
item_2 = ListItem(List=explode_2.Segments, Index=0, Wrap=True)

D = ClusterInput()

# ----
# Center of moving Circle
polygon_3 = Polygon(Plane=PlaneXY(0, 0, 0), Radius=eval_2, Segments=eval, FilletRadius=0)  # -> Polygon, Length
cir_3 = Circle(Plane=PlaneXY(0, 0, 0), Radius=eval_2)
explode_3 = Explode(Curve=polygon_3.Polygon, Recursive=True)  # -> Segments, Vertices
area = Area(Geometry=polygon_3.Polygon)  # -> Area, Centroid

area_2 = Area(Geometry=polygon.Polygon)  # -> Area, Centroid
area_3 = Area(Geometry=polygon_2.Polygon)  # -> Area, Centroid

# ----
# Adjust length of smaller circle (equal length)
len = Length(Curve=item_2)
len_2 = Length(Curve=item)
subtraction = Subtraction(A=len_2, B=len)
abs = Absolute(Value=subtraction)
# Depth adopted
panel = Panel(abs)
galapagos = Galapagos(fitness=abs)

# ----
# Insert Plane
number_slider = Slider(22.5, range=0..100)
rotate = Rotate(Geometry=explode_2.Vertices, Angle=degrees(number_slider), Plane=area_3.Centroid)  # -> Geometry, Transform
rotate_2 = Rotate(Geometry=explode_2.Segments, Angle=degrees(number_slider), Plane=area_3.Centroid)  # -> Geometry, Transform

l0 = ClusterInput()
l1 = ClusterInput()
l0_2 = ClusterInput()
l1_2 = ClusterInput()
duppt = RemoveDuplicatePts(Points=explode_3.Vertices, Tolerance=0.01)

# ----
# Insert Plane
rotate_3 = Rotate(Geometry=explode_3.Segments, Angle=degrees(number_slider), Plane=area.Centroid)  # -> Geometry, Transform
rotate_4 = Rotate(Geometry=explode_3.Vertices, Angle=degrees(number_slider), Plane=area.Centroid)  # -> Geometry, Transform

# ----
# Insert Plane
rotate_5 = Rotate(Geometry=explode.Vertices, Angle=degrees(number_slider), Plane=area_2.Centroid)  # -> Geometry, Transform
rotate_6 = Rotate(Geometry=explode.Segments, Angle=degrees(number_slider), Plane=area_2.Centroid)  # -> Geometry, Transform

A_2 = ClusterInput()

# ----
# The Octagon Wings (unmodified)
# Insert Plane
neg = Negative(Value=x_3)
offset = OffsetCurve(Curve=rotate_3.Geometry, Distance=D, Plane=PlaneXY(0, 0, 0), Corners=1)
offset_2 = OffsetCurve(Curve=rotate_3.Geometry, Distance=neg, Plane=PlaneXY(0, 0, 0), Corners=1)
md_slider = MDSlider(SliderMode=0, slider_value=Point(0.5, 0.5, 0.5), x_domain=Domain(0, 1), y_domain=Domain(0, 1), z_domain=Domain(0, 1))
ext = ExtendCurve(Curve=offset, Type=0, Start=l0, End=l1)
ext_2 = ExtendCurve(Curve=offset_2, Type=0, Start=l0_2, End=l1_2)
loft = Loft(Curves=[ext, ext_2], Options={Adjust=False, Closed=False, LoftEnds=0, LoftSimp=0, LoftType=0, Rebuild=10, Refit=0.01})
evalsrf = EvaluateSurface(Surface=loft, Point=md_slider)  # -> Point, Normal, UDirection, VDirection, Frame
amp = Amplitude(Vector=evalsrf.Normal, Amplitude=A_2)
neg_2 = Negative(Value=amp)
multiplication_2 = Multiplication(A=amp, B=Slider(2, range=0..10))
extr = Extrude(Base=loft, Direction=amp)
move = Move(Geometry=extr, Motion=multiplication_2)  # -> simplify(flatten(Geometry)), Transform

duppt_2 = RemoveDuplicatePts(Points=rotate_5.Geometry, Tolerance=0.01)
duppt_3 = RemoveDuplicatePts(Points=rotate_4.Geometry, Tolerance=0.01)
duppt_4 = RemoveDuplicatePts(Points=rotate.Geometry, Tolerance=0.01)

item_3 = ListItem(List=flatten(neg_2), Index=0, Wrap=True)
expression = Expression(x=item_3, Expression="x * 2")

height_of_ring = Slider(0.017, range=0..0.5)
size_of_screws = Slider(0.005, range=0..0.03)
panel_2 = Panel(item_3)
panel_3 = Panel(expression)
size_of_screws_2 = Slider(0.005, range=0..0.03)

vertices = Data(explode.Vertices)
duppt_5 = RemoveDuplicatePts(Points=vertices, Tolerance=0.01)

depth_adopted = Data(item_3)
inner_vertices = Data(duppt_5)
outer_vertices = Data(duppt)

h3 = ClusterInput()
h2 = Data(height_of_ring)
h3_2 = Data(h3)

half_width_of_ring = Slider(0.02, range=0.01..0.1)
base_circle = Data(cir)
neg_3 = Negative(Value=half_width_of_ring)
offset_3 = OffsetCurve(Curve=base_circle, Distance=neg_3, Plane=PlaneXY(0, 0, 0), Corners=1)
offset_4 = OffsetCurve(Curve=base_circle, Distance=half_width_of_ring, Plane=PlaneXY(0, 0, 0), Corners=1)
loft_2 = Loft(
    Curves=[offset_4, offset_3],
    Options={Adjust=False, Closed=False, LoftEnds=0, LoftSimp=0, LoftType=0, Rebuild=10, Refit=0.01})

md_slider_2 = MDSlider(SliderMode=0, slider_value=Point(0.5, 0.5, 0.5), x_domain=Domain(0, 1), y_domain=Domain(0, 1), z_domain=Domain(0, 1))
evalsrf_2 = EvaluateSurface(Surface=loft_2, Point=md_slider_2)  # -> Point, Normal, UDirection, VDirection, Frame
amp_2 = Amplitude(Vector=evalsrf_2.Normal, Amplitude=height_of_ring)
extr_2 = Extrude(Base=loft_2, Direction=amp_2)

cluster = Cluster(G=extr_2, A=amp_2)

# ----
# Part1-Tool
subtraction_2 = Subtraction(A=half_width_of_ring, B=size_of_screws)
panel_4 = Panel(subtraction_2)
circle = CircleCNR(Center=duppt_5, Normal=evalsrf_2.Normal, Radius=subtraction_2)
boundary = BoundarySurfaces(Edges=circle)
extr_3 = Extrude(Base=boundary, Direction=amp_2)
move_2 = Move(Geometry=duppt_5, Motion=amp_2)  # -> Geometry, Transform

# ----
# Depth for connection
panel_5 = Panel("""0
1""")
expression_2 = Expression(x=depth_adopted, Expression="x / 2")
dispatch = Dispatch(List=outer_vertices, DispatchPattern=panel_5)  # -> ListA, ListB
inner_vertices_2 = Data(simplify(graft(inner_vertices)))
move_3 = Move(Geometry=inner_vertices, Motion=expression_2)  # -> simplify(graft(Geometry)), Transform
move_4 = Move(Geometry=dispatch.ListB, Motion=depth_adopted)  # -> simplify(graft(Geometry)), Transform
move_5 = Move(Geometry=dispatch.ListB, Motion=expression_2)  # -> simplify(graft(Geometry)), Transform
merge = Merge(Data1=inner_vertices_2, Data2=move_3.Geometry, Data3=move_5.Geometry, Data4=move_4.Geometry)
pline = PolyLine(Vertices=merge, Closed=False)
pipe = Pipe(Curve=pline, Radius=subtraction_2, Caps=0)  # -> simplify(Pipe)

bbox = BoundingBox(Content=pipe, Plane=PlaneXY(0, 0, 0))  # -> flatten(Box), Box_2
list = ItemSelector(bbox.Box, {"Box", "Box", "Box", "Box"}, selected="Box")
debox = DeconstructBox(Box=list)  # -> Plane, X, Y, Z
dedomain = DeconstructDomain(Domain=debox.Z)  # -> Start, End
h1 = Data(dedomain.End)

eval_3 = Evaluate(F="2*(x+y+z)", x=h1, y=h2, z=h3_2)
part1 = Data(extr_3)
half_width_of_ring_2 = ClusterOutput(half_width_of_ring)
C = ClusterOutput(offset_3)
Z = UnitZ(Factor=1)
data = Data(extr_3)
neg_4 = Negative(Value=Z)
move_a = Move(Geometry=duppt_5, Motion=neg_4)  # -> Geometry, Transform
move_a_2 = Move(Geometry=move_2.Geometry, Motion=neg_4)  # -> Geometry, Transform

# ----
# Base1(ring)
trim = TrimSolid()
a_base_points_upper = Data(duppt_5)
a_base_points_lower = Data(move_2.Geometry)
a_points_upper = Data(move_a.Geometry)
a_points_lower = Data(move_a_2.Geometry)

a_base_points_upper_2 = ClusterOutput(a_base_points_upper)
a_base_points_lower_2 = ClusterOutput(a_base_points_lower)
a_points_upper_2 = ClusterOutput(a_points_upper)
a_points_lower_2 = ClusterOutput(a_points_lower)

# ----
# Screw combining them together
panel_6 = Panel("""0
1""")
dispatch_2 = Dispatch(List=flatten(extr), DispatchPattern=panel_6)  # -> ListA, ListB
item_4 = ListItem(List=flatten(neg_2), Index=0, Wrap=True)
level_2_bars = Data(graft(dispatch_2.ListB))
center_pts_up = Data(duppt_4)
subtraction_3 = Subtraction(A=half_width_of_ring, B=size_of_screws_2)
panel_7 = Panel(subtraction_3)
circle_2 = CircleCNR(Center=center_pts_up, Normal=item_3, Radius=subtraction_3)
move_6 = Move(Geometry=simplify(center_pts_up), Motion=simplify(flatten(amp)))  # -> Geometry, Transform
boundary_2 = BoundarySurfaces(Edges=circle_2)
level_1_bars = Data(dispatch_2.ListA)
extr_4 = Extrude(Base=boundary_2, Direction=flatten(amp))
center_pts_down = Data(move_6.Geometry)
move_7 = Move(Geometry=level_2_bars, Motion=item_4)  # -> Geometry, Transform
trim_2 = TrimSolid(Shape=graft(level_1_bars), Cutters=flatten(extr_4))
partition = PartitionList(List=extr_4, Size="2")  # -> simplify(Chunks)
merge_2 = Merge(Data1=simplify(move_7.Geometry), Data2=partition)
sunion = SolidUnion(Breps=merge_2)  # -> flatten(Result)

sdiff = SolidDifference(BrepsA=graft(level_1_bars), BrepsB=flatten(extr_4))

center_pts_up_2 = Data(center_pts_up)
center_pts_down_2 = Data(move_6.Geometry)
move_8 = Move(Geometry=center_pts_up_2, Motion=expression)  # -> Geometry, Transform
move_9 = Move(Geometry=center_pts_down_2, Motion=expression)  # -> Geometry, Transform

data_2 = Data(flatten(sdiff))

moved_upper = Move(Geometry=sunion, Motion=expression)  # -> Geometry, Transform
moved_low = Move(Geometry=data_2, Motion=expression)  # -> Geometry, Transform

# ----
# Lower Full Bars (with connections)
trim_3 = TrimTree(Tree=part1, Depth=2)  # -> graft(Tree)
moved_low_2 = Data(moved_low.Geometry)
merge_3 = Merge(Data1=simplify(trim_3), Data2=simplify(pipe))
shift = ShiftList(List=moved_low_2, Shift=-1, Wrap=True)  # -> simplify(graft(List))
sunion_2 = SolidUnion(Breps=merge_3)
merge_4 = Merge(Data1=sunion_2, Data2=shift)
sunion_3 = SolidUnion(Breps=merge_4)

# ----
# Mirror
debrep = DeconstructBrep(Brep=moved_low.Geometry)  # -> Faces, Edges, Vertices
md_slider_3 = MDSlider(SliderMode=0, slider_value=Point(0.5, 0.5, 0.5), x_domain=Domain(0, 1), y_domain=Domain(0, 1), z_domain=Domain(0, 1))
item_5 = ListItem(List=flatten(debrep.Faces), Index=0, Wrap=True)
evalsrf_3 = EvaluateSurface(Surface=item_5, Point=md_slider_3)  # -> Point, Normal, UDirection, VDirection, Frame
data_3 = Data(item_5)
mirror = Mirror(Geometry=sunion_2, Plane=evalsrf_3.Point)  # -> Geometry, Transform

# ----
# Upper Full Bars (with connections)
movetoplane = MoveToPlane(Geometry=area_2.Centroid, Plane=evalsrf_3.Point, Above=True, Below=True)  # -> Geometry, Transform
moved_upper_2 = Data(simplify(graft(moved_upper.Geometry)))
rotate_7 = Rotate(Geometry=mirror.Geometry, Angle=degrees("45"), Plane=movetoplane.Geometry)  # -> Geometry, Transform
merge_5 = Merge(Data1=rotate_7.Geometry, Data2=moved_upper_2)
sunion_4 = SolidUnion(Breps=merge_5)

sdiff_2 = SolidDifference(BrepsA=extr_2, BrepsB=[extr_4, extr_3])

# ----
# Upper ring and points
mir_pts_up = Mirror(Geometry=a_base_points_lower, Plane=evalsrf_3.Point)  # -> Geometry, Transform
mirror_2 = Mirror(Geometry=sdiff_2, Plane=evalsrf_3.Point)  # -> Geometry, Transform
mir_pts_low = Mirror(Geometry=a_base_points_upper, Plane=evalsrf_3.Point)  # -> Geometry, Transform
rotate_8 = Rotate(Geometry=mirror_2.Geometry, Angle=degrees("45"), Plane=movetoplane.Geometry)  # -> Geometry, Transform
rotate_9 = Rotate(Geometry=mir_pts_low.Geometry, Angle=degrees("45"), Plane=movetoplane.Geometry)  # -> Geometry, Transform
rotate_10 = Rotate(Geometry=mir_pts_up.Geometry, Angle=degrees("45"), Plane=movetoplane.Geometry)  # -> Geometry, Transform

move_b = Move(Geometry=move_8.Geometry, Motion=Z)  # -> Geometry, Transform
move_b_2 = Move(Geometry=move_9.Geometry, Motion=Z)  # -> Geometry, Transform
move_a_3 = Move(Geometry=move_9.Geometry, Motion=neg_4)  # -> Geometry, Transform
move_b_3 = Move(Geometry=rotate_9.Geometry, Motion=Z)  # -> Geometry, Transform
move_b_4 = Move(Geometry=rotate_10.Geometry, Motion=Z)  # -> Geometry, Transform
move_a_4 = Move(Geometry=sunion_3, Motion=neg_4)  # -> Geometry, Transform
move_b_5 = Move(Geometry=sunion_4, Motion=Z)  # -> Geometry, Transform
move_a_5 = Move(Geometry=move_8.Geometry, Motion=neg_4)  # -> Geometry, Transform

# ----
# Base2(ring) (up)
B_2 = Data(rotate_8.Geometry)
b_base_points_lower = Data(rotate_9.Geometry)
b_base_points_upper = Data(rotate_10.Geometry)
b_points_lower = Data(move_b_3.Geometry)
b_points_upper = Data(move_b_4.Geometry)

# ----
# A common
common_pts_down = Data(move_a_3.Geometry)
common_pts_up = Data(move_a_5.Geometry)

# ----
# Final Output
lower_bars_a = Data(move_a_4.Geometry)
upper_bars_b = Data(move_b_5.Geometry)

# ----
# B common
common_pts_down_2 = Data(move_b_2.Geometry)
common_pts_up_2 = Data(move_b.Geometry)

B_3 = ClusterOutput(B_2)
A_3 = Data(sdiff_2)
A_4 = ClusterOutput(A_3)
common_pts_up_3 = ClusterOutput(common_pts_up)
common_pts_down_3 = ClusterOutput(common_pts_down)
bang = ExplodeTree(Data=lower_bars_a)  # -> Branch0, Branch1, Branch2, Branch3
common_pts_up_4 = ClusterOutput(common_pts_up_2)
bang_2 = ExplodeTree(Data=upper_bars_b)  # -> Branch0, Branch1, Branch2, Branch3
common_pts_down_4 = ClusterOutput(common_pts_down_2)
b_base_points_lower_2 = ClusterOutput(b_base_points_lower)
b_points_lower_2 = ClusterOutput(b_points_lower)
b_base_points_upper_2 = ClusterOutput(b_base_points_upper)
b_points_upper_2 = ClusterOutput(b_points_upper)
_0 = ClusterOutput(bang.Branch0)
_1 = ClusterOutput(bang.Branch1)
_2 = ClusterOutput(bang.Branch2)
_3 = ClusterOutput(bang.Branch3)
_0_2 = ClusterOutput(bang_2.Branch0)
_1_2 = ClusterOutput(bang_2.Branch1)
_2_2 = ClusterOutput(bang_2.Branch2)
_3_2 = ClusterOutput(bang_2.Branch3)

# ==== cluster Cluster_3
E = ClusterInput()

Z = UnitZ(Factor=1)
boundary = BoundarySurfaces(Edges=E)
rev = Reverse(Vector=Z)
amp = Amplitude(Vector=rev, Amplitude=Slider(0.2, range=0..1))
extr = Extrude(Base=boundary, Direction=amp)

# ==== cluster Cluster_4
D = ClusterInput()
bang = ExplodeTree(Data=D)  # -> Branch0, Branch1, Branch2, Branch3, Branch4, Branch5; disabled
panel = Panel(ClusterInput())  # disabled

# ----
# 29 mm - a
# 19.002 - b
same_as_kangaroo_solver = CSharpScript(x=bang.Branch0, Reference="F:\Program files\grasshopper\Plug-ins\Grasshopper\Components\KangarooSolver.dll")  # -> out, A, B; inputs x: list; disabled
# ---------- same_as_kangaroo_solver: C# usings ----------
using System.IO;
using System.Linq;
using System.Data;
using System.Drawing;
using System.Reflection;
using System.Windows.Forms;
using System.Xml;
using System.Xml.Linq;
using System.Runtime.InteropServices;

using Rhino.DocObjects;
using Rhino.Collections;
using GH_IO;
using GH_IO.Serialization;
using KPlankton;
using KangarooSolver;
using KangarooSolver.Goals;
# ---------- same_as_kangaroo_solver: C# ----------
    var PS = new KangarooSolver.PhysicalSystem();
    double tol = 0.0001; // points closer than this will get combined into a single particle
    var GoalList = new List<IGoal>();

    //Assign indexes to the particles in each Goal:
    foreach(IGoal G in x)
    {
      PS.AssignPIndex(G, tol);
      GoalList.Add(G);
    }

    int counter = 0;
    double threshold = 1e-15;
    do
    {
      PS.Step(GoalList, true, 1); // The step will iterate until either reaching 15ms or the energy threshold
      counter++;
    }while(PS.GetvSum() > threshold && counter < 100); //GetvSum returns the current kinetic energy
    // always include a counter to prevent it getting stuck forever in case it cannot reach the given threshold

    A = PS.GetOutput(GoalList);
    B = counter;
# ---------- end same_as_kangaroo_solver ----------
same_as_kangaroo_solver_2 = CSharpScript(x=bang.Branch1, Reference="F:\Program files\grasshopper\Plug-ins\Grasshopper\Components\KangarooSolver.dll")  # -> out, A, B; inputs x: list; disabled; same code as same_as_kangaroo_solver
same_as_kangaroo_solver_3 = CSharpScript(x=bang.Branch2, Reference="F:\Program files\grasshopper\Plug-ins\Grasshopper\Components\KangarooSolver.dll")  # -> out, A, B; inputs x: list; disabled; same code as same_as_kangaroo_solver
same_as_kangaroo_solver_4 = CSharpScript(x=bang.Branch3, Reference="F:\Program files\grasshopper\Plug-ins\Grasshopper\Components\KangarooSolver.dll")  # -> out, A, B; inputs x: list; disabled; same code as same_as_kangaroo_solver
same_as_kangaroo_solver_5 = CSharpScript(x=bang.Branch4, Reference="F:\Program files\grasshopper\Plug-ins\Grasshopper\Components\KangarooSolver.dll")  # -> out, A, B; inputs x: list; disabled; same code as same_as_kangaroo_solver
same_as_kangaroo_solver_6 = CSharpScript(x=bang.Branch5, Reference="F:\Program files\grasshopper\Plug-ins\Grasshopper\Components\KangarooSolver.dll")  # -> out, A, B; inputs x: list; disabled; same code as same_as_kangaroo_solver

merge = Merge(
    Data1=same_as_kangaroo_solver.A,
    Data2=same_as_kangaroo_solver_2.A,
    Data3=same_as_kangaroo_solver_3.A,
    Data4=same_as_kangaroo_solver_4.A,
    Data5=same_as_kangaroo_solver_5.A,
    Data6=same_as_kangaroo_solver_6.A)  # disabled
panel_2 = Panel(same_as_kangaroo_solver.A)  # disabled

# ==== cluster Cluster_5
list = ClusterInput()
list_2 = ClusterInput()
list_3 = ClusterInput()
list_4 = ClusterInput()
list_5 = ClusterInput()
list_6 = ClusterInput()
list_7 = ClusterInput()
list_8 = ClusterInput()
data = ClusterInput()
data_2 = ClusterInput()
list_9 = ClusterInput()
list_10 = ClusterInput()
list_11 = ClusterInput()
list_12 = ClusterInput()
list_13 = ClusterInput()
list_14 = ClusterInput()
list_15 = ClusterInput()
data_3 = Data(data)
data_4 = Data(data_2)
list_16 = ClusterInput()
list_17 = ClusterInput()
list_18 = ClusterInput()
list_19 = ClusterInput()
list_20 = ClusterInput()
list_21 = ClusterInput()
list_22 = ClusterInput()
list_23 = ClusterInput()
list_24 = ClusterInput()
list_25 = ClusterInput()
list_26 = ClusterInput()
list_27 = ClusterInput()
list_28 = ClusterInput()
list_29 = ClusterInput()
list_30 = ClusterInput()
list_31 = ClusterInput()
list_32 = ClusterInput()
list_33 = ClusterInput()
list_34 = ClusterInput()
list_35 = ClusterInput()
list_36 = ClusterInput()
list_37 = ClusterInput()
list_38 = ClusterInput()
list_39 = ClusterInput()
list_40 = ClusterInput()
list_41 = ClusterInput()
list_42 = ClusterInput()
list_43 = ClusterInput()
list_44 = ClusterInput()
list_45 = ClusterInput()
list_46 = ClusterInput()
list_47 = ItemSelector(list_20, {"{0.424264, 1.024265, -0.92}"}, selected="{0.424264, 1.024265, -0.92}")
list_48 = ClusterInput()
list_49 = ItemSelector(list_22, {"{-1.024265, 0.424264, -0.92}"}, selected="{-1.024265, 0.424264, -0.92}")
list_50 = ItemSelector(list_23, {"{-0.424264, -1.024265, -0.92}"}, selected="{-0.424264, -1.024265, -0.92}")
list_51 = ItemSelector(list_25, {"{1.024265, -0.424264, -0.92}"}, selected="{1.024265, -0.424264, -0.92}")
list_52 = ItemSelector(list_26, {"{0.424264, 1.024265, 1.08}"}, selected="{0.424264, 1.024265, 1.08}")
list_53 = ItemSelector(list_28, {"{0.424264, 1.024265, -0.96}"}, selected="{0.424264, 1.024265, -0.96}")
list_54 = ItemSelector(list_29, {"{-1.024265, 0.424264, 1.08}"}, selected="{-1.024265, 0.424264, 1.08}")
list_55 = ItemSelector(list_30, {"{-0.424264, -1.024265, 1.08}"}, selected="{-0.424264, -1.024265, 1.08}")
list_56 = ItemSelector(list_31, {"{-1.024265, 0.424264, -0.96}"}, selected="{-1.024265, 0.424264, -0.96}")
list_57 = ItemSelector(list_32, {"{-0.424264, -1.024265, -0.96}"}, selected="{-0.424264, -1.024265, -0.96}")
list_58 = ItemSelector(list_33, {"{0.424264, 1.024265, 1.04}"}, selected="{0.424264, 1.024265, 1.04}")
list_59 = ItemSelector(list_34, {"{1.024265, -0.424264, 1.08}"}, selected="{1.024265, -0.424264, 1.08}")
number_slider = Slider(10000, range=0..10000)
list_60 = ItemSelector(list_35, {"{1.024265, -0.424264, -0.96}"}, selected="{1.024265, -0.424264, -0.96}")
list_61 = ItemSelector(list_37, {"{-1.024265, 0.424264, 1.04}"}, selected="{-1.024265, 0.424264, 1.04}")
list_62 = ItemSelector(list_38, {"{-0.424264, -1.024265, 1.04}"}, selected="{-0.424264, -1.024265, 1.04}")
list_63 = ItemSelector(list_39, {"{1.024265, -0.424264, 1.04}"}, selected="{1.024265, -0.424264, 1.04}")
list_64 = ClusterInput()
list_65 = ClusterInput()
list_66 = ClusterInput()
list_67 = ClusterInput()
list_68 = ClusterInput()
list_69 = ClusterInput()
list_70 = ClusterInput()
list_71 = ClusterInput()
list_72 = ClusterInput()
list_73 = ClusterInput()
list_74 = ClusterInput()
list_75 = ClusterInput()
list_76 = ClusterInput()
list_77 = ClusterInput()
list_78 = ClusterInput()
list_79 = ClusterInput()
list_80 = ClusterInput()
list_81 = ClusterInput()
list_82 = ClusterInput()
list_83 = ClusterInput()
list_84 = ClusterInput()
list_85 = ClusterInput()
list_86 = ClusterInput()
list_87 = ClusterInput()
list_88 = ClusterInput()
list_89 = ClusterInput()
list_90 = ClusterInput()
list_91 = ClusterInput()
list_92 = ClusterInput()
list_93 = ClusterInput()
list_94 = ClusterInput()
list_95 = ClusterInput()
list_96 = ClusterInput()
list_97 = ClusterInput()
list_98 = ClusterInput()
list_99 = ClusterInput()
list_100 = ClusterInput()
list_101 = ClusterInput()
list_102 = ClusterInput()
list_103 = ClusterInput()
points = ClusterInput()
list_104 = ClusterInput()
list_105 = ClusterInput()
list_106 = ClusterInput()
list_107 = ClusterInput()
list_108 = ClusterInput()
list_109 = ClusterInput()
list_110 = ClusterInput()
list_111 = ClusterInput()
list_112 = ClusterInput()
list_113 = ClusterInput()
list_114 = ClusterInput()

list_115 = ItemSelector(list, {"{-0.424264, -0.424264, 1.177}"}, selected="{-0.424264, -0.424264, 1.177}")
list_116 = ItemSelector(list_3, {"{-0.424264, -0.424264, 1.16}"}, selected="{-0.424264, -0.424264, 1.16}")
list_117 = ItemSelector(list_9, {"{-0.6, 0, -1.017}"}, selected="{-0.6, 0, -1.017}")
list_118 = ItemSelector(list_11, {"{-0.6, 0, -1}"}, selected="{-0.6, 0, -1}")
list_119 = ItemSelector(list_16, {"{-0.424264, -0.424264, 0.177}"}, selected="{-0.424264, -0.424264, 0.177}")
list_120 = ItemSelector(list_19, {"{-0.424264, -0.424264, 0.16}"}, selected="{-0.424264, -0.424264, 0.16}")
list_121 = ItemSelector(list_40, {"{-0.6, 0, -0.017}"}, selected="{-0.6, 0, -0.017}")
list_122 = ItemSelector(list_43, {"{-0.6, 0, 0}"}, selected="{-0.6, 0, 0}")
list_123 = ItemSelector(list_105, {"{-1.024265, -0.424264, -0.92}"}, selected="{-1.024265, -0.424264, -0.92}")
list_124 = ItemSelector(list_107, {"{-1.024265, -0.424264, 1.04}"}, selected="{-1.024265, -0.424264, 1.04}")
list_125 = ItemSelector(list_110, {"{-1.024265, -0.424264, 1.08}"}, selected="{-1.024265, -0.424264, 1.08}")
list_126 = ItemSelector(list_114, {"{-1.024265, -0.424264, -0.96}"}, selected="{-1.024265, -0.424264, -0.96}")

list_127 = ClusterInput()

list_128 = ItemSelector(list_2, {"{-0.424264, 0.424264, 1.177}"}, selected="{-0.424264, 0.424264, 1.177}")
list_129 = ItemSelector(list_4, {"{-0.424264, 0.424264, 1.16}"}, selected="{-0.424264, 0.424264, 1.16}")
list_130 = ItemSelector(list_10, {"{0, 0.6, -1.017}"}, selected="{0, 0.6, -1.017}")
list_131 = ItemSelector(list_12, {"{0, 0.6, -1}"}, selected="{0, 0.6, -1}")
list_132 = ItemSelector(list_17, {"{-0.424264, 0.424264, 0.177}"}, selected="{-0.424264, 0.424264, 0.177}")
list_133 = ItemSelector(list_21, {"{-0.424264, 0.424264, 0.16}"}, selected="{-0.424264, 0.424264, 0.16}")
list_134 = ItemSelector(list_41, {"{0, 0.6, -0.017}"}, selected="{0, 0.6, -0.017}")
list_135 = ItemSelector(list_44, {"{0, 0.6, 0}"}, selected="{0, 0.6, 0}")
list_136 = ItemSelector(list_106, {"{-0.424264, 1.024265, -0.92}"}, selected="{-0.424264, 1.024265, -0.92}")
list_137 = ItemSelector(list_109, {"{-0.424264, 1.024265, 1.04}"}, selected="{-0.424264, 1.024265, 1.04}")
list_138 = ItemSelector(list_112, {"{-0.424264, 1.024265, 1.08}"}, selected="{-0.424264, 1.024265, 1.08}")
list_139 = ItemSelector(list_127, {"{-0.424264, 1.024265, -0.96}"}, selected="{-0.424264, 1.024265, -0.96}")

list_140 = ClusterInput()
list_141 = ClusterInput()
list_142 = ClusterInput()
list_143 = ClusterInput()
list_144 = ClusterInput()

list_145 = ItemSelector(list_5, {"{0.424264, -0.424264, 1.177}"}, selected="{0.424264, -0.424264, 1.177}")
list_146 = ItemSelector(list_6, {"{0.424264, -0.424264, 1.16}"}, selected="{0.424264, -0.424264, 1.16}")
list_147 = ItemSelector(list_13, {"{0, -0.6, -1.017}"}, selected="{0, -0.6, -1.017}")
list_148 = ItemSelector(list_14, {"{0, -0.6, -1}"}, selected="{0, -0.6, -1}")
list_149 = ItemSelector(list_18, {"{0.424264, -0.424264, 0.177}"}, selected="{0.424264, -0.424264, 0.177}")
list_150 = ItemSelector(list_24, {"{0.424264, -0.424264, 0.16}"}, selected="{0.424264, -0.424264, 0.16}")
list_151 = ItemSelector(list_42, {"{0, -0.6, -0.017}"}, selected="{0, -0.6, -0.017}")
list_152 = ItemSelector(list_46, {"{0, -0.6, 0}"}, selected="{0, -0.6, 0}")
list_153 = ItemSelector(list_111, {"{0.424264, -1.024265, -0.92}"}, selected="{0.424264, -1.024265, -0.92}")
list_154 = ItemSelector(list_141, {"{0.424264, -1.024265, 1.04}"}, selected="{0.424264, -1.024265, 1.04}")
list_155 = ItemSelector(list_142, {"{0.424264, -1.024265, 1.08}"}, selected="{0.424264, -1.024265, 1.08}")
list_156 = ItemSelector(list_144, {"{0.424264, -1.024265, -0.96}"}, selected="{0.424264, -1.024265, -0.96}")

list_157 = ClusterInput()
list_158 = ClusterInput()
list_159 = ClusterInput()
list_160 = ClusterInput()
list_161 = ClusterInput()
list_162 = ClusterInput()
list_163 = ClusterInput()
list_164 = ItemSelector(list_64, {"{-1.024265, 0.424264, -0.92}"}, selected="{-1.024265, 0.424264, -0.92}")
list_165 = ItemSelector(list_65, {"{-1.024265, 0.424264, -0.96}"}, selected="{-1.024265, 0.424264, -0.96}")
list_166 = ItemSelector(list_66, {"{-1.024265, -0.424264, -0.92}"}, selected="{-1.024265, -0.424264, -0.92}")
list_167 = ItemSelector(list_67, {"{-1.024265, -0.424264, -0.96}"}, selected="{-1.024265, -0.424264, -0.96}")
list_168 = ItemSelector(list_68, {"{-0.424264, -0.424264, 1.16}"}, selected="{-0.424264, -0.424264, 1.16}")
list_169 = ItemSelector(list_69, {"{1.024265, -0.424264, -0.92}"}, selected="{1.024265, -0.424264, -0.92}")
list_170 = ItemSelector(list_70, {"{1.024265, -0.424264, -0.96}"}, selected="{1.024265, -0.424264, -0.96}")
list_171 = ItemSelector(list_71, {"{1.024265, 0.424264, -0.92}"}, selected="{1.024265, 0.424264, -0.92}")
list_172 = ItemSelector(list_72, {"{-0.424264, -0.424264, 1.177}"}, selected="{-0.424264, -0.424264, 1.177}")
list_173 = ItemSelector(list_73, {"{-0.424264, -1.024265, -0.92}"}, selected="{-0.424264, -1.024265, -0.92}")
list_174 = ItemSelector(list_74, {"{-0.424264, -1.024265, -0.96}"}, selected="{-0.424264, -1.024265, -0.96}")
list_175 = ItemSelector(list_75, {"{1.024265, 0.424264, -0.96}"}, selected="{1.024265, 0.424264, -0.96}")
list_176 = ItemSelector(list_76, {"{0.424264, 1.024265, -0.92}"}, selected="{0.424264, 1.024265, -0.92}")
list_177 = ItemSelector(list_77, {"{0.424264, 1.024265, -0.96}"}, selected="{0.424264, 1.024265, -0.96}")
list_178 = ItemSelector(list_78, {"{0.424264, -1.024265, -0.92}"}, selected="{0.424264, -1.024265, -0.92}")
list_179 = ItemSelector(list_79, {"{-1.024265, -0.424264, 1.04}"}, selected="{-1.024265, -0.424264, 1.04}")
list_180 = ItemSelector(list_80, {"{-0.424264, 1.024265, -0.92}"}, selected="{-0.424264, 1.024265, -0.92}")
list_181 = ItemSelector(list_81, {"{-1.024265, -0.424264, 1.08}"}, selected="{-1.024265, -0.424264, 1.08}")
list_182 = ItemSelector(list_82, {"{0.424264, 0.424264, 1.16}"}, selected="{0.424264, 0.424264, 1.16}")
list_183 = ItemSelector(list_83, {"{0.424264, -1.024265, -0.96}"}, selected="{0.424264, -1.024265, -0.96}")
list_184 = ItemSelector(list_84, {"{0.424264, -0.424264, 1.16}"}, selected="{0.424264, -0.424264, 1.16}")
list_185 = ItemSelector(list_85, {"{-0.424264, 1.024265, -0.96}"}, selected="{-0.424264, 1.024265, -0.96}")
list_186 = ItemSelector(list_86, {"{-0.424264, 0.424264, 1.16}"}, selected="{-0.424264, 0.424264, 1.16}")
list_187 = ItemSelector(list_87, {"{0.424264, 0.424264, 1.177}"}, selected="{0.424264, 0.424264, 1.177}")
list_188 = ItemSelector(list_88, {"{0.424264, 1.024265, 1.08}"}, selected="{0.424264, 1.024265, 1.08}")
list_189 = ItemSelector(list_89, {"{-0.424264, -1.024265, 1.08}"}, selected="{-0.424264, -1.024265, 1.08}")
list_190 = ItemSelector(list_90, {"{0.424264, -0.424264, 1.177}"}, selected="{0.424264, -0.424264, 1.177}")
list_191 = ItemSelector(list_91, {"{-0.424264, 0.424264, 1.177}"}, selected="{-0.424264, 0.424264, 1.177}")
list_192 = ItemSelector(list_92, {"{-0.424264, -1.024265, 1.04}"}, selected="{-0.424264, -1.024265, 1.04}")
list_193 = ItemSelector(list_93, {"{1.024265, 0.424264, 1.04}"}, selected="{1.024265, 0.424264, 1.04}")
list_194 = ItemSelector(list_94, {"{1.024265, 0.424264, 1.08}"}, selected="{1.024265, 0.424264, 1.08}")
list_195 = ItemSelector(list_95, {"{0.424264, -1.024265, 1.04}"}, selected="{0.424264, -1.024265, 1.04}")
list_196 = ItemSelector(list_96, {"{0.424264, -1.024265, 1.08}"}, selected="{0.424264, -1.024265, 1.08}")
list_197 = ItemSelector(list_97, {"{-0.424264, 1.024265, 1.04}"}, selected="{-0.424264, 1.024265, 1.04}")
list_198 = ItemSelector(list_98, {"{-0.424264, 1.024265, 1.08}"}, selected="{-0.424264, 1.024265, 1.08}")
list_199 = ItemSelector(list_99, {"{1.024265, -0.424264, 1.08}"}, selected="{1.024265, -0.424264, 1.08}")
list_200 = ItemSelector(list_100, {"{0.424264, 1.024265, 1.04}"}, selected="{0.424264, 1.024265, 1.04}")
list_201 = ItemSelector(list_101, {"{-1.024265, 0.424264, 1.08}"}, selected="{-1.024265, 0.424264, 1.08}")
list_202 = ItemSelector(list_102, {"{1.024265, -0.424264, 1.04}"}, selected="{1.024265, -0.424264, 1.04}")
list_203 = ItemSelector(list_103, {"{-1.024265, 0.424264, 1.04}"}, selected="{-1.024265, 0.424264, 1.04}")
list_204 = ItemSelector(list_104, {"{0, 0.6, -1.017}"}, selected="{0, 0.6, -1.017}")
list_205 = ItemSelector(list_108, {"{-0.6, 0, -1.017}"}, selected="{-0.6, 0, -1.017}")
list_206 = ItemSelector(list_113, {"{-0.6, 0, -1}"}, selected="{-0.6, 0, -1}")
list_207 = ItemSelector(list_143, {"{0.6, 0, -1.017}"}, selected="{0.6, 0, -1.017}")
list_208 = ItemSelector(list_157, {"{0.6, 0, -1}"}, selected="{0.6, 0, -1}")
list_209 = ItemSelector(list_159, {"{0, -0.6, -1.017}"}, selected="{0, -0.6, -1.017}")
list_210 = ItemSelector(list_160, {"{0, -0.6, -1}"}, selected="{0, -0.6, -1}")
list_211 = ItemSelector(list_162, {"{0, 0.6, -1}"}, selected="{0, 0.6, -1}")
d1 = ClusterInput()
d2 = ClusterInput()
d1_2 = ClusterInput()
d2_2 = ClusterInput()

point = Point(list_58)
point_2 = Point(list_53)
point_3 = Point(list_52)
point_4 = Point(list_47)
C = Coincident(Point0=point_4, Point1=point_3, Strength=100)
C_2 = Coincident(Point0=point_2, Point1=point, Strength=100)

point_5 = Point(list_61)
point_6 = Point(list_56)
point_7 = Point(list_54)
point_8 = Point(list_49)
C_3 = Coincident(Point0=point_8, Point1=point_7, Strength=100)
C_4 = Coincident(Point0=point_6, Point1=point_5, Strength=100)

point_9 = Point(list_62)
point_10 = Point(list_57)
point_11 = Point(list_55)
point_12 = Point(list_50)
C_5 = Coincident(Point0=point_12, Point1=point_11, Strength=100)
C_6 = Coincident(Point0=point_10, Point1=point_9, Strength=100)

point_13 = Point(list_63)
point_14 = Point(list_60)
point_15 = Point(list_59)
point_16 = Point(list_51)
C_7 = Coincident(Point0=point_16, Point1=point_15, Strength=100)
C_8 = Coincident(Point0=point_14, Point1=point_13, Strength=100)

a3 = ClusterInput()
merge = Merge(Data1=d1, Data2=d2)
b3 = ClusterInput()
merge_2 = Merge(Data1=d1_2, Data2=d2_2)
A = ClusterInput()
a2 = ClusterInput()
b2 = ClusterInput()
a4 = ClusterInput()
B = ClusterInput()
b4 = ClusterInput()
B_2 = ClusterInput()

# ----
# A3 B3
a3_2 = Brep(a3)
pt = Point([list_206, list_205, list_164, list_165, list_166, list_167])
b3_2 = Brep(b3)
pt_2 = Point([list_168, list_172, list_181, list_179, list_189, list_192])
debrep = DeconstructBrep(Brep=b3_2)  # -> Faces, Edges, Vertices
debrep_2 = DeconstructBrep(Brep=a3_2)  # -> Faces, Edges, Vertices
rigidbody = RigidBody(Part=a3_2, Points=flatten([debrep_2.Vertices, pt]), Strength=10)  # -> RigidBody, Planes
rigidbody_2 = RigidBody(Part=b3_2, Points=flatten([debrep.Vertices, pt_2]), Strength=10)  # -> RigidBody, Planes

A_2 = ClusterInput()

# ----
# A1 B1
A_3 = Brep(A)
B_3 = Brep(B)
pt_3 = Point([list_208, list_207, list_171, list_175, list_169, list_170])
pt_4 = Point([list_182, list_187, list_194, list_193, list_188, list_200])
debrep_3 = DeconstructBrep(Brep=A_3)  # -> Faces, Edges, Vertices
debrep_4 = DeconstructBrep(Brep=B_3)  # -> Faces, Edges, Vertices
rigidbody_3 = RigidBody(Part=A_3, Points=flatten([debrep_3.Vertices, pt_3]), Strength=10)  # -> RigidBody, Planes
rigidbody_4 = RigidBody(Part=B_3, Points=flatten([debrep_4.Vertices, pt_4]), Strength=10)  # -> RigidBody, Planes

# ----
# A2 B2
a2_2 = Brep(a2)
pt_5 = Point([list_211, list_204, list_176, list_177, list_180, list_185])
b2_2 = Brep(b2)
pt_6 = Point([list_186, list_191, list_198, list_197, list_201, list_203])
debrep_5 = DeconstructBrep(Brep=b2_2)  # -> Faces, Edges, Vertices
debrep_6 = DeconstructBrep(Brep=a2_2)  # -> Faces, Edges, Vertices
rigidbody_5 = RigidBody(Part=a2_2, Points=flatten([debrep_6.Vertices, pt_5]), Strength=10)  # -> RigidBody, Planes
rigidbody_6 = RigidBody(Part=b2_2, Points=flatten([debrep_5.Vertices, pt_6]), Strength=10)  # -> RigidBody, Planes

# ----
# A4 B4
a4_2 = Brep(a4)
b4_2 = Brep(b4)
pt_7 = Point([list_210, list_209, list_173, list_174, list_178, list_183])
pt_8 = Point([list_184, list_190, list_196, list_195, list_199, list_202])
debrep_7 = DeconstructBrep(Brep=a4_2)  # -> Faces, Edges, Vertices
debrep_8 = DeconstructBrep(Brep=b4_2)  # -> Faces, Edges, Vertices
rigidbody_7 = RigidBody(Part=a4_2, Points=flatten([debrep_7.Vertices, pt_7]), Strength=10)  # -> RigidBody, Planes
rigidbody_8 = RigidBody(Part=b4_2, Points=flatten([debrep_8.Vertices, pt_8]), Strength=10)  # -> RigidBody, Planes

# ----
# A
pt_9 = Point(merge_2)
A_4 = Brep(A_2)
debrep_9 = DeconstructBrep(Brep=A_4)  # -> Faces, Edges, Vertices
list_212 = ItemSelector(
    debrep_9.Faces,
    {"Untrimmed Surface", "Untrimmed Surface", "Untrimmed Surface", "Trimmed Surface", "Trimmed Surface", "Untrimmed Surface", "Untrimmed Surface", "Untrimmed Surface"}, selected="Trimmed Surface")
area = Area(Geometry=list_212)  # -> Area, Centroid
xy = XYPlane(Origin=area.Centroid)
rigidbody_9 = RigidBody(Part=A_4, Plane=xy, Points=flatten([debrep_9.Vertices, pt_9]), Strength=10)  # -> RigidBody, Planes
support = Support(Frame=rigidbody_9.Planes, X=True, Y=True, Z=True, XX=True, YY=True, ZZ=True, Strength=100)

au = Point(list_136)
bu = Point(list_138)
_1_a_d = Point(list_130)
a_1_d = Point(list_134)
C_9 = Coincident(Point0=_1_a_d, Point1=a_1_d, Strength=100)
C_10 = Coincident(Point0=au, Point1=bu, Strength=100)
ad = Point(list_139)
bd = Point(list_137)
b_1_u = Point(list_132)
_1_b_u = Point(list_128)
C_11 = Coincident(Point0=ad, Point1=bd, Strength=100)
C_12 = Coincident(Point0=_1_b_u, Point1=b_1_u, Strength=100)
_1_a_u = Point(list_131)
a_1_u = Point(list_135)
b_1_d = Point(list_133)
_1_b_d = Point(list_129)
C_13 = Coincident(Point0=_1_a_u, Point1=a_1_u, Strength=100)
C_14 = Coincident(Point0=_1_b_d, Point1=b_1_d, Strength=100)

au_2 = Point(list_123)
bu_2 = Point(list_125)
_1_a_d_2 = Point(list_117)
a_1_d_2 = Point(list_121)
C_15 = Coincident(Point0=_1_a_d_2, Point1=a_1_d_2, Strength=100)
C_16 = Coincident(Point0=au_2, Point1=bu_2, Strength=100)
ad_2 = Point(list_126)
bd_2 = Point(list_124)
b_1_u_2 = Point(list_119)
_1_b_u_2 = Point(list_115)
C_17 = Coincident(Point0=ad_2, Point1=bd_2, Strength=100)
C_18 = Coincident(Point0=_1_b_u_2, Point1=b_1_u_2, Strength=100)
_1_a_u_2 = Point(list_118)
a_1_u_2 = Point(list_122)
b_1_d_2 = Point(list_120)
_1_b_d_2 = Point(list_116)
C_19 = Coincident(Point0=_1_a_u_2, Point1=a_1_u_2, Strength=100)
C_20 = Coincident(Point0=_1_b_d_2, Point1=b_1_d_2, Strength=100)

# ----
# B
B_4 = Brep(B_2)
pt_10 = Point(merge)
debrep_10 = DeconstructBrep(Brep=B_4)  # -> Faces, Edges, Vertices
list_213 = ItemSelector(
    debrep_10.Faces,
    {"Untrimmed Surface", "Untrimmed Surface", "Untrimmed Surface", "Trimmed Surface", "Trimmed Surface", "Untrimmed Surface", "Untrimmed Surface", "Untrimmed Surface"}, selected="Trimmed Surface")
area_2 = Area(Geometry=list_213)  # -> Area, Centroid
xy_2 = XYPlane(Origin=area_2.Centroid)
rigidbody_10 = RigidBody(Part=B_4, Plane=xy_2, Points=flatten([debrep_10.Vertices, pt_10]), Strength=10)  # -> RigidBody, Planes
support_2 = Support(Frame=rigidbody_10.Planes, X=True, Y=True, Z=True, XX=True, YY=True, ZZ=False, Strength=100)

au_3 = Point(list_153)
bu_3 = Point(list_155)
_1_a_d_3 = Point(list_147)
a_1_d_3 = Point(list_151)
C_21 = Coincident(Point0=_1_a_d_3, Point1=a_1_d_3, Strength=100)
C_22 = Coincident(Point0=au_3, Point1=bu_3, Strength=100)
ad_3 = Point(list_156)
bd_3 = Point(list_154)
b_1_u_3 = Point(list_149)
_1_b_u_3 = Point(list_145)
C_23 = Coincident(Point0=ad_3, Point1=bd_3, Strength=100)
C_24 = Coincident(Point0=_1_b_u_3, Point1=b_1_u_3, Strength=100)
_1_a_u_3 = Point(list_148)
a_1_u_3 = Point(list_152)
b_1_d_3 = Point(list_150)
_1_b_d_3 = Point(list_146)
C_25 = Coincident(Point0=_1_a_u_3, Point1=a_1_u_3, Strength=100)
C_26 = Coincident(Point0=_1_b_d_3, Point1=b_1_d_3, Strength=100)

list_214 = ItemSelector(
    debrep_2.Faces,
    {"Trimmed Surface", "Untrimmed Surface", "Untrimmed Surface", "Untrimmed Surface", "Untrimmed Surface", "Trimmed Surface", "Untrimmed Surface", "Untrimmed Surface", "Trimmed Surface", "Trimmed Surface", "Trimmed Surface", "Untrimmed Surface", "Trimmed Surface"}, selected="Trimmed Surface")
list_215 = ClusterOutput(list_212)
list_216 = ClusterInput()

list_217 = ItemSelector(list_7, {"{0.424264, 0.424264, 1.177}"}, selected="{0.424264, 0.424264, 1.177}")
list_218 = ItemSelector(list_8, {"{0.424264, 0.424264, 1.16}"}, selected="{0.424264, 0.424264, 1.16}")
list_219 = ItemSelector(list_15, {"{0.6, 0, -1.017}"}, selected="{0.6, 0, -1.017}")
list_220 = ItemSelector(list_27, {"{0.424264, 0.424264, 0.16}"}, selected="{0.424264, 0.424264, 0.16}")
list_221 = ItemSelector(list_36, {"{0.424264, 0.424264, 0.177}"}, selected="{0.424264, 0.424264, 0.177}")
list_222 = ItemSelector(list_45, {"{0.6, 0, -0.017}"}, selected="{0.6, 0, -0.017}")
list_223 = ItemSelector(list_48, {"{0.6, 0, 0}"}, selected="{0.6, 0, 0}")
list_224 = ItemSelector(list_140, {"{1.024265, 0.424264, -0.92}"}, selected="{1.024265, 0.424264, -0.92}")
list_225 = ItemSelector(list_158, {"{1.024265, 0.424264, 1.04}"}, selected="{1.024265, 0.424264, 1.04}")
list_226 = ItemSelector(list_161, {"{1.024265, 0.424264, -0.96}"}, selected="{1.024265, 0.424264, -0.96}")
list_227 = ItemSelector(list_163, {"{1.024265, 0.424264, 1.08}"}, selected="{1.024265, 0.424264, 1.08}")
list_228 = ItemSelector(list_216, {"{0.6, 0, -1}"}, selected="{0.6, 0, -1}")

a1 = Point(list_224)
b1 = Point(list_227)
_1_a_d_4 = Point(list_219)
a_1_d_4 = Point(list_222)
C_27 = Coincident(Point0=_1_a_d_4, Point1=a_1_d_4, Strength=100)
C_28 = Coincident(Point0=a1, Point1=b1, Strength=100)
a2_3 = Point(list_226)
b2_3 = Point(list_225)
b_1_u_4 = Point(list_221)
_1_b_u_4 = Point(list_217)
C_29 = Coincident(Point0=a2_3, Point1=b2_3, Strength=100)
C_30 = Coincident(Point0=_1_b_u_4, Point1=b_1_u_4, Strength=100)
_1_a_u_4 = Point(list_228)
a_1_u_4 = Point(list_223)
b_1_d_4 = Point(list_220)
_1_b_d_4 = Point(list_218)
C_31 = Coincident(Point0=_1_a_u_4, Point1=a_1_u_4, Strength=100)
C_32 = Coincident(Point0=_1_b_d_4, Point1=b_1_d_4, Strength=100)

list_229 = ClusterOutput(list_213)
list_230 = ItemSelector(
    debrep_6.Faces,
    {"Trimmed Surface", "Untrimmed Surface", "Untrimmed Surface", "Untrimmed Surface", "Untrimmed Surface", "Trimmed Surface", "Untrimmed Surface", "Untrimmed Surface", "Trimmed Surface", "Trimmed Surface", "Trimmed Surface", "Untrimmed Surface", "Trimmed Surface"}, selected="Trimmed Surface")
V = ClusterOutput(debrep_10.Vertices)
list_231 = ItemSelector(
    debrep_8.Faces,
    {"Untrimmed Surface", "Trimmed Surface", "Untrimmed Surface", "Trimmed Surface", "Trimmed Surface", "Untrimmed Surface", "Untrimmed Surface", "Untrimmed Surface", "Untrimmed Surface", "Trimmed Surface", "Trimmed Surface", "Trimmed Surface", "Trimmed Surface", "Untrimmed Surface", "Trimmed Surface"}, selected="Trimmed Surface")
list_232 = ItemSelector(
    debrep_3.Faces,
    {"Trimmed Surface", "Untrimmed Surface", "Untrimmed Surface", "Untrimmed Surface", "Untrimmed Surface", "Trimmed Surface", "Untrimmed Surface", "Untrimmed Surface", "Trimmed Surface", "Trimmed Surface", "Trimmed Surface", "Untrimmed Surface", "Trimmed Surface"}, selected="Trimmed Surface")
item = ListItem(List=debrep_6.Faces, Index=Slider(0, range=0..10), Wrap=True)
list_233 = ItemSelector(
    debrep_5.Faces,
    {"Untrimmed Surface", "Trimmed Surface", "Untrimmed Surface", "Trimmed Surface", "Trimmed Surface", "Untrimmed Surface", "Untrimmed Surface", "Untrimmed Surface", "Untrimmed Surface", "Trimmed Surface", "Trimmed Surface", "Trimmed Surface", "Trimmed Surface", "Untrimmed Surface", "Trimmed Surface"}, selected="Trimmed Surface")
list_234 = ItemSelector(
    debrep_4.Faces,
    {"Untrimmed Surface", "Trimmed Surface", "Untrimmed Surface", "Trimmed Surface", "Trimmed Surface", "Untrimmed Surface", "Untrimmed Surface", "Untrimmed Surface", "Untrimmed Surface", "Trimmed Surface", "Trimmed Surface", "Trimmed Surface", "Trimmed Surface", "Untrimmed Surface", "Trimmed Surface"}, selected="Trimmed Surface")
list_235 = ItemSelector(
    debrep.Faces,
    {"Untrimmed Surface", "Trimmed Surface", "Untrimmed Surface", "Trimmed Surface", "Trimmed Surface", "Untrimmed Surface", "Untrimmed Surface", "Untrimmed Surface", "Untrimmed Surface", "Trimmed Surface", "Trimmed Surface", "Trimmed Surface", "Trimmed Surface", "Untrimmed Surface", "Trimmed Surface"}, selected="Trimmed Surface")
list_236 = ItemSelector(
    debrep_3.Faces,
    {"Trimmed Surface", "Untrimmed Surface", "Untrimmed Surface", "Untrimmed Surface", "Untrimmed Surface", "Trimmed Surface", "Untrimmed Surface", "Untrimmed Surface", "Trimmed Surface", "Trimmed Surface", "Trimmed Surface", "Untrimmed Surface", "Trimmed Surface"}, selected="Trimmed Surface")
P = ClusterOutput(xy_2)
data_5 = Data(item)
list_237 = ItemSelector(
    debrep_6.Faces,
    {"Trimmed Surface", "Untrimmed Surface", "Untrimmed Surface", "Untrimmed Surface", "Untrimmed Surface", "Trimmed Surface", "Untrimmed Surface", "Untrimmed Surface", "Trimmed Surface", "Trimmed Surface", "Trimmed Surface", "Untrimmed Surface", "Trimmed Surface"}, selected="Trimmed Surface")
list_238 = ItemSelector(
    debrep_7.Faces,
    {"Trimmed Surface", "Untrimmed Surface", "Untrimmed Surface", "Untrimmed Surface", "Untrimmed Surface", "Trimmed Surface", "Untrimmed Surface", "Untrimmed Surface", "Trimmed Surface", "Trimmed Surface", "Trimmed Surface", "Untrimmed Surface", "Trimmed Surface"}, selected="Trimmed Surface")
alignfaces = AlignFaces(PlaneA=rigidbody_7.Planes, PlaneB=rigidbody_8.Planes, FaceA=list_238, FaceB=list_231, Flip=False, Strength=1)
list_239 = ItemSelector(
    debrep_2.Faces,
    {"Trimmed Surface", "Untrimmed Surface", "Untrimmed Surface", "Untrimmed Surface", "Untrimmed Surface", "Trimmed Surface", "Untrimmed Surface", "Untrimmed Surface", "Trimmed Surface", "Trimmed Surface", "Trimmed Surface", "Untrimmed Surface", "Trimmed Surface"}, selected="Trimmed Surface")
number_slider_2 = Slider(10000, range=0..10000)
A_5 = ClusterInput()
rotate = Rotate(Geometry=debrep_10.Vertices, Angle=degrees(A_5), Plane=xy_2)  # -> Geometry, Transform

alignfaces_2 = AlignFaces(PlaneA=rigidbody_9.Planes, PlaneB=rigidbody_3.Planes, FaceA=list_212, FaceB=list_232, Flip=False, Strength=1)
alignfaces_3 = AlignFaces(PlaneA=rigidbody_3.Planes, PlaneB=rigidbody_4.Planes, FaceA=list_236, FaceB=list_234, Flip=False, Strength=1)
alignfaces_4 = AlignFaces(PlaneA=rigidbody_3.Planes, PlaneB=rigidbody_5.Planes, FaceA=list_236, FaceB=list_237, Flip=False, Strength=1)
alignfaces_5 = AlignFaces(PlaneA=rigidbody_5.Planes, PlaneB=rigidbody_6.Planes, FaceA=list_237, FaceB=list_233, Flip=False, Strength=1)
alignfaces_6 = AlignFaces(PlaneA=rigidbody_5.Planes, PlaneB=rigidbody.Planes, FaceA=list_237, FaceB=list_239, Flip=False, Strength=1)
alignfaces_7 = AlignFaces(PlaneA=rigidbody.Planes, PlaneB=rigidbody_7.Planes, FaceA=list_239, FaceB=list_238, Flip=False, Strength=1)
alignfaces_8 = AlignFaces(PlaneA=rigidbody_3.Planes, PlaneB=rigidbody_7.Planes, FaceA=list_236, FaceB=list_238, Flip=False, Strength=1)
alignfaces_9 = AlignFaces(PlaneA=rigidbody.Planes, PlaneB=rigidbody_2.Planes, FaceA=list_239, FaceB=list_235, Flip=False, Strength=1)

number_slider_3 = Slider(6158, range=0..10000)
coplanar = CoPlanar(Points=points, Strength=number_slider_3)
points_2 = ClusterInput()
anchor = Anchor(Point=debrep_10.Vertices, Target=rotate.Geometry, Strength=10000)
coplanar_2 = CoPlanar(Points=points_2, Strength=number_slider_3)
merge_3 = Merge(Data1=rigidbody_10.RigidBody, Data2=support_2, Data3=anchor)  # -> flatten(Result)
merge_4 = Merge(Data1=C, Data2=C_2, Data3=C_3, Data4=C_4, Data5=C_5, Data6=C_6, Data7=C_7, Data8=C_8)
merge_5 = Merge(
    Data1=C_28,
    Data2=C_29,
    Data3=C_31,
    Data4=C_27,
    Data5=C_30,
    Data6=C_32,
    Data7=C_10,
    Data8=C_11,
    Data9=C_13,
    Data10=C_9,
    Data11=C_12,
    Data12=C_14,
    Data13=C_16,
    Data14=C_17,
    Data15=C_19,
    Data16=C_15,
    Data17=C_18,
    Data18=C_20,
    Data19=C_22,
    Data20=C_23,
    Data21=C_25,
    Data22=C_21,
    Data23=C_24,
    Data24=C_26)
knob = ControlKnob(Decimals=2, Limit=True, Maximum=50, Minimum=-50, Range=100, Value=38.93)
merge_6 = Merge(
    Data1=merge_3,
    Data2=support,
    Data3=rigidbody_9.RigidBody,
    Data4=rigidbody_3.RigidBody,
    Data5=rigidbody_4.RigidBody,
    Data6=rigidbody_5.RigidBody,
    Data7=rigidbody_6.RigidBody,
    Data8=rigidbody.RigidBody,
    Data9=rigidbody_2.RigidBody,
    Data10=rigidbody_7.RigidBody,
    Data11=rigidbody_8.RigidBody,
    Data12=anchor,
    Data13=coplanar,
    Data14=coplanar_2,
    Data16=alignfaces_7,
    Data17=alignfaces_6,
    Data18=alignfaces_4,
    Data19=alignfaces_8,
    Data20=alignfaces_3,
    Data21=alignfaces_5,
    Data22=alignfaces_9,
    Data23=alignfaces,
    Data24=alignfaces_2,
    Data25=merge_4,
    Data26=merge_5)  # -> flatten(Result); disabled
merge_7 = Merge(
    Data1=merge_3,
    Data2=support,
    Data3=rigidbody_9.RigidBody,
    Data4=rigidbody_3.RigidBody,
    Data5=rigidbody_4.RigidBody,
    Data6=rigidbody_5.RigidBody,
    Data7=rigidbody_6.RigidBody,
    Data8=rigidbody.RigidBody,
    Data9=rigidbody_2.RigidBody,
    Data10=rigidbody_7.RigidBody,
    Data11=rigidbody_8.RigidBody,
    Data12=coplanar,
    Data13=coplanar_2,
    Data15=alignfaces_7,
    Data16=alignfaces_6,
    Data17=alignfaces_4,
    Data18=alignfaces_8,
    Data19=alignfaces_3,
    Data20=alignfaces_5,
    Data21=alignfaces_9,
    Data22=alignfaces,
    Data23=alignfaces_2,
    Data24=merge_4,
    Data25=merge_5)  # -> flatten(Result)
R = ClusterOutput(merge_6)
R_2 = ClusterOutput(merge_7)

# ==== cluster Cluster_6
half_width_of_ring = Slider(0.02, range=0.01..0.1)
A = ClusterInput()
B = ClusterInput()
addition = Addition(A=A, B=B)
x = ClusterInput()
D = ClusterInput()
A_2 = ClusterInput()
x_2 = ClusterInput()
data = ClusterInput()
data_2 = Data(data)
number_slider = Slider(0.094, range=0..1)
l1 = ClusterInput()
l1_2 = ClusterInput()
number_slider_2 = Slider(45, range=0..100)
A_3 = ClusterInput()
B_2 = ClusterInput()
subtraction = Subtraction(A=half_width_of_ring, B=B_2)
B_3 = ClusterInput()
A_4 = ClusterInput()

factor_for_equal_sides = Slider(1.84776, range=1.1..2)
no_of_segments_octagon = Slider(4, range=4..12)
number_slider_3 = Slider(1.2, range=1.2..2)

eval = Evaluate(F="x*2", x=no_of_segments_octagon)
multiplication = Multiplication(A=A_2, B=factor_for_equal_sides)
eval_2 = Evaluate(F="x*2", x=x_2)

# ----
# Inner base
cir = Circle(Plane=PlaneXY(0, 0, 0), Radius=addition)
polygon = Polygon(Plane=PlaneXY(0, 0, 0), Radius=addition, Segments=no_of_segments_octagon, FilletRadius=0)  # -> Polygon, Length
explode = Explode(Curve=polygon.Polygon, Recursive=True)  # -> Segments, Vertices
item = ListItem(List=explode.Segments, Index=0, Wrap=True)

# ----
# Hole placement of outer
polygon_2 = Polygon(Plane=PlaneXY(0, 0, 0), Radius=multiplication, Segments=eval, FilletRadius=0)  # -> Polygon, Length
cir_2 = Circle(Plane=PlaneXY(0, 0, 0), Radius=multiplication)
explode_2 = Explode(Curve=polygon_2.Polygon, Recursive=True)  # -> Segments, Vertices
item_2 = ListItem(List=explode_2.Segments, Index=0, Wrap=True)

# ----
# Center of moving Circle
polygon_3 = Polygon(Plane=PlaneXY(0, 0, 0), Radius=eval_2, Segments=eval, FilletRadius=0)  # -> Polygon, Length
cir_3 = Circle(Plane=PlaneXY(0, 0, 0), Radius=eval_2)
explode_3 = Explode(Curve=polygon_3.Polygon, Recursive=True)  # -> Segments, Vertices
area = Area(Geometry=polygon_3.Polygon)  # -> Area, Centroid

area_2 = Area(Geometry=polygon.Polygon)  # -> Area, Centroid
area_3 = Area(Geometry=polygon_2.Polygon)  # -> Area, Centroid

number_slider_4 = Slider(22.5, range=0..100)
rotate = Rotate(Geometry=explode_2.Vertices, Angle=degrees(number_slider_4), Plane=area_3.Centroid)  # -> Geometry, Transform
rotate_2 = Rotate(Geometry=explode_2.Segments, Angle=degrees(number_slider_4), Plane=area_3.Centroid)  # -> Geometry, Transform

rotate_3 = Rotate(Geometry=explode_3.Segments, Angle=degrees(number_slider_4), Plane=area.Centroid)  # -> Geometry, Transform
rotate_4 = Rotate(Geometry=explode_3.Vertices, Angle=degrees(number_slider_4), Plane=area.Centroid)  # -> Geometry, Transform

# ----
# The Octagon Wings (unmodified)
neg = Negative(Value=x)
offset = OffsetCurve(Curve=rotate_3.Geometry, Distance=neg, Plane=PlaneXY(0, 0, 0), Corners=1)
offset_2 = OffsetCurve(Curve=rotate_3.Geometry, Distance=D, Plane=PlaneXY(0, 0, 0), Corners=1)
md_slider = MDSlider(SliderMode=0, slider_value=Point(0.5, 0.5, 0.5), x_domain=Domain(0, 1), y_domain=Domain(0, 1), z_domain=Domain(0, 1))
ext = ExtendCurve(Curve=offset_2, Type=0, Start=data_2, End=l1)
ext_2 = ExtendCurve(Curve=offset, Type=0, Start=data_2, End=l1_2)
loft = Loft(Curves=[ext, ext_2], Options={Adjust=False, Closed=False, LoftEnds=0, LoftSimp=0, LoftType=0, Rebuild=10, Refit=0.01})  # -> flatten(Loft)
evalsrf = EvaluateSurface(Surface=reparameterize(loft), Point=md_slider)  # -> Point, flatten(Normal), UDirection, VDirection, Frame
amp = Amplitude(Vector=evalsrf.Normal, Amplitude=A_3)
neg_2 = Negative(Value=amp)
multiplication_2 = Multiplication(A=amp, B=Slider(2, range=0..10))
extr = Extrude(Base=loft, Direction=amp)  # -> flatten(Extrusion)
move = Move(Geometry=extr, Motion=multiplication_2)  # -> simplify(flatten(Geometry)), Transform

rotate_5 = Rotate(Geometry=explode.Segments, Angle=degrees(number_slider_2), Plane=area_2.Centroid)  # -> Geometry, Transform
rotate_6 = Rotate(Geometry=explode.Vertices, Angle=degrees(number_slider_2), Plane=area_2.Centroid)  # -> Geometry, Transform

duppt = RemoveDuplicatePts(Points=explode_3.Vertices, Tolerance=0.01)
duppt_2 = RemoveDuplicatePts(Points=rotate_6.Geometry, Tolerance=0.01)
duppt_3 = RemoveDuplicatePts(Points=rotate_4.Geometry, Tolerance=0.01)
duppt_4 = RemoveDuplicatePts(Points=rotate.Geometry, Tolerance=0.01)

vertices = Data(explode.Vertices)
duppt_5 = RemoveDuplicatePts(Points=vertices, Tolerance=0.01)

weave = Weave(Pattern=[0, 1], Stream0=graft(duppt_5), Stream1=graft(duppt_2), NullGaps=False)  # -> flatten(Weave)

item_3 = ListItem(List=flatten(neg_2), Index=0, Wrap=True)
expression = Expression(x=item_3, Expression="x * 2")

i = ClusterOutput(item_3)

# ----
# Screw combining them together
panel = Panel("""0
1""")
dispatch = Dispatch(List=flatten(extr), DispatchPattern=panel)  # -> ListA, ListB
item_4 = ListItem(List=flatten(neg_2), Index=0, Wrap=True)
level_2_bars = Data(graft(dispatch.ListB))
center_pts_up = Data(duppt_4)
subtraction_2 = Subtraction(A=half_width_of_ring, B=B_3)
panel_2 = Panel(subtraction_2)
circle = CircleCNR(Center=center_pts_up, Normal=item_3, Radius=subtraction_2)
move_2 = Move(Geometry=simplify(center_pts_up), Motion=simplify(flatten(amp)))  # -> Geometry, Transform
boundary = BoundarySurfaces(Edges=circle)
level_1_bars = Data(dispatch.ListA)
extr_2 = Extrude(Base=boundary, Direction=flatten(amp))
center_pts_down = Data(move_2.Geometry)
move_3 = Move(Geometry=level_2_bars, Motion=item_4)  # -> Geometry, Transform
partition = PartitionList(List=extr_2, Size="2")  # -> simplify(Chunks)
merge = Merge(Data1=simplify(move_3.Geometry), Data2=partition)
sunion = SolidUnion(Breps=merge)

# ----
# Depth adopted
base_circle = Data(cir)
neg_3 = Negative(Value=half_width_of_ring)
offset_3 = OffsetCurve(Curve=base_circle, Distance=half_width_of_ring, Plane=PlaneXY(0, 0, 0), Corners=1)
offset_4 = OffsetCurve(Curve=base_circle, Distance=neg_3, Plane=PlaneXY(0, 0, 0), Corners=1)
loft_2 = Loft(
    Curves=[offset_3, offset_4],
    Options={Adjust=False, Closed=False, LoftEnds=0, LoftSimp=0, LoftType=0, Rebuild=10, Refit=0.01})

midpt = CurveMiddle(Curve=offset)
total_inner_vertces = Data(weave)
outer_vertices = Data(flatten(midpt))
shift = ShiftList(List=total_inner_vertces, Shift=1, Wrap=True)
list = ItemSelector(
    outer_vertices,
    {"{0.706156, 0.706156, 0}", "{0, 0.998655, 0}", "{-0.706156, 0.706156, 0}", "{-0.998655, 0, 0}", "{-0.706156, -0.706156, 0}", "{0, -0.998655, 0}", "{0.706156, -0.706156, 0}", "{0.998655, 0, 0}"}, selected="{0.706156, 0.706156, 0}")
ln = Line(StartPoint=outer_vertices, EndPoint=shift)
list_2 = ItemSelector(
    total_inner_vertces,
    {"{0.682, 0, 0}", "{0.482247, 0.482247, 0}", "{0, 0.682, 0}", "{-0.482247, 0.482247, 0}", "{-0.682, 0, 0}", "{-0.482247, -0.482247, 0}", "{0, -0.682, 0}", "{0.482247, -0.482247, 0}"}, selected="{0.682, 0, 0}")
panel_3 = Panel("""0
1""")
pipe = Pipe(Curve=ln, Radius=subtraction, Caps=0)  # -> flatten(Pipe)
expression_2 = Expression(x=item_3, Expression="3*x / 2")
expression_3 = Expression(x=item_3, Expression="x / 2")
dispatch_2 = Dispatch(List=pipe, DispatchPattern=panel_3)  # -> ListA, ListB
move_4 = Move(Geometry=dispatch_2.ListA, Motion=expression_3)  # -> simplify(graft(Geometry)), Transform
move_5 = Move(Geometry=dispatch_2.ListB, Motion=expression_2)  # -> simplify(graft(Geometry)), Transform

md_slider_2 = MDSlider(SliderMode=0, slider_value=Point(0.5, 0.5, 0.5), x_domain=Domain(0, 1), y_domain=Domain(0, 1), z_domain=Domain(0, 1))
evalsrf_2 = EvaluateSurface(Surface=loft_2, Point=md_slider_2)  # -> Point, Normal, UDirection, VDirection, Frame
amp_2 = Amplitude(Vector=evalsrf_2.Normal, Amplitude=A_4)
extr_3 = Extrude(Base=loft_2, Direction=amp_2)

sdiff = SolidDifference(BrepsA=graft(level_1_bars), BrepsB=flatten(partition))
G = ClusterOutput(move_4.Geometry)
G_2 = ClusterOutput(move_5.Geometry)
R = ClusterOutput(sdiff)
R_2 = ClusterOutput(sunion)

# ==== cluster Cluster
number_slider = Slider(1.77, range=0..3)  # disabled
fromp = FromPolylines(Weld=-1, Min_Triangulation=True)  # disabled
from_mesh = FromMesh(Mesh=fromp, ID=0, It=1000)  # -> Mesh, VertexID, Polylines; disabled
number_slider_2 = Slider(1.9, range=1..5)  # disabled
number_slider_3 = Slider(1, range=0..1)  # disabled
top = GetPolylines()  # disabled
number_slider_4 = Slider(0.84, range=0..1)  # disabled
recipricalextend = RecipricalExtend(Mesh=fromp, Angle=number_slider_4, Scale=number_slider, NormalType=True, Height=number_slider)  # -> CM, C0, C1, P, EP; disabled
recipricalextend_2 = RecipricalExtend(Angle=0.7, Scale=1.4, NormalType=True, Height=1)  # -> CM, C0, C1, P, EP; disabled
recipricaledges = RecipricalEdges(Mesh=fromp, Angle=expr("0", 0.7), Scale=number_slider_2, NormalType=number_slider_3)  # -> Curve, ID0, ID1, Vectors; disabled
offsettrianglemesh = OffsetTriangleMesh(Dist=0.01, Chamfer=0.001)  # -> P0, P1, S, P; disabled
number_slider_5 = Slider(4.15, range=0..5)  # disabled
data = Data(<missing>)  # disabled
A = ClusterInput()
panel = Panel("2")  # disabled
multiplication = Multiplication(A=A, B=panel)  # disabled
G = ClusterInput()
move = Move(Geometry=G, Motion=multiplication)  # -> Geometry, Transform; disabled
mirror = Mirror(Plane=PlaneYZ(0, 0, 0))  # -> Geometry, Transform; disabled
